# Grasshopper definition RGB_10_07.gh (Grasshopper 0.9.76)
# plug-ins: Python Interpreter

# ---- group: Circles
crv = Curve([<curve referenced from the Rhino model> x261])  # disabled
cpoly = ControlPolygon(Curve=graft(crv))  # -> Polygon, Points; disabled
redpline = Reduce(Polyline=cpoly.Polygon, Tolerance=1)  # -> Polyline, Reduction; disabled
cp = ControlPoints(Curve=redpline.Polyline)  # -> Points, Weights, Knots; disabled
lng = ListLength(List=cp.Points)  # disabled
subtraction = Subtraction(A=lng, B=1)  # disabled
degrees = Slider(155, range=150..180)  # disabled
distance = Slider(1.54, range=0..2.2)  # disabled
series = Series(Start=0, Step=1, Count=subtraction)  # disabled
item = ListItem(List=cp.Points, Index=series, Wrap=True)  # -> simplify(Item); disabled
py_clear_polyline_pts = PythonScript(crvs=simplify(item), a=degrees, d=distance)  # -> flatten(out), flatten(polylines), angs; inputs crvs: tree of Point3d; same code as py_clear_polyline_pts
toggle = BooleanToggle(True)  # disabled
cp_2 = ControlPoints(Curve=py_clear_polyline_pts.polylines)  # -> simplify(Points), Weights, Knots; disabled
lng_2 = ListLength(List=cp_2.Points)  # -> flatten(Length); disabled
pline = PolyLine(Vertices=cp_2.Points, Closed=toggle)  # disabled
area = Area(Geometry=pline)  # -> Area, Centroid; disabled
panel = Panel("0.15")  # disabled
multiplication = Multiplication(A=lng_2, B=panel)  # disabled
dist = Distance(PointA=area.Centroid, PointB=cp_2.Points)  # disabled
pt = Point(flatten(area.Centroid))  # disabled
panel_2 = Panel("1")  # disabled
sort = SortList(Keys=dist)  # -> Keys, ValuesA; disabled
eval = Evaluate(F="if(x>1, y, x)", x=multiplication, y=panel_2)  # disabled
rev = ReverseList(List=sort.Keys)  # disabled
area_2 = Area(Geometry=pline)  # -> flatten(Area), Centroid; disabled
item_2 = ListItem(List=rev, Index=0, Wrap=True)  # -> flatten(Item); disabled
cir = Circle(Plane=pt, Radius=item_2)  # disabled
area_3 = Area(Geometry=cir)  # -> Area, Centroid; disabled
division = Division(A=area_2.Area, B=area_3.Area)  # disabled
multiplication_2 = Multiplication(A=eval, B=division)  # disabled
number_slider = Slider(1, range=0..2)  # disabled
normalize_to_255 = NormalizeTo255(num=multiplication_2)  # disabled
number_slider_2 = Slider(0, range=0..100)  # disabled
multiplication_3 = Multiplication(A=number_slider, B=normalize_to_255)  # disabled
number_slider_3 = Slider(1, range=0..1)  # disabled
addition = Addition(A=multiplication_3, B=number_slider_2)  # disabled
boundary = BoundarySurfaces(Edges=crv)  # disabled
rgb = ColourRGB(Alpha=255, Red=0, Green=0, Blue=addition)  # disabled
transperancy_size = TransperancySize(G=crv, B=number_slider_3)  # disabled
multiplication_4 = Multiplication(A=rgb, B=transperancy_size)  # disabled
preview = CustomPreview(Geometry=boundary, Shader=multiplication_4)  # disabled

# ---- group: Oblong Forms
accuracy = Panel("100")  # disabled
pan = Panel("PI/2")  # disabled
crv_2 = Curve([<curve referenced from the Rhino model> x261])  # disabled
xy = XYPlane(Origin=Point(0, 0, 0))  # disabled
range = Range(Domain=pan, Steps=accuracy)  # disabled
prot = RotatePlane(Plane=xy, Angle=range)  # disabled
bbox = BoundingBox(Content=crv_2, Plane=graft(prot))  # -> Box, Box_2; disabled
flip = FlipMatrix(Data=bbox.Box)  # -> simplify(Data); disabled
area_4 = Area(Geometry=flip)  # -> Area, Centroid; disabled
sort_2 = SortList(Keys=area_4.Area, ValuesA=flip)  # -> Keys, ValuesA; disabled
item_3 = ListItem(List=sort_2.ValuesA, Index=0, Wrap=True)  # disabled
min_2d_boundingbox = Surface(item_3)  # disabled
lenseg = SegmentLengths(Curve=flatten(min_2d_boundingbox))  # -> ShortestLength, ShortestDomain, LongestLength, LongestDomain; disabled
number_slider_4 = Slider(0.7, range=0..1)  # disabled
division_2 = Division(A=lenseg.LongestLength, B=lenseg.ShortestLength)  # -> flatten(Result); disabled
area_5 = Area(Geometry=crv_2)  # -> flatten(Area), Centroid; disabled
area_6 = Area(Geometry=min_2d_boundingbox)  # -> flatten(Area), Centroid; disabled
number_slider_5 = Slider(0.5, range=0..1)  # disabled
norm_0_1 = Norm01(K=division_2)  # disabled
division_3 = Division(A=area_5.Area, B=area_6.Area)  # disabled
multiplication_5 = Multiplication(A=number_slider_4, B=division_3)  # disabled
multiplication_6 = Multiplication(A=norm_0_1, B=number_slider_5)  # disabled
addition_2 = Addition(A=multiplication_5, B=multiplication_6)  # disabled
number_slider_6 = Slider(1, range=0..1)  # disabled
number_slider_7 = Slider(30, range=0..100)  # disabled
normalize_to_255_2 = NormalizeTo255(num=addition_2)  # disabled
number_slider_8 = Slider(1, range=0..1)  # disabled
multiplication_7 = Multiplication(A=number_slider_6, B=normalize_to_255_2)  # disabled
addition_3 = Addition(A=multiplication_7, B=number_slider_7)  # disabled
boundary_2 = BoundarySurfaces(Edges=crv_2)  # disabled
rgb_2 = ColourRGB(Alpha=255, Red=0, Green=addition_3, Blue=0)  # disabled
transperancy_size_2 = TransperancySize(G=crv_2, B=number_slider_8)  # disabled
multiplication_8 = Multiplication(A=rgb_2, B=transperancy_size_2)  # disabled
preview_2 = CustomPreview(Geometry=boundary_2, Shader=multiplication_8)  # disabled

# ----
crv_3 = Curve([<curve referenced from the Rhino model> x3286])  # disabled

crv_4 = Curve([<curve referenced from the Rhino model> x3286])
rect = Rect(crv=crv_4)  # disabled
red = Red(rectanglness=rect, crv=[<geometry referenced from the Rhino model> x261])  # -> N, R; disabled
green = Green()  # -> N, R; disabled
blue = Blue()  # -> N, R; disabled
number_slider_9 = Slider(0.6, range=0..1)  # disabled
rect_ness = RectNess(crv=crv_4)  # disabled
number_slider_10 = Slider(0.6, range=0..1)  # disabled
number_slider_11 = Slider(0.9, range=0..1)  # disabled
number_slider_12 = Slider(0.6, range=0..1)  # disabled
r_square = RSquare(rectanglness=rect_ness, crv=crv_4)  # disabled
g_triangle = GTriangle(C=crv_4, B=number_slider_9)  # disabled
b_circle = BCircle(crv=crv_4)  # disabled
number_slider_13 = Slider(1, range=0..1)  # disabled
multiplication_9 = Multiplication(A=number_slider_11, B=r_square)  # disabled
multiplication_10 = Multiplication(A=number_slider_10, B=g_triangle)  # disabled
multiplication_11 = Multiplication(A=number_slider_12, B=b_circle)  # disabled
transperancy_size_3 = TransperancySize(G=crv_4, B=number_slider_13)  # disabled
rgb_3 = ColourRGB(Alpha=255, Red=multiplication_9, Green=multiplication_10, Blue=multiplication_11)  # disabled
multiplication_12 = Multiplication(A=rgb_3, B=transperancy_size_3)  # disabled
argb = SplitARGB(Colour=multiplication_12)  # -> Alpha, Red, Green, Blue; disabled
py_dominant_color = PythonScript(x=argb.Red, y=argb.Green, z=argb.Blue)  # -> r, g, b; inputs x: list, y: list, z: list; disabled
# ---------- py_dominant_color: Python ----------
__author__ = "NaamaGlauber"
import math
import clr
import Rhino as R
clr.AddReference("Grasshopper")

r = []
g = []
b = []
for i in range(len(x)):
    if x[i] >= y[i] and x[i] > z[i]:
        r.append(1)
        g.append(0)
        b.append(0)
    if y[i] > x[i] and y[i] >= z[i]:
        r.append(0)
        g.append(1)
        b.append(0)
    if z[i] >= x[i] and z[i] > y[i]:
        r.append(0)
        g.append(0)
        b.append(1)
# ---------- end py_dominant_color ----------
rgb_4 = ColourRGB(Alpha=255, Red=0, Green=py_dominant_color.g, Blue=0)  # disabled
number_slider_14 = Slider(1, range=0..1)  # disabled
multiplication_13 = Multiplication(A=rgb_4, B=255)  # disabled
subtraction_2 = Subtraction(A=1, B=number_slider_14)  # disabled
multiplication_14 = Multiplication(A=multiplication_12, B=subtraction_2)  # disabled
multiplication_15 = Multiplication(A=multiplication_13, B=number_slider_14)  # disabled
crv_5 = Curve(crv_4)  # disabled
addition_4 = Addition(A=multiplication_14, B=multiplication_15)  # disabled
boundary_3 = BoundarySurfaces(Edges=crv_4)  # disabled
preview_3 = CustomPreview(Geometry=boundary_3, Shader=multiplication_13)  # disabled
preview_4 = CustomPreview(Geometry=boundary_3, Shader=multiplication_12)  # disabled
preview_5 = CustomPreview(Geometry=boundary_3, Shader=addition_4)  # disabled

toggle_2 = BooleanToggle(True)  # disabled
number_slider_15 = Slider(1, range=0..1)  # disabled
number_slider_16 = Slider(1, range=0..1)  # disabled
multiplication_16 = Multiplication(A=number_slider_11, B=r_square)  # disabled
multiplication_17 = Multiplication(A=number_slider_12, B=b_circle)  # disabled
number_slider_17 = Slider(0, range=0..1)  # disabled
transperancy_size_4 = TransperancySize(G=crv_4, B=number_slider_16)  # disabled
subtraction_3 = Subtraction(A=1, B=number_slider_17)  # disabled
number_slider_18 = Slider(1, range=0..1)  # disabled
subtraction_4 = Subtraction(A=1, B=number_slider_18)  # disabled
boundary_4 = BoundarySurfaces(Edges=crv_4)  # disabled

crv_6 = Curve([<curve referenced from the Rhino model> x261])  # disabled
number_slider_19 = Slider(0, range=0..100)  # disabled
number_slider_20 = Slider(1, range=0..1)  # disabled

crv_7 = Curve(crv_6)  # disabled
divide = DivideCurve(Curve=crv_7, Count=10, Kinks=False)  # -> Points, Tangents, Parameters; disabled
cpoly_2 = ControlPolygon(Curve=graft(crv_7))  # -> Polygon, Points; disabled
number_slider_21 = Slider(100, range=99..100)  # disabled
redpline_2 = Reduce(Polyline=cpoly_2.Polygon, Tolerance=1)  # -> Polyline, Reduction; disabled
hull = ConvexHull(Points=divide.Points, Plane=PlaneXY(0, 0, 0))  # -> Hull, HullZ, Indices; disabled
cp_3 = ControlPoints(Curve=redpline_2.Polyline)  # -> Points, Weights, Knots; disabled
area_7 = Area(Geometry=hull.Hull)  # -> Area, Centroid; disabled
lng_3 = ListLength(List=cp_3.Points)  # disabled
expression = Expression(x=number_slider_21, y=area_7.Area, Expression="(x/y)^(1/2)")  # disabled
subtraction_5 = Subtraction(A=lng_3, B=1)  # disabled
number_slider_22 = Slider(50, range=0..100)  # disabled
series_2 = Series(Start=0, Step=1, Count=subtraction_5)  # disabled
scale = Scale(Geometry=hull.Hull, Center=area_7.Centroid, Factor=expression)  # -> Geometry, Transform; disabled
distance_2 = Slider(2.15, range=0..2.3)  # disabled
degrees_2 = Slider(155, range=150..180)  # disabled
divide_2 = DivideCurve(Curve=scale.Geometry, Count=number_slider_22, Kinks=False)  # -> Points, Tangents, Parameters; disabled
item_4 = ListItem(List=cp_3.Points, Index=series_2, Wrap=True)  # -> simplify(Item); disabled
ln = Line(StartPoint=area_7.Centroid, EndPoint=divide_2.Points)  # -> simplify(Line); disabled
clx = CurveLine(Curve=graft(crv_7), Line=ln)  # -> simplify(Points), Params, Count; disabled
py_clear_polyline_pts_2 = PythonScript(crvs=simplify(item_4), a=degrees_2, d=distance_2)  # -> flatten(out), flatten(polylines), angs; inputs crvs: tree of Point3d; disabled; same code as py_clear_polyline_pts
item_5 = ListItem(List=clx.Points, Index=0, Wrap=True)  # disabled
item_6 = ListItem(List=clx.Points, Index=1, Wrap=True)  # disabled
dist_2 = Distance(PointA=item_5, PointB=item_6)  # disabled
angles_deg = Number(py_clear_polyline_pts_2.angs)  # disabled
panel_3 = Panel("90")  # disabled
cp_4 = ControlPoints(Curve=py_clear_polyline_pts_2.polylines)  # -> simplify(Points), Weights, Knots; disabled
path_mapper = PathMapper(dist_2, source="{A;B}", target="{A}")  # disabled
subtraction_6 = Subtraction(A=angles_deg, B=panel_3)  # disabled
pt_extreme_points = Point(cp_4.Points)  # disabled
shift = ShiftList(List=cp_4.Points, Shift=1, Wrap=True)  # disabled
subtraction_7 = Subtraction(A=number_slider_22, B=1)  # disabled
sort_3 = SortList(Keys=path_mapper)  # -> Keys, ValuesA; disabled
abs = Absolute(Value=subtraction_6)  # disabled
dist_3 = Distance(PointA=cp_4.Points, PointB=shift)  # disabled
lng_4 = ListLength(List=pt_extreme_points)  # disabled
ma = MassAddition(Input=abs)  # -> Result, PartialResults; disabled
item_7 = ListItem(List=sort_3.Keys, Index=0, Wrap=True)  # disabled
item_8 = ListItem(List=sort_3.Keys, Index=subtraction_7, Wrap=True)  # disabled
distances = Number(simplify(dist_3))  # disabled
accdifffrom90deg = Number(ma.Result)  # disabled
num_of_extreme_points = Number(lng_4)  # disabled
min_diameter = Number(item_7)  # disabled
max_diameter = Number(item_8)  # disabled
panel_4 = Panel("255")  # disabled
number_slider_23 = Slider(0.7, range=0..1)  # disabled
python = PythonScript(Distances=distances)  # -> accAllPairsRatios; inputs Distances: tree; disabled; same code as py_allpairdiffratio
panel_5 = Panel("4")  # disabled
division_4 = Division(A=min_diameter, B=max_diameter)  # disabled
py = PythonScript(x=flatten(accdifffrom90deg), n=panel_4)  # -> a; inputs x: list; disabled; same code as py
ma_2 = MassAddition(Input=distances)  # -> Result, PartialResults; disabled
smaller = SmallerThan(FirstNumber=num_of_extreme_points, SecondNumber=panel_5)  # -> SmallerThan, OrEqualTo; disabled
max_min_form_proportion = Number(division_4)  # disabled
multiplication_18 = Multiplication(A=py, B=number_slider_23)  # -> simplify(graft(Result)); disabled
number_slider_24 = Slider(0.2, range=0..1)  # disabled
division_5 = Division(A=python, B=ma_2.Result)  # disabled
panel_6 = Panel("255")  # disabled
neg = Negative(Value=multiplication_18)  # disabled
number_slider_25 = Slider(0.1, range=0..1)  # disabled
multiplication_19 = Multiplication(A=panel_6, B=max_min_form_proportion)  # disabled
acc_pairs_ratio = Number(division_5)  # disabled
multiplication_20 = Multiplication(A=smaller.SmallerThan, B=neg)  # disabled
number_slider_26 = Slider(0.4, range=0..1)  # disabled
multiplication_21 = Multiplication(A=multiplication_19, B=number_slider_24)  # disabled
multiplication_22 = Multiplication(A=number_slider_25, B=multiplication_20)  # -> simplify(Result); disabled
ma_3 = MassAddition(Input=[multiplication_18, multiplication_22, multiplication_21])  # -> flatten(Result), PartialResults; disabled

crv_8 = Curve([<curve referenced from the Rhino model> x261])  # disabled
boundary_5 = BoundarySurfaces(Edges=crv_8)  # disabled
number_slider_27 = Slider(1, range=0..1)  # disabled
number_slider_28 = Slider(0.5, range=0..1)  # disabled
number_slider_29 = Slider(0.5, range=0..1)  # disabled
g_triangle_2 = GTriangle(C=crv_8, B=number_slider_27)  # disabled
b_circle_2 = BCircle(crv=crv_8)  # disabled
multiplication_23 = Multiplication(A=number_slider_28, B=g_triangle_2)  # disabled
multiplication_24 = Multiplication(A=number_slider_29, B=b_circle_2)  # disabled
rgb_5 = ColourRGB(Alpha=255, Red=0, Green=multiplication_23, Blue=multiplication_24)  # disabled
transperancy_size_5 = TransperancySize(G=crv_8, B=number_slider_20)  # disabled
multiplication_25 = Multiplication(A=rgb_5, B=transperancy_size_5)  # disabled
preview_6 = CustomPreview(Geometry=boundary_5, Shader=multiplication_25)  # disabled

crv_9 = Curve([<curve referenced from the Rhino model> x261])  # disabled
boundary_6 = BoundarySurfaces(Edges=crv_9)  # disabled
rect_ness_2 = RectNess(crv=crv_9)  # disabled
number_slider_30 = Slider(0.66, range=0..1)  # disabled
number_slider_31 = Slider(0.9, range=0..1)  # disabled
r_square_2 = RSquare(rectanglness=rect_ness_2, crv=crv_9)  # disabled
b_circle_3 = BCircle(crv=crv_9)  # disabled
multiplication_26 = Multiplication(A=number_slider_31, B=r_square_2)  # disabled
multiplication_27 = Multiplication(A=number_slider_30, B=b_circle_3)  # disabled
rgb_6 = ColourRGB(Alpha=255, Red=multiplication_26, Green=0, Blue=multiplication_27)  # disabled
transperancy_size_6 = TransperancySize(G=crv_9, B=number_slider_20)  # disabled
multiplication_28 = Multiplication(A=rgb_6, B=transperancy_size_6)  # disabled
preview_7 = CustomPreview(Geometry=boundary_6, Shader=multiplication_28)  # disabled

crv_10 = Curve([<curve referenced from the Rhino model> x261])  # disabled
boundary_7 = BoundarySurfaces(Edges=crv_10)  # disabled
number_slider_32 = Slider(1, range=0..1)  # disabled
rect_ness_3 = RectNess(crv=crv_10)  # disabled
number_slider_33 = Slider(1, range=0..1)  # disabled
number_slider_34 = Slider(0.6, range=0..1)  # disabled
r_square_3 = RSquare(rectanglness=rect_ness_3, crv=crv_10)  # disabled
g_triangle_3 = GTriangle(C=crv_10, B=number_slider_32)  # disabled
multiplication_29 = Multiplication(A=number_slider_33, B=r_square_3)  # disabled
multiplication_30 = Multiplication(A=number_slider_34, B=g_triangle_3)  # disabled
rgb_7 = ColourRGB(Alpha=255, Red=multiplication_29, Green=multiplication_30, Blue=0)  # disabled
transperancy_size_7 = TransperancySize(G=crv_10, B=number_slider_20)  # disabled
multiplication_31 = Multiplication(A=rgb_7, B=transperancy_size_7)  # disabled
preview_8 = CustomPreview(Geometry=boundary_7, Shader=multiplication_31)  # disabled

# ---- group: Squares
accuracy_2 = Panel("100")  # disabled
pan_2 = Panel("PI/2")  # disabled
crv_11 = Curve(crv_6)  # disabled
xy_2 = XYPlane(Origin=Point(0, 0, 0))  # disabled
range_2 = Range(Domain=pan_2, Steps=accuracy_2)  # disabled
prot_2 = RotatePlane(Plane=xy_2, Angle=range_2)  # disabled
bbox_2 = BoundingBox(Content=crv_11, Plane=graft(prot_2))  # -> Box, Box_2; disabled
flip_2 = FlipMatrix(Data=bbox_2.Box)  # -> simplify(Data); disabled
area_8 = Area(Geometry=flip_2)  # -> Area, Centroid; disabled
sort_4 = SortList(Keys=area_8.Area, ValuesA=flip_2)  # -> Keys, ValuesA; disabled
item_9 = ListItem(List=sort_4.ValuesA, Index=0, Wrap=True)  # disabled
minimum_2d_bounding_box = Surface(item_9)  # disabled
lenseg_2 = SegmentLengths(Curve=flatten(minimum_2d_bounding_box))  # -> ShortestLength, ShortestDomain, LongestLength, LongestDomain; disabled
area_9 = Area(Geometry=crv_11)  # -> flatten(Area), Centroid; disabled
area_10 = Area(Geometry=minimum_2d_bounding_box)  # -> flatten(Area), Centroid; disabled
number_slider_35 = Slider(0.8, range=0..1)  # disabled
number_slider_36 = Slider(0.2, range=0..1)  # disabled
division_6 = Division(A=lenseg_2.ShortestLength, B=lenseg_2.LongestLength)  # -> flatten(Result); disabled
division_7 = Division(A=area_9.Area, B=area_10.Area)  # disabled
multiplication_32 = Multiplication(A=number_slider_36, B=division_6)  # disabled
multiplication_33 = Multiplication(A=number_slider_35, B=division_7)  # disabled
rectanglness = Number(ma_3.Result)  # disabled
addition_5 = Addition(A=multiplication_33, B=multiplication_32)  # disabled
number_slider_37 = Slider(0.5, range=0..1)  # disabled
number_slider_38 = Slider(0.5, range=0..1)  # disabled
division_8 = Division(A=rectanglness, B=255)  # disabled
multiplication_34 = Multiplication(A=division_8, B=number_slider_37)  # disabled
multiplication_35 = Multiplication(A=number_slider_38, B=addition_5)  # disabled
addition_6 = Addition(A=multiplication_34, B=multiplication_35)  # disabled
number_slider_39 = Slider(1, range=0.85..1.15)  # disabled
normalize_to_255_3 = NormalizeTo255(num=addition_6)  # disabled
number_slider_40 = Slider(1, range=0..1)  # disabled
boundary_8 = BoundarySurfaces(Edges=crv_11)  # disabled
transperancy_size_8 = TransperancySize(G=crv_11, B=number_slider_40)  # disabled

# ---- group: Triangles
crv_12 = Curve([<curve referenced from the Rhino model> x261])  # disabled
cpoly_3 = ControlPolygon(Curve=graft(crv_12))  # -> Polygon, Points; disabled
redpline_3 = Reduce(Polyline=cpoly_3.Polygon, Tolerance=1)  # -> Polyline, Reduction; disabled
cp_5 = ControlPoints(Curve=redpline_3.Polyline)  # -> Points, Weights, Knots; disabled
lng_5 = ListLength(List=cp_5.Points)  # disabled
subtraction_8 = Subtraction(A=lng_5, B=1)  # disabled
series_3 = Series(Start=0, Step=1, Count=subtraction_8)  # disabled
distance_3 = Slider(1.54, range=0..2.2)  # disabled
degrees_3 = Slider(155, range=150..180)  # disabled
item_10 = ListItem(List=cp_5.Points, Index=series_3, Wrap=True)  # -> simplify(Item); disabled
py_clear_polyline_pts_3 = PythonScript(crvs=simplify(item_10), a=degrees_3, d=distance_3)  # -> flatten(out), flatten(polylines), angs; inputs crvs: tree of Point3d; disabled; same code as py_clear_polyline_pts
py_clear_polyline_pts_4 = PythonScript(crvs=simplify(item_10), a=degrees_3, d=distance_3)  # -> flatten(out), flatten(polylines), angs; inputs crvs: tree of Point3d
# ---------- py_clear_polyline_pts_4: Python ----------
__author__ = "NaamaGlauber"
import math
import clr
import Rhino as R
clr.AddReference("Grasshopper")
from Grasshopper.Kernel.Data import GH_Path as ghPath
from Grasshopper import DataTree as ghTree

def find_len(a, b):
    return math.sqrt(math.pow((b[0] - a[0]), 2) + math.pow((b[1] - a[1]), 2))

def find_mid(a, b):
    c = R.Geometry.Point3d((a[0] + b[0])/2, (a[1] + b[1])/2, 0)
    return c

angs = ghTree[float]()
polylines = ghTree[R.Geometry.Polyline]()


for formIdx in range(crvs.BranchCount):
    #print "formIdx ", formIdx
    pts = crvs.Branch(formIdx)
    crvCorners = []
    #crvCorners.append(pts[0])
    x = len(pts)
    path = ghPath(formIdx)

    for i in range(1,x+1):
        crvCorners.append(pts[i%x])

    # polylineCrv = R.Geometry.Polyline(crvCorners)
    # polylines.Add(polylineCrv, path)

    while x > 3:
        min_len = find_len(crvCorners[0], crvCorners[1])
        remove_location = 0

        for i in range(0,x):
            len_a = find_len(crvCorners[i], crvCorners[(i+1)%x])
            if len_a < min_len:
                min_len = len_a
                remove_location = i

        to_remove_1 = crvCorners[(remove_location)%x]
        to_remove_2 = crvCorners[(remove_location + 1)%x]

        mid = find_mid(to_remove_1, to_remove_2)

        crvCorners.remove(to_remove_1)
        crvCorners.remove(to_remove_2)

        crvCorners.insert(remove_location, mid)
        x = len(crvCorners)

    polylineCrv = R.Geometry.Polyline(crvCorners)
    polylines.Add(polylineCrv, path)
# ---------- end py_clear_polyline_pts_4 ----------
cp_6 = ControlPoints(Curve=py_clear_polyline_pts_3.polylines)  # -> simplify(Points), Weights, Knots; disabled
cp_7 = ControlPoints(Curve=py_clear_polyline_pts_4.polylines)  # -> Points, Weights, Knots; disabled
lng_6 = ListLength(List=cp_6.Points)  # -> flatten(Length); disabled
toggle_3 = BooleanToggle(True)  # disabled
equals = Equality(FirstNumber=lng_6, SecondNumber=3)  # -> Equality, Inequality; disabled
py_2 = PythonScript(x=lng_6)  # -> a; inputs x: list of Int32; disabled; same code as py
pline_2 = PolyLine(Vertices=cp_7.Points, Closed=toggle_3)  # disabled
pline_3 = PolyLine(Vertices=cp_6.Points, Closed=toggle_3)  # disabled
cull = CullPattern(List=flatten(pline_3), CullPattern=equals.Inequality)  # disabled
cull_2 = CullPattern(List=flatten(pline_2), CullPattern=equals.Inequality)  # disabled
area_11 = Area(Geometry=cull)  # -> Area, Centroid; disabled
area_12 = Area(Geometry=cull_2)  # -> Area, Centroid; disabled
division_9 = Division(A=area_12.Area, B=area_11.Area)  # -> flatten(Result); disabled
number_slider_41 = Slider(1, range=0.85..1.15)  # disabled
normalize_to_255_4 = NormalizeTo255(num=division_9)  # disabled
pow = Power(A=normalize_to_255_4, B=number_slider_41)  # disabled
number_slider_42 = Slider(1, range=0..1)  # disabled
boundary_9 = BoundarySurfaces(Edges=crv_12)  # disabled
transperancy_size_9 = TransperancySize(B=number_slider_42)  # disabled

# ----
pow_2 = Power(A=normalize_to_255_3, B=number_slider_39)  # disabled
py_merge = PythonScript(b=equals.Equality, f=pow)  # -> a; inputs b: list of Boolean, f: list; disabled; same code as py_merge
addition_7 = Addition(A=number_slider_19, B=py_merge)  # disabled

# ---- group: Squares (continued)
rgb_8 = ColourRGB(Alpha=255, Red=pow_2, Green=0, Blue=0)  # disabled
multiplication_36 = Multiplication(A=rgb_8, B=transperancy_size_8)  # disabled
preview_9 = CustomPreview(Geometry=boundary_8, Shader=multiplication_36)  # disabled

# ---- group: Triangles (continued)
rgb_9 = ColourRGB(Alpha=255, Red=0, Green=addition_7, Blue=0)  # disabled

# ----
multiplication_37 = Multiplication(A=rgb_9, B=transperancy_size_9)  # disabled

# ---- group: Triangles (continued)
preview_10 = CustomPreview(Geometry=boundary_9, Shader=multiplication_37)  # disabled

# ----
crv_13 = Curve(crv_3)  # disabled
cpoly_4 = ControlPolygon(Curve=graft(crv_13))  # -> Polygon, Points; disabled
redpline_4 = Reduce(Polyline=cpoly_4.Polygon, Tolerance=1)  # -> Polyline, Reduction; disabled
cp_8 = ControlPoints(Curve=redpline_4.Polyline)  # -> Points, Weights, Knots; disabled
lng_7 = ListLength(List=cp_8.Points)  # disabled
subtraction_9 = Subtraction(A=lng_7, B=1)  # disabled
series_4 = Series(Start=0, Step=1, Count=subtraction_9)  # disabled
distance_4 = Slider(1.54, range=0..2.2)  # disabled
degrees_4 = Slider(155, range=150..180)  # disabled
item_11 = ListItem(List=cp_8.Points, Index=series_4, Wrap=True)  # -> simplify(Item); disabled
py_clear_polyline_pts_5 = PythonScript(crvs=simplify(item_11), a=degrees_4, d=distance_4)  # -> flatten(out), flatten(polylines), angs; inputs crvs: tree of Point3d; disabled; same code as py_clear_polyline_pts
py_clear_polyline_pts_6 = PythonScript(crvs=simplify(item_11))  # -> flatten(out), flatten(polylines), angs; inputs crvs: tree of Point3d; disabled; same code as py_clear_polyline_pts_2
cp_9 = ControlPoints(Curve=py_clear_polyline_pts_6.polylines)  # -> Points, Weights, Knots; disabled
cp_10 = ControlPoints(Curve=py_clear_polyline_pts_5.polylines)  # -> simplify(Points), Weights, Knots; disabled
lng_8 = ListLength(List=cp_10.Points)  # -> flatten(Length); disabled
toggle_4 = BooleanToggle(True)  # disabled
equals_2 = Equality(FirstNumber=lng_8, SecondNumber=3)  # -> Equality, Inequality; disabled
py_3 = PythonScript(x=lng_8)  # -> a; inputs x: list of Int32; disabled; same code as py
pline_4 = PolyLine(Vertices=cp_10.Points, Closed=toggle_4)  # disabled
cull_3 = CullPattern(List=flatten(pline_4), CullPattern=equals_2.Inequality)  # disabled
area_13 = Area(Geometry=cull_3)  # -> Area, Centroid; disabled
number_slider_43 = Slider(1, range=0..1)  # disabled

number_slider_44 = Slider(0.6, range=0..1)  # disabled
rect_ness_4 = RectNess(crv=crv_13)  # disabled
number_slider_45 = Slider(0.6, range=0..1)  # disabled
r_square_4 = RSquare(rectanglness=rect_ness_4, crv=crv_13)  # disabled
number_slider_46 = Slider(0.9, range=0..1)  # disabled
number_slider_47 = Slider(0.6, range=0..1)  # disabled
g_triangle_4 = GTriangle(C=crv_13, B=number_slider_44)  # disabled
b_circle_4 = BCircle(crv=crv_13)  # disabled

pline_5 = PolyLine(Vertices=item_11, Closed=True)  # disabled
area_14 = Area(Geometry=pline_5)  # -> flatten(Area), Centroid; disabled
py_clear_polyline_pts_7 = PythonScript(crvs=simplify(item_11), origArea=area_14.Area)  # -> out, flatten(polylines); inputs crvs: tree of Point3d, origArea: list; disabled
# ---------- py_clear_polyline_pts_7: Python ----------
__author__ = "NaamaGlauber"
import math
import clr
import Rhino as R
clr.AddReference("Grasshopper")
from Grasshopper.Kernel.Data import GH_Path as ghPath
from Grasshopper import DataTree as ghTree
import rhinoscriptsyntax as rs

def find_mid(a, b):
    c = R.Geometry.Point3d((a[0] + b[0])/2, (a[1] + b[1])/2, 0)
    return c

polylines = ghTree[R.Geometry.Polyline]()

for formIdx in range(crvs.BranchCount):
    #print "\n----------------"
    #print "formIdx: ", formIdx
    crv = crvs.Branch(formIdx)
    path = ghPath(formIdx)
    crvOrigArea = origArea[formIdx]
    
    x = len(crv)
    crvCorners = []
    for i in range(x):
        crvCorners.append(crv[i])
    
    print "\n----------------"
    print "formIdx: ", formIdx, ", num of points(closed): ", x+1
    while x > 3:
        remove_location = 0
        maxRatioArea = 0
        takeMid = False # take mid and also project it!!
        #print "num of points: ", x
        #print "crvCorners[ptIdx]: ", crvCorners[ptIdx], "\n"
        for ptIdxRemove in range(x):
            #print "\n *** number of points: ", x
            crvCornersTemp = []
            crvCornersTempClosed = []
            crvCornersTempMid = []
            crvCornersTempMidClosed = []
            for ptIdx in range(x):
                if ptIdxRemove == 0 and ptIdx == 0:
                    midPt = find_mid(crv[0], crv[1])
                    #print "Add ptIdx '0.5'"
                    crvCornersTempMid.append(midPt)
                    crvCornersTempMidClosed.append(midPt)
                    #print "len(crvCornersTempMid)", len(crvCornersTempMid)
                if ptIdxRemove == x-1 and ptIdx == 0:
                    midPt = find_mid(crv[x-1], crv[0])
                    #mPt = rs.AddPoint(midPt)
                    #print "curveOrig ", curveOrig
                    #[success, t] = Y.ClosestPoint(midPt)
                    #print "t = ", t
                    #print "success = ", success
                    #print "Add ptIdx ", x-1, ".5"
                    crvCornersTempMid.append(midPt)
                    crvCornersTempMidClosed.append(midPt)
                    #print crvCornersTempMid
                if ptIdxRemove != ptIdx:
                    #print ptIdx
                    crvCornersTemp.append(crv[ptIdx])
                    crvCornersTempClosed.append(crv[ptIdx])
                    if (ptIdxRemove!=0 or (ptIdx!=0 and ptIdx!=1)) and (ptIdxRemove!=x-1 or (ptIdx!=x-1 and ptIdx!=0)):
                        #print "ptIdxRemove ", ptIdxRemove, "Add ptIdx ", ptIdx
                        crvCornersTempMid.append(crv[ptIdx])
                        crvCornersTempMidClosed.append(crv[ptIdx])
                        #print "len(crvCornersTempMid)", len(crvCornersTempMid)
            #Closing the polyline
            if ptIdxRemove != 0:
                crvCornersTempClosed.append(crv[0])
            else:
                crvCornersTempClosed.append(crv[1])
            
            crvCornersTempMidClosed.append(crvCornersTempMid[0])
            
            #print "Crv's points: \n", crvCornersTempClosed
            pl = rs.AddPolyline(crvCornersTempClosed)
            plMid = rs.AddPolyline(crvCornersTempMidClosed)
            curArea = rs.Area(pl)
            curAreaMid = rs.Area(plMid)
            areaRatio = curArea/crvOrigArea
            areaRatioMid = curAreaMid/crvOrigArea
            #print "areaRatio      : ", areaRatio
            #print "areaRatioMid: ", areaRatioMid
            if areaRatioMid > maxRatioArea and areaRatioMid > areaRatio:
                    #print "mid", remove_location
                    remove_location = ptIdxRemove
                    maxRatioArea = areaRatioMid
                    crvCorners = crvCornersTempMid
            if areaRatio > maxRatioArea and areaRatio >= areaRatioMid:
                #print "regular", remove_location
                remove_location = ptIdxRemove
                maxRatioArea = areaRatio
                crvCorners = crvCornersTemp
            else:
                if areaRatioMid > maxRatioArea and areaRatioMid > areaRatio:
                    print "mid", remove_location
                    remove_location = ptIdxRemove
                    maxRatioArea = areaRatioMid
                    crvCorners = crvCornersTempMid
        crv = crvCorners
        x = x-1 # len(crvCorners)
    firstPt = crvCorners[0]
    crvCorners.append(firstPt)
    polylineCrv = R.Geometry.Polyline(crvCorners)
    polylines.Add(polylineCrv, path)
    #print "\n final num of points: ", len(crvCorners)
# ---------- end py_clear_polyline_pts_7 ----------
cp_11 = ControlPoints(Curve=py_clear_polyline_pts_7.polylines)  # -> simplify(Points), Weights, Knots; disabled
crv_cp = CurveClosestPoint(Point=simplify(cp_9.Points), Curve=simplify(graft(crv_13)))  # -> Point, Parameter, Distance; disabled
pline_6 = PolyLine(Vertices=cp_11.Points, Closed=toggle_2)  # disabled
area_15 = Area(Geometry=pline_6)  # -> flatten(Area), Centroid; disabled

pline_7 = PolyLine(Vertices=crv_cp.Point, Closed=toggle_4)  # disabled
cull_4 = CullPattern(List=flatten(pline_7), CullPattern=equals_2.Inequality)  # disabled
area_16 = Area(Geometry=cull_4)  # -> Area, Centroid; disabled
division_10 = Division(A=area_16.Area, B=area_13.Area)  # -> flatten(Result); disabled
normalize_to_255_5 = NormalizeTo255(num=division_10)  # disabled
multiplication_38 = Multiplication(A=normalize_to_255_5, B=number_slider_44)  # disabled
py_merge_2 = PythonScript(b=equals_2.Equality, f=multiplication_38)  # -> a; inputs b: list of Boolean, f: list; disabled; same code as py_merge

division_11 = Division(A=area_15.Area, B=area_14.Area)  # disabled
normalize_to_255_6 = NormalizeTo255(num=division_11)  # disabled
multiplication_39 = Multiplication(A=number_slider_46, B=r_square_4)  # disabled
multiplication_40 = Multiplication(A=number_slider_45, B=normalize_to_255_6)  # disabled
multiplication_41 = Multiplication(A=number_slider_47, B=b_circle_4)  # disabled
transperancy_size_10 = TransperancySize(G=crv_13, B=number_slider_15)  # disabled
rgb_10 = ColourRGB(Alpha=255, Red=multiplication_39, Green=multiplication_40, Blue=multiplication_41)  # disabled
multiplication_42 = Multiplication(A=rgb_10, B=transperancy_size_10)  # disabled
argb_2 = SplitARGB(Colour=multiplication_42)  # -> Alpha, Red, Green, Blue; disabled
py_dominant_color_2 = PythonScript(x=argb_2.Red, y=argb_2.Green, z=argb_2.Blue)  # -> r, g, b; inputs x: list, y: list, z: list; disabled; same code as py_dominant_color
rgb_11 = ColourRGB(Alpha=255, Red=0, Green=py_dominant_color_2.g, Blue=0)  # disabled
multiplication_43 = Multiplication(A=number_slider_10, B=py_merge_2)  # disabled
multiplication_44 = Multiplication(A=rgb_11, B=255)  # disabled
rgb_12 = ColourRGB(Alpha=255, Red=multiplication_16, Green=multiplication_43, Blue=multiplication_17)  # disabled
boundary_10 = BoundarySurfaces(Edges=crv_13)  # disabled
multiplication_45 = Multiplication(A=rgb_12, B=transperancy_size_4)  # disabled
multiplication_46 = Multiplication(A=multiplication_42, B=subtraction_3)  # disabled
multiplication_47 = Multiplication(A=multiplication_44, B=number_slider_17)  # disabled
preview_11 = CustomPreview(Geometry=boundary_10, Shader=multiplication_42)  # disabled
argb_3 = SplitARGB(Colour=multiplication_45)  # -> Alpha, Red, Green, Blue; disabled
addition_8 = Addition(A=multiplication_46, B=multiplication_47)  # disabled
preview_12 = CustomPreview(Geometry=boundary_10, Shader=multiplication_44)  # disabled
py_dominant_color_3 = PythonScript(x=argb_3.Red, y=argb_3.Green, z=argb_3.Blue)  # -> r, g, b; inputs x: list, y: list, z: list; disabled; same code as py_dominant_color
rgb_13 = ColourRGB(Alpha=255, Red=0, Green=py_dominant_color_3.g, Blue=0)  # disabled
preview_13 = CustomPreview(Geometry=boundary_10, Shader=addition_8)  # disabled
multiplication_48 = Multiplication(A=rgb_13, B=255)  # disabled
multiplication_49 = Multiplication(A=multiplication_45, B=subtraction_4)  # disabled
multiplication_50 = Multiplication(A=multiplication_48, B=number_slider_18)  # disabled
preview_14 = CustomPreview(Geometry=boundary_4, Shader=multiplication_48)  # disabled
addition_9 = Addition(A=multiplication_49, B=multiplication_50)  # disabled
preview_15 = CustomPreview(Geometry=boundary_4, Shader=multiplication_45)  # disabled
preview_16 = CustomPreview(Geometry=boundary_4, Shader=addition_9)  # disabled

# ==== cluster NormalizeTo255
num = ClusterInput()
num_2 = Number(num)
sort = SortList(Keys=num_2)  # -> Keys, ValuesA
item = ListItem(List=sort.Keys, Index=0, Wrap=True)
subtraction = Subtraction(A=num_2, B=item)
sort_2 = SortList(Keys=subtraction)  # -> Keys, ValuesA
rev = ReverseList(List=sort_2.Keys)
item_2 = ListItem(List=rev, Index=0, Wrap=True)
division = Division(A=subtraction, B=item_2)
multiplication = Multiplication(A="255", B=division)
R = ClusterOutput(multiplication)

# ==== cluster Blue
C = ClusterInput()
cpoly = ControlPolygon(Curve=graft(C))  # -> Polygon, Points
redpline = Reduce(Polyline=cpoly.Polygon, Tolerance=1)  # -> Polyline, Reduction
cp = ControlPoints(Curve=redpline.Polyline)  # -> Points, Weights, Knots
lng = ListLength(List=cp.Points)
subtraction = Subtraction(A=lng, B=1)
series = Series(Start=0, Step=1, Count=subtraction)
distance = Slider(1.54, range=0..2.2)
degrees = Slider(155, range=150..180)
item = ListItem(List=cp.Points, Index=series, Wrap=True)  # -> simplify(Item)
py_clear_polyline_pts = PythonScript(crvs=simplify(item), a=degrees, d=distance)  # -> flatten(out), flatten(polylines), angs; inputs crvs: tree of Point3d
# ---------- py_clear_polyline_pts: Python ----------
__author__ = "NaamaGlauber"
import math
import clr
import Rhino as R
clr.AddReference("Grasshopper")
from Grasshopper.Kernel.Data import GH_Path as ghPath
from Grasshopper import DataTree as ghTree
#import System.Collections.Generic as SCG

def find_len(a, b):
    return math.sqrt(math.pow((b[0] - a[0]), 2) + math.pow((b[1] - a[1]), 2))

angs = ghTree[float]()
polylines = ghTree[R.Geometry.Polyline]()
for formIdx in range(crvs.BranchCount):
    #print "formIdx ", formIdx
    pts = crvs.Branch(formIdx)
    crvCorners = []
    #crvCorners.append(pts[0])
    x = len(pts)
    path = ghPath(formIdx)
    for i in range(1,x+1):
        toAdd = 1
        len_a = find_len(pts[(i-1)%x], pts[i%x])
        len_b = find_len(pts[i%x], pts[(i+1)%x])
        len_c = find_len(pts[(i-1)%x], pts[(i+1)%x]) # The edge in front of the desired angle
         
        ratio = ((len_a * len_a) + (len_b * len_b) - (len_c * len_c)) / (2 * len_a * len_b)
        rad = math.acos(ratio) #math.radians(ratio)
        deg= math.degrees(rad)
        if deg > a:
            toAdd = 0
            #print "point idx", i%x
            #print "too flat", deg
        dis = find_len(pts[(i-1)%x], pts[(i)%x])
        #print "dis= ", dis
        if dis <d:
            toAdd = 0
            #print "pts[i-1] = ", pts[(i-1)%x]
            #print "pts[i] = ", pts[(i)%x]
            #print "point idx", i%x
            #print "too close", dis
            #print "toAdd", toAdd
        if toAdd == 1:
            #print "toAdd ", toAdd
            angs.Add(deg, path)
            crvCorners.append(pts[i%x])
    polylineCrv = R.Geometry.Polyline(crvCorners)
    polylines.Add(polylineCrv, path)
# ---------- end py_clear_polyline_pts ----------
cp_2 = ControlPoints(Curve=py_clear_polyline_pts.polylines)  # -> simplify(Points), Weights, Knots
pline = PolyLine(Vertices=cp_2.Points, Closed=Toggle(True))
area = Area(Geometry=pline)  # -> flatten(Area), Centroid
dist = Distance(PointA=cp_2.Points, PointB=area.Centroid)
sort = SortList(Keys=dist)  # -> Keys, ValuesA
rev = ReverseList(List=sort.Keys)
item_2 = ListItem(List=rev, Index=0, Wrap=True)  # -> flatten(Item)
cir = Circle(Plane=flatten(area.Centroid), Radius=item_2)

lng_2 = ListLength(List=cp_2.Points)  # -> flatten(Length)
multiplication = Multiplication(A=lng_2, B="0.15")
eval = Evaluate(F="if(x>1, y, x)", x=multiplication, y="1")

area_2 = Area(Geometry=cir)  # -> Area, Centroid
division = Division(A=area.Area, B=area_2.Area)
multiplication_2 = Multiplication(A="255", B=division)
multiplication_3 = Multiplication(A=multiplication_2, B=eval)
normalize_to_255 = NormalizeTo255_2(num=multiplication_3)
round = Round(Number=normalize_to_255)  # -> Nearest, Floor, Ceiling
N = ClusterOutput(round.Nearest)
R = ClusterOutput(normalize_to_255)

# ==== cluster Green
C = ClusterInput()
cpoly = ControlPolygon(Curve=graft(C))  # -> Polygon, Points
redpline = Reduce(Polyline=cpoly.Polygon, Tolerance=1)  # -> Polyline, Reduction
cp = ControlPoints(Curve=redpline.Polyline)  # -> Points, Weights, Knots
lng = ListLength(List=cp.Points)
subtraction = Subtraction(A=lng, B=1)
series = Series(Start=0, Step=1, Count=subtraction)
distance = Slider(1.54, range=0..2.2)
degrees = Slider(155, range=150..180)
item = ListItem(List=cp.Points, Index=series, Wrap=True)  # -> simplify(Item)
py_clear_polyline_pts = PythonScript(crvs=simplify(item), a=degrees, d=distance)  # -> flatten(out), flatten(polylines), angs; inputs crvs: tree of Point3d; same code as py_clear_polyline_pts
py_clear_polyline_pts_2 = PythonScript(crvs=simplify(item), a=degrees, d=distance)  # -> flatten(out), flatten(polylines), angs; inputs crvs: tree of Point3d
# ---------- py_clear_polyline_pts_2: Python ----------
__author__ = "NaamaGlauber"
import math
import clr
import Rhino as R
clr.AddReference("Grasshopper")
from Grasshopper.Kernel.Data import GH_Path as ghPath
from Grasshopper import DataTree as ghTree
#import System.Collections.Generic as SCG

def find_len(a, b):
    return math.sqrt(math.pow((b[0] - a[0]), 2) + math.pow((b[1] - a[1]), 2))

def find_mid(a, b):
    c = R.Geometry.Point3d((a[0] + b[0])/2, (a[1] + b[1])/2, 0)
    return c

angs = ghTree[float]()
polylines = ghTree[R.Geometry.Polyline]()


for formIdx in range(crvs.BranchCount):
    #print "formIdx ", formIdx
    pts = crvs.Branch(formIdx)
    crvCorners = []
    #crvCorners.append(pts[0])
    x = len(pts)
    path = ghPath(formIdx)

    for i in range(1,x+1):
        crvCorners.append(pts[i%x])

    # polylineCrv = R.Geometry.Polyline(crvCorners)
    # polylines.Add(polylineCrv, path)

    while x > 3:
        min_len = find_len(crvCorners[0], crvCorners[1])
        remove_location = 0

        for i in range(0,x):
            len_a = find_len(crvCorners[i], crvCorners[(i+1)%x])
            if len_a < min_len:
                min_len = len_a
                remove_location = i

        to_remove_1 = crvCorners[(remove_location)%x]
        to_remove_2 = crvCorners[(remove_location + 1)%x]

        mid = find_mid(to_remove_1, to_remove_2)

        crvCorners.remove(to_remove_1)
        crvCorners.remove(to_remove_2)

        crvCorners.insert(remove_location, mid)
        x = len(crvCorners)

    polylineCrv = R.Geometry.Polyline(crvCorners)
    polylines.Add(polylineCrv, path)
# ---------- end py_clear_polyline_pts_2 ----------
cp_2 = ControlPoints(Curve=py_clear_polyline_pts.polylines)  # -> simplify(Points), Weights, Knots
toggle = BooleanToggle(True)
cp_3 = ControlPoints(Curve=py_clear_polyline_pts_2.polylines)  # -> Points, Weights, Knots
pline = PolyLine(Vertices=cp_2.Points, Closed=toggle)
pline_2 = PolyLine(Vertices=cp_3.Points, Closed=toggle)
area = Area(Geometry=pline)  # -> Area, Centroid
area_2 = Area(Geometry=pline_2)  # -> Area, Centroid
division = Division(A=area_2.Area, B=area.Area)  # -> flatten(Result)
normalize_to_255 = NormalizeTo255_2(num=division)
round = Round(Number=normalize_to_255)  # -> Nearest, Floor, Ceiling
N = ClusterOutput(round.Nearest)
R = ClusterOutput(normalize_to_255)

# ==== cluster Red
accuracy = Panel("100")
crv = ClusterInput()
xy = XYPlane(Origin=Point(0, 0, 0))
range = Range(Domain="PI/2", Steps=accuracy)
crv_2 = Curve(crv)
prot = RotatePlane(Plane=xy, Angle=range)
bbox = BoundingBox(Content=crv_2, Plane=graft(prot))  # -> Box, Box_2
flip = FlipMatrix(Data=bbox.Box)
area = Area(Geometry=flip)  # -> Area, Centroid
sort = SortList(Keys=area.Area, ValuesA=flip)  # -> Keys, ValuesA
item = ListItem(List=sort.ValuesA, Index=0, Wrap=True)
minimum_2d_bounding_box = Surface(item)
lenseg = SegmentLengths(Curve=flatten(minimum_2d_bounding_box))  # -> ShortestLength, ShortestDomain, LongestLength, LongestDomain
area_2 = Area(Geometry=crv_2)  # -> flatten(Area), Centroid
area_3 = Area(Geometry=minimum_2d_bounding_box)  # -> flatten(Area), Centroid
rectanglness = ClusterInput()
division = Division(A=lenseg.ShortestLength, B=lenseg.LongestLength)  # -> flatten(Result)
division_2 = Division(A=area_2.Area, B=area_3.Area)
rectanglness_2 = Number(flatten(rectanglness))
multiplication = Multiplication(A=Slider(0.3, range=0..1), B=division)
multiplication_2 = Multiplication(A=Slider(0.8, range=0..1), B=division_2)
addition = Addition(A=multiplication_2, B=multiplication)
normalize_to_255 = NormalizeTo255_2(num=rectanglness_2)
normalize_to_255_2 = NormalizeTo255_2(num=addition)
multiplication_3 = Multiplication(A=normalize_to_255, B=Slider(0.5, range=0..1))
multiplication_4 = Multiplication(A=Slider(0.5, range=0..1), B=normalize_to_255_2)
addition_2 = Addition(A=multiplication_3, B=multiplication_4)
round = Round(Number=addition_2)  # -> Nearest, Floor, Ceiling
R = ClusterOutput(addition_2)
N = ClusterOutput(round.Nearest)

# ==== cluster Rect
crv = ClusterInput()

crv_2 = Curve(crv)
divide = DivideCurve(Curve=crv_2, Count=10, Kinks=False)  # -> Points, Tangents, Parameters
cpoly = ControlPolygon(Curve=graft(crv_2))  # -> Polygon, Points
hull = ConvexHull(Points=divide.Points, Plane=PlaneXY(0, 0, 0))  # -> Hull, HullZ, Indices
redpline = Reduce(Polyline=cpoly.Polygon, Tolerance=1)  # -> Polyline, Reduction
area = Area(Geometry=hull.Hull)  # -> Area, Centroid
cp = ControlPoints(Curve=redpline.Polyline)  # -> Points, Weights, Knots
expression = Expression(x=Slider(100, range=99..100), y=area.Area, Expression="(x/y)^(1/2)")
lng = ListLength(List=cp.Points)
number_slider = Slider(50, range=0..100)
subtraction = Subtraction(A=lng, B=1)
scale = Scale(Geometry=hull.Hull, Center=area.Centroid, Factor=expression)  # -> Geometry, Transform
series = Series(Start=0, Step=1, Count=subtraction)
divide_2 = DivideCurve(Curve=scale.Geometry, Count=number_slider, Kinks=False)  # -> Points, Tangents, Parameters
distance = Slider(1.54, range=0..2.2)
degrees = Slider(155, range=150..180)
item = ListItem(List=cp.Points, Index=series, Wrap=True)  # -> simplify(Item)
ln = Line(StartPoint=area.Centroid, EndPoint=divide_2.Points)  # -> simplify(Line)
clx = CurveLine(Curve=graft(crv_2), Line=ln)  # -> simplify(Points), Params, Count
py_clear_polyline_pts = PythonScript(crvs=simplify(item), a=degrees, d=distance)  # -> flatten(out), flatten(polylines), angs; inputs crvs: tree of Point3d; same code as py_clear_polyline_pts
item_2 = ListItem(List=clx.Points, Index=0, Wrap=True)
item_3 = ListItem(List=clx.Points, Index=1, Wrap=True)
dist = Distance(PointA=item_2, PointB=item_3)
path_mapper = PathMapper(dist, source="{A;B}", target="{A}")
cp_2 = ControlPoints(Curve=py_clear_polyline_pts.polylines)  # -> simplify(Points), Weights, Knots
shift = ShiftList(List=cp_2.Points, Shift=1, Wrap=True)  # disabled
subtraction_2 = Subtraction(A=number_slider, B=1)
sort = SortList(Keys=path_mapper)  # -> Keys, ValuesA
dist_2 = Distance(PointA=cp_2.Points, PointB=shift)  # disabled
item_4 = ListItem(List=sort.Keys, Index=0, Wrap=True)
item_5 = ListItem(List=sort.Keys, Index=subtraction_2, Wrap=True)

# ----
# make sure (extreme situation):
# In case of 5 points for square-
# to do not count the flatt angle..
pt_extreme_points = Point(cp_2.Points)
angles_deg = Number(py_clear_polyline_pts.angs)
distances = Number(simplify(dist_2))  # disabled
max_diameter = Number(item_5)
min_diameter = Number(item_4)
subtraction_3 = Subtraction(A=angles_deg, B="90")
py_allpairdiffratio = PythonScript(Distances=distances)  # -> accAllPairsRatios; inputs Distances: tree; disabled
# ---------- py_allpairdiffratio: Python ----------
import Rhino as R
import clr
clr.AddReference("Grasshopper")
from Grasshopper.Kernel.Data import GH_Path as ghPath
from Grasshopper import DataTree as ghTree

def find_len(a, b):
    return math.sqrt(math.pow((b[0] - a[0]), 2) + math.pow((b[1] - a[1]), 2))

accAllPairsRatios = ghTree[float]()

for formIdx in range(Distances.BranchCount):
    formDis = Distances.Branch(formIdx)
    path = ghPath(formIdx)
    accD = 0
    for i in range(len(formDis)):
        for j in range(len(formDis)):
            if i<j:
                d = abs(formDis[i] - formDis[j])
                accD += d
    accAllPairsRatios.Add(accD, path)
# ---------- end py_allpairdiffratio ----------
division = Division(A=min_diameter, B=max_diameter)
abs = Absolute(Value=subtraction_3)
lng_2 = ListLength(List=pt_extreme_points)
ma = MassAddition(Input=abs)  # -> Result, PartialResults
ma_2 = MassAddition(Input=distances)  # -> Result, PartialResults; disabled
division_2 = Division(A=py_allpairdiffratio, B=ma_2.Result)  # disabled
max_min_form_proportion = Number(division)
num_of_extreme_points = Number(lng_2)
accdifffrom90deg = Number(ma.Result)
acc_pairs_ratio = Number(division_2)  # disabled

subtraction_4 = Subtraction(A="255", B=accdifffrom90deg)
smaller = SmallerThan(FirstNumber=num_of_extreme_points, SecondNumber="4")  # -> SmallerThan, OrEqualTo
multiplication = Multiplication(A="255", B=max_min_form_proportion)
abs_2 = Absolute(Value=subtraction_4)
multiplication_2 = Multiplication(A=abs_2, B=Slider(0.7, range=0..1))
neg = Negative(Value=multiplication_2)
multiplication_3 = Multiplication(A=smaller.SmallerThan, B=neg)
multiplication_4 = Multiplication(A=multiplication, B=Slider(0.3, range=0..1))
multiplication_5 = Multiplication(A=Slider(0.2, range=0..1), B=multiplication_3)
ma_3 = MassAddition(Input=[multiplication_2, multiplication_5, multiplication_4])  # -> Result, PartialResults

R = ClusterOutput(ma_3.Result)

# ==== cluster TransperancySize
G = ClusterInput()
area = Area(Geometry=G)  # -> Area, Centroid
sort = SortList(Keys=area.Area, ValuesA=G)  # -> Keys, ValuesA
item = ListItem(List=sort.Keys, Index=0, Wrap=True)
subtraction = Subtraction(A=sort.Keys, B=item)
subtraction_2 = Subtraction(A=area.Area, B=item)
rev = ReverseList(List=subtraction)
item_2 = ListItem(List=rev, Index=0, Wrap=True)
division = Division(A=subtraction_2, B=item_2)
B = ClusterInput()
addition = Addition(A=division, B=B)
min = Minimum(A=addition, B="1")
R = ClusterOutput(min)

# ==== cluster Norm01
K = ClusterInput()
sort = SortList(Keys=K)  # -> Keys, ValuesA
item = ListItem(List=sort.Keys, Index=0, Wrap=True)
subtraction = Subtraction(A=K, B=item)
subtraction_2 = Subtraction(A=sort.Keys, B=item)
rev = ReverseList(List=subtraction_2)
item_2 = ListItem(List=rev, Index=0, Wrap=True)
division = Division(A=subtraction, B=item_2)
R = ClusterOutput(division)

# ==== cluster BCircle
crv = ClusterInput()
crv_2 = Curve(crv)
cpoly = ControlPolygon(Curve=graft(crv_2))  # -> Polygon, Points
redpline = Reduce(Polyline=cpoly.Polygon, Tolerance=1)  # -> Polyline, Reduction
cp = ControlPoints(Curve=redpline.Polyline)  # -> Points, Weights, Knots
lng = ListLength(List=cp.Points)
subtraction = Subtraction(A=lng, B=1)
degrees = Slider(155, range=150..180)
distance = Slider(1.54, range=0..2.2)
series = Series(Start=0, Step=1, Count=subtraction)
item = ListItem(List=cp.Points, Index=series, Wrap=True)  # -> simplify(Item)
py_clear_polyline_pts = PythonScript(crvs=simplify(item), a=degrees, d=distance)  # -> flatten(out), flatten(polylines), angs; inputs crvs: tree of Point3d; same code as py_clear_polyline_pts
cp_2 = ControlPoints(Curve=py_clear_polyline_pts.polylines)  # -> simplify(Points), Weights, Knots
lng_2 = ListLength(List=cp_2.Points)  # -> flatten(Length)
pline = PolyLine(Vertices=cp_2.Points, Closed=Toggle(True))
area = Area(Geometry=pline)  # -> Area, Centroid
multiplication = Multiplication(A=lng_2, B="0.15")
dist = Distance(PointA=area.Centroid, PointB=cp_2.Points)
pt = Point(flatten(area.Centroid))
sort = SortList(Keys=dist)  # -> Keys, ValuesA
eval = Evaluate(F="if(x>1, y, x)", x=multiplication, y="1")
rev = ReverseList(List=sort.Keys)
area_2 = Area(Geometry=pline)  # -> flatten(Area), Centroid
item_2 = ListItem(List=rev, Index=0, Wrap=True)  # -> flatten(Item)
cir = Circle(Plane=pt, Radius=item_2)
area_3 = Area(Geometry=cir)  # -> Area, Centroid
division = Division(A=area_2.Area, B=area_3.Area)
multiplication_2 = Multiplication(A=eval, B=division)
normalize_to_255 = NormalizeTo255(num=multiplication_2)
multiplication_3 = Multiplication(A=Slider(1, range=0..1), B=normalize_to_255)
addition = Addition(A=multiplication_3, B=Slider(25, range=0..100))
transperancy_size = TransperancySize(G=crv_2, B=Slider(1, range=0..1))
multiplication_4 = Multiplication(A=addition, B=transperancy_size)
R = ClusterOutput(multiplication_4)

# ==== cluster RSquare
accuracy = Panel("100")
crv = ClusterInput()
crv_2 = Curve(crv)
xy = XYPlane(Origin=Point(0, 0, 0))
range = Range(Domain="PI/2", Steps=accuracy)
prot = RotatePlane(Plane=xy, Angle=range)
bbox = BoundingBox(Content=crv_2, Plane=graft(prot))  # -> Box, Box_2
flip = FlipMatrix(Data=bbox.Box)  # -> simplify(Data)
area = Area(Geometry=flip)  # -> Area, Centroid
sort = SortList(Keys=area.Area, ValuesA=flip)  # -> Keys, ValuesA
item = ListItem(List=sort.ValuesA, Index=0, Wrap=True)
minimum_2d_bounding_box = Surface(item)
lenseg = SegmentLengths(Curve=flatten(minimum_2d_bounding_box))  # -> ShortestLength, ShortestDomain, LongestLength, LongestDomain
area_2 = Area(Geometry=crv_2)  # -> flatten(Area), Centroid
area_3 = Area(Geometry=minimum_2d_bounding_box)  # -> flatten(Area), Centroid
division = Division(A=lenseg.ShortestLength, B=lenseg.LongestLength)  # -> flatten(Result)
division_2 = Division(A=area_2.Area, B=area_3.Area)
rectanglness = ClusterInput()
multiplication = Multiplication(A=Slider(0.2, range=0..1), B=division)
multiplication_2 = Multiplication(A=Slider(0.8, range=0..1), B=division_2)
rectanglness_2 = Number(rectanglness)
addition = Addition(A=multiplication_2, B=multiplication)
division_3 = Division(A=rectanglness_2, B=255)
multiplication_3 = Multiplication(A=division_3, B=Slider(0, range=0..1))
multiplication_4 = Multiplication(A=Slider(1, range=0..1), B=addition)
addition_2 = Addition(A=multiplication_3, B=multiplication_4)
normalize_to_255 = NormalizeTo255(num=addition_2)
multiplication_5 = Multiplication(A=normalize_to_255, B=Slider(1, range=0..1))
transperancy_size = TransperancySize(G=crv_2, B=Slider(0.5, range=0..1))
multiplication_6 = Multiplication(A=multiplication_5, B=transperancy_size)
R = ClusterOutput(multiplication_6)

# ==== cluster RectNess
crv = ClusterInput()
crv_2 = Curve(crv)
cpoly = ControlPolygon(Curve=graft(crv_2))  # -> Polygon, Points
divide = DivideCurve(Curve=crv_2, Count=10, Kinks=False)  # -> Points, Tangents, Parameters
redpline = Reduce(Polyline=cpoly.Polygon, Tolerance=1)  # -> Polyline, Reduction
hull = ConvexHull(Points=divide.Points, Plane=PlaneXY(0, 0, 0))  # -> Hull, HullZ, Indices
cp = ControlPoints(Curve=redpline.Polyline)  # -> Points, Weights, Knots
area = Area(Geometry=hull.Hull)  # -> Area, Centroid
lng = ListLength(List=cp.Points)
expression = Expression(x=Slider(100, range=99..100), y=area.Area, Expression="(x/y)^(1/2)")
subtraction = Subtraction(A=lng, B=1)
number_slider = Slider(50, range=0..100)
series = Series(Start=0, Step=1, Count=subtraction)
scale = Scale(Geometry=hull.Hull, Center=area.Centroid, Factor=expression)  # -> Geometry, Transform
distance = Slider(2.15, range=0..2.3)
degrees = Slider(155, range=150..180)
divide_2 = DivideCurve(Curve=scale.Geometry, Count=number_slider, Kinks=False)  # -> Points, Tangents, Parameters
item = ListItem(List=cp.Points, Index=series, Wrap=True)  # -> simplify(Item)
ln = Line(StartPoint=area.Centroid, EndPoint=divide_2.Points)  # -> simplify(Line)
clx = CurveLine(Curve=graft(crv_2), Line=ln)  # -> simplify(Points), Params, Count
py_clear_polyline_pts = PythonScript(crvs=simplify(item), a=degrees, d=distance)  # -> flatten(out), flatten(polylines), angs; inputs crvs: tree of Point3d; same code as py_clear_polyline_pts
item_2 = ListItem(List=clx.Points, Index=0, Wrap=True)
item_3 = ListItem(List=clx.Points, Index=1, Wrap=True)
dist = Distance(PointA=item_2, PointB=item_3)
angles_deg = Number(py_clear_polyline_pts.angs)
cp_2 = ControlPoints(Curve=py_clear_polyline_pts.polylines)  # -> simplify(Points), Weights, Knots
path_mapper = PathMapper(dist, source="{A;B}", target="{A}")
subtraction_2 = Subtraction(A=angles_deg, B="90")
pt_extreme_points = Point(cp_2.Points)
subtraction_3 = Subtraction(A=number_slider, B=1)
sort = SortList(Keys=path_mapper)  # -> Keys, ValuesA
abs = Absolute(Value=subtraction_2)
lng_2 = ListLength(List=pt_extreme_points)
ma = MassAddition(Input=abs)  # -> Result, PartialResults
item_4 = ListItem(List=sort.Keys, Index=0, Wrap=True)
item_5 = ListItem(List=sort.Keys, Index=subtraction_3, Wrap=True)
accdifffrom90deg = Number(ma.Result)
num_of_extreme_points = Number(lng_2)
max_diameter = Number(item_5)
min_diameter = Number(item_4)
division = Division(A=min_diameter, B=max_diameter)
py = PythonScript(x=flatten(accdifffrom90deg), n="255")  # -> a; inputs x: list
# ---------- py: Python ----------
__author__ = "NaamaGlauber"
import math
import clr
import Rhino as R
clr.AddReference("Grasshopper")
from Grasshopper.Kernel.Data import GH_Path as ghPath
from Grasshopper import DataTree as ghTree

a = []
for i in range(len(x)):
    if(n - x[i] > 0):
        a.append(n-x[i])
    else:
        a.append(0.0)
# ---------- end py ----------
smaller = SmallerThan(FirstNumber=num_of_extreme_points, SecondNumber="4")  # -> SmallerThan, OrEqualTo
max_min_form_proportion = Number(division)
multiplication = Multiplication(A=py, B=Slider(0.7, range=0..1))  # -> simplify(graft(Result))
neg = Negative(Value=multiplication)
multiplication_2 = Multiplication(A="255", B=max_min_form_proportion)
multiplication_3 = Multiplication(A=smaller.SmallerThan, B=neg)
multiplication_4 = Multiplication(A=multiplication_2, B=Slider(0.2, range=0..1))
multiplication_5 = Multiplication(A=Slider(0.1, range=0..1), B=multiplication_3)  # -> simplify(Result)
ma_2 = MassAddition(Input=[multiplication, multiplication_5, multiplication_4])  # -> flatten(Result), PartialResults
R = ClusterOutput(ma_2.Result)

# ==== cluster GTriangle
B = ClusterInput()
C = ClusterInput()
cpoly = ControlPolygon(Curve=graft(C))  # -> Polygon, Points
redpline = Reduce(Polyline=cpoly.Polygon, Tolerance=1)  # -> Polyline, Reduction
cp = ControlPoints(Curve=redpline.Polyline)  # -> Points, Weights, Knots
lng = ListLength(List=cp.Points)
subtraction = Subtraction(A=lng, B=1)
series = Series(Start=0, Step=1, Count=subtraction)
distance = Slider(1.54, range=0..2.2)
degrees = Slider(155, range=150..180)
item = ListItem(List=cp.Points, Index=series, Wrap=True)  # -> simplify(Item)
py_clear_polyline_pts = PythonScript(crvs=simplify(item), a=degrees, d=distance)  # -> flatten(out), flatten(polylines), angs; inputs crvs: tree of Point3d
# ---------- py_clear_polyline_pts: Python ----------
__author__ = "NaamaGlauber"
import math
import clr
import Rhino as R
clr.AddReference("Grasshopper")
from Grasshopper.Kernel.Data import GH_Path as ghPath
from Grasshopper import DataTree as ghTree

def find_len(a, b):
    return math.sqrt(math.pow((b[0] - a[0]), 2) + math.pow((b[1] - a[1]), 2))

angs = ghTree[float]()
polylines = ghTree[R.Geometry.Polyline]()
for formIdx in range(crvs.BranchCount):
    #print "formIdx ", formIdx
    pts = crvs.Branch(formIdx)
    crvCorners = []
    #crvCorners.append(pts[0])
    x = len(pts)
    path = ghPath(formIdx)
    for i in range(1,x+1):
        toAdd = 1
        len_a = find_len(pts[(i-1)%x], pts[i%x])
        len_b = find_len(pts[i%x], pts[(i+1)%x])
        len_c = find_len(pts[(i-1)%x], pts[(i+1)%x]) # The edge in front of the desired angle
         
        ratio = ((len_a * len_a) + (len_b * len_b) - (len_c * len_c)) / (2 * len_a * len_b)
        rad = math.acos(ratio) #math.radians(ratio)
        deg= math.degrees(rad)
        if deg > a and x>3 and (len(crvCorners)+(x-i+1))>3:
            toAdd = 0
            #print "point idx", i%x
            #print "too flat", deg
            
        dis = len_a #find_len(pts[(i-1)%x], pts[(i)%x])
        #print "dis= ", dis
        if dis <d and x>3 and (len(crvCorners)+(x-i+1))>3:
            toAdd = 0
            #print "x= " , x
            #print "potential points = " ,(len(crvCorners)+(x-i+1)) 
            #print "pts[i-1] = ", pts[(i-1)%x]
            #print "pts[i] = ", pts[(i)%x]
            #print "point idx", i%x
            #print "too close", dis
            #print "toAdd", toAdd
            
        if toAdd == 1:
            #print "toAdd ", toAdd
            angs.Add(deg, path)
            crvCorners.append(pts[i%x])
    polylineCrv = R.Geometry.Polyline(crvCorners)
    polylines.Add(polylineCrv, path)
# ---------- end py_clear_polyline_pts ----------
py_clear_polyline_pts_2 = PythonScript(crvs=simplify(item), a=degrees, d=distance)  # -> flatten(out), flatten(polylines), angs; inputs crvs: tree of Point3d; same code as py_clear_polyline_pts_2
cp_2 = ControlPoints(Curve=py_clear_polyline_pts.polylines)  # -> simplify(Points), Weights, Knots
cp_3 = ControlPoints(Curve=py_clear_polyline_pts_2.polylines)  # -> Points, Weights, Knots
lng_2 = ListLength(List=cp_2.Points)  # -> flatten(Length)
toggle = BooleanToggle(True)
equals = Equality(FirstNumber=lng_2, SecondNumber=3)  # -> Equality, Inequality
py = PythonScript(x=lng_2)  # -> a; inputs x: list of Int32; disabled
# ---------- py: Python ----------
__author__ = "NaamaGlauber"
import math
import clr
import Rhino as R
clr.AddReference("Grasshopper")
from Grasshopper.Kernel.Data import GH_Path as ghPath
from Grasshopper import DataTree as ghTree

a = []
for i in range(len(x)):
    if x[i] == 3:
        a.append(255)
    else:
        if x[i] == 4:
            a.append(0) # 125
        else:
            a.append(0)
# ---------- end py ----------
pline = PolyLine(Vertices=cp_3.Points, Closed=toggle)
pline_2 = PolyLine(Vertices=cp_2.Points, Closed=toggle)
cull = CullPattern(List=flatten(pline), CullPattern=equals.Inequality)
cull_2 = CullPattern(List=flatten(pline_2), CullPattern=equals.Inequality)
area = Area(Geometry=cull_2)  # -> Area, Centroid
area_2 = Area(Geometry=cull)  # -> Area, Centroid
division = Division(A=area_2.Area, B=area.Area)  # -> flatten(Result)
normalize_to_255 = NormalizeTo255(num=division)
multiplication = Multiplication(A=normalize_to_255, B=B)
py_merge = PythonScript(b=equals.Equality, f=multiplication)  # -> a; inputs b: list of Boolean, f: list
# ---------- py_merge: Python ----------
__author__ = "NaamaGlauber"
import math
import clr
import Rhino as R
clr.AddReference("Grasshopper")
from Grasshopper.Kernel.Data import GH_Path as ghPath
from Grasshopper import DataTree as ghTree

a = []
j=0
for i in range(len(b)):
    if b[i] == True:
        a.append(255)
    else:
        a.append(int(f[j]))
        j=j+1
# ---------- end py_merge ----------
transperancy_size = TransperancySize(G=C, B=Slider(1, range=0..1))
multiplication_2 = Multiplication(A=py_merge, B=transperancy_size)
R = ClusterOutput(multiplication_2)

# ==== cluster NormalizeTo255_2
num = ClusterInput()
num_2 = Number(num)
sort = SortList(Keys=num_2)  # -> Keys, ValuesA
number_slider = Slider(0, range=0..100)
rev = ReverseList(List=sort.Keys)
item = ListItem(List=rev, Index=number_slider, Wrap=True)
item_2 = ListItem(List=sort.Keys, Index=number_slider, Wrap=True)
subtraction = Subtraction(A=item, B=item_2)
division = Division(A=Slider(1, range=0..1), B=subtraction)
subtraction_2 = Subtraction(A=num_2, B=item_2)
multiplication = Multiplication(A=division, B=subtraction_2)
multiplication_2 = Multiplication(A="255", B=multiplication)
R = ClusterOutput(multiplication_2)
