# Grasshopper definition RGB_Final.gh (Grasshopper 0.9.76)
# plug-ins: Python Interpreter

distance = Slider(1, range=0..2.3)
degrees = Slider(155, range=150..180)

number_slider = Slider(159, range=-180..180)
number_slider_2 = Slider(2, range=0..10)
number_slider_3 = Slider(20, range=0..180)

degrees_2 = Slider(150, range=150..180)
distance_2 = Slider(1.54, range=0..2.2)

radius = Number(number_slider_2)
number_slider_4 = Slider(1804, range=0..2616)  # disabled
number_slider_5 = Slider(0, range=0..2615)  # disabled
number_slider_6 = Slider(2615, range=0..2615)
addition = Addition(A=number_slider_5, B=number_slider_4)  # disabled
series = Series(Start=number_slider_5, Step=1, Count=number_slider_4)  # disabled
subtraction = Subtraction(A=addition, B=1)  # disabled
number_slider_7 = Slider(1.7, range=0..10)  # disabled
panel = Panel("1")  # disabled
subtraction_2 = Subtraction(A=panel)  # disabled
panel_2 = Panel("255")  # disabled
pow = Power(A=subtraction_2, B=number_slider_7)  # disabled
multiplication = Multiplication(A=pow, B=panel_2)  # disabled
lng = ListLength()  # disabled
panel_3 = Panel("255")  # disabled
norm_0_1 = Norm01(num=flatten(multiplication))  # disabled
dup = DuplicateData(Data=panel_3, Number=lng, Order=True)  # disabled
subtraction_3 = Subtraction(A=dup, B=norm_0_1)  # disabled

max_size = Slider(1, range=0..1)
mix_vs_dom = Slider(0, range=0..1)
square_active = BooleanToggle(True)
triangle_active = BooleanToggle(True)
lines_active = BooleanToggle(True)
crv = Curve([<curve referenced from the Rhino model> x5000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])
min_size = Slider(0, range=0..1)

crv_2 = Curve(crv)
crv_pts = CrvPts(C=crv_2)  # -> simplify(P), i
py_clear_polyline_pts = PythonScript(crvs=simplify(crv_pts.i), a=degrees, d=distance)  # -> flatten(out), flatten(polylines), takenIdx; inputs crvs: tree of Point3d
# ---------- py_clear_polyline_pts: Python ----------
__author__ = "NaamaGlauber"
import math
import clr
import Rhino as R
clr.AddReference("Grasshopper")
from Grasshopper.Kernel.Data import GH_Path as ghPath
from Grasshopper import DataTree as ghTree

def find_len(a, b):
    return math.sqrt(math.pow((b[0] - a[0]), 2) + math.pow((b[1] - a[1]), 2))

angs = ghTree[float]()
takenIdx = ghTree[int]()
polylines = ghTree[R.Geometry.Polyline]()
for formIdx in range(crvs.BranchCount):
    #print "formIdx ", formIdx
    pts = crvs.Branch(formIdx)
    crvCorners = []
    #crvCorners.append(pts[0])
    x = len(pts)
    path = ghPath(formIdx)
    for i in range(1,x+1):
        toAdd = 1
        len_a = find_len(pts[(i-1)%x], pts[i%x])
        len_b = find_len(pts[i%x], pts[(i+1)%x])
        len_c = find_len(pts[(i-1)%x], pts[(i+1)%x]) # The edge in front of the desired angle
        
        ratio = ((len_a * len_a) + (len_b * len_b) - (len_c * len_c)) / (2 * len_a * len_b)
        rad = math.acos(ratio) #math.radians(ratio)
        deg= math.degrees(rad)
        if deg > a and x>3 and (len(crvCorners)+(x-i+1))>3:
            toAdd = 0
            #print "point idx", i%x
            #print "too flat", deg
            
        dis = len_a #find_len(pts[(i-1)%x], pts[(i)%x])
        #print "dis= ", dis
        if dis <d and x>3 and (len(crvCorners)+(x-i+1))>3:
            toAdd = 0
            #print "x= " , x
            #print "potential points = " ,(len(crvCorners)+(x-i+1)) 
            #print "pts[i-1] = ", pts[(i-1)%x]
            #print "pts[i] = ", pts[(i)%x]
            #print "point idx", i%x
            #print "too close", dis
            #print "toAdd", toAdd
            
        if toAdd == 1:
            #print "toAdd ", toAdd
            angs.Add(deg, path)
            takenIdx.Add(i%x,path)
            crvCorners.append(pts[i%x])
    polylineCrv = R.Geometry.Polyline(crvCorners)
    polylines.Add(polylineCrv, path)
# ---------- end py_clear_polyline_pts ----------
cp = ControlPoints(Curve=py_clear_polyline_pts.polylines)  # -> simplify(Points), Weights, Knots
extreme_pts = ListLength(List=cp.Points)

# ----
# How much it is
# a real triangle
# how much it is similar
# to the original form
panel_4 = Panel("4")
smaller = SmallerThan(FirstNumber=extreme_pts, SecondNumber=panel_4)  # -> SmallerThan, OrEqualTo
cull = CullPattern(List=crv_2, CullPattern=flatten(smaller.SmallerThan))
cull_2 = CullPattern(List=cp.Points, CullPattern=smaller.SmallerThan)
cull_3 = CullPattern(List=crv_pts.P, CullPattern=smaller.SmallerThan)  # -> simplify(List)
clearnull = PythonScript(x=cull_2)  # -> a; inputs x: tree of Point3d
# ---------- clearnull: Python ----------
import Rhino as R
import clr
clr.AddReference("Grasshopper")
from Grasshopper.Kernel.Data import GH_Path as ghPath
from Grasshopper import DataTree as ghTree

a = ghTree[R.Geometry.Point3d]()
idx = 0
for crvIdx in range(x.BranchCount):
    crvPts = x.Branch(crvIdx)
    for i in range(len(crvPts)):
        path = ghPath(idx)
        a.Add(crvPts[i], path)
    if len(crvPts) != 0:
        idx += 1
# ---------- end clearnull ----------
clearnull_2 = PythonScript(x=cull_3)  # -> a; inputs x: tree of Point3d; same code as clearnull
pline = PolyLine(Vertices=clearnull, Closed=True)
pline_2 = PolyLine(Vertices=clearnull_2, Closed=True)
area = Area(Geometry=flatten(pline))  # -> Area, Centroid
area_2 = Area(Geometry=flatten(pline_2))  # -> Area, Centroid
area_3 = Area(Geometry=cull)  # -> Area, Centroid
division = Division(A=area_3.Area, B=area.Area)
division_2 = Division(A=area_2.Area, B=area.Area)
norm_0_1_2 = Norm01(num=flatten(division_2))
norm_0_1_3 = Norm01(num=flatten(division))
pow_2 = Power(A=norm_0_1_2, B=Slider(0.6, range=0..1))
pow_3 = Power(A=norm_0_1_3, B=Slider(0.6, range=0..1))
multiplication_2 = Multiplication(A=pow_2, B="255")
multiplication_3 = Multiplication(A=pow_3, B="255")
addition_2 = Addition(A=multiplication_3, B=multiplication_2)
lng_2 = ListLength(List=cull)
dup_2 = DuplicateData(Data="255", Number=lng_2, Order=True)
division_3 = Division(A=addition_2, B=Slider(2.5, range=1..3))
filter_by_size = FilterBySize(A=min_size, B=max_size, G=cull)
subtraction_4 = Subtraction(A=dup_2, B=division_3)
multiplication_4 = Multiplication(A=division_3, B=filter_by_size)
multiplication_5 = Multiplication(A=subtraction_4, B=filter_by_size)
rgb = ColourRGB(Alpha=255, Red=0, Green=multiplication_5, Blue=0)
boundary = BoundarySurfaces(Edges=cull)
dom_color = DomColor(mixvsdom=mix_vs_dom, C=rgb, B=square_active, B_2=triangle_active)
preview = CustomPreview(Geometry=boundary, Shader=dom_color)

larger = LargerThan(FirstNumber=extreme_pts, SecondNumber="4")  # -> LargerThan, OrEqualTo
# Dominant color
# mixed colors
cull_4 = CullPattern(List=extreme_pts, CullPattern=larger.LargerThan)
cull_5 = CullPattern(List=crv_2, CullPattern=flatten(larger.LargerThan))
cull_6 = CullPattern(List=cp.Points, CullPattern=larger.LargerThan)
clearintnull = PythonScript(x=cull_4)  # -> a; inputs x: tree of Int32
# ---------- clearintnull: Python ----------
import Rhino as R
import clr
clr.AddReference("Grasshopper")
from Grasshopper.Kernel.Data import GH_Path as ghPath
from Grasshopper import DataTree as ghTree

a = ghTree[int]()
idx = 0
for crvIdx in range(x.BranchCount):
    crvPts = x.Branch(crvIdx)
    for i in range(len(crvPts)):
        path = ghPath(idx)
        a.Add(crvPts[i], path)
    if len(crvPts) != 0:
        idx += 1
# ---------- end clearintnull ----------
clearnull_3 = PythonScript(x=cull_6)  # -> a; inputs x: tree of Point3d; same code as clearnull
py_remove_pts = PythonScript(crvs=simplify(clearnull_3), numOfPoints="3")  # -> flatten(polylines); inputs crvs: tree of Point3d, numOfPoints: Int32
# ---------- py_remove_pts: Python ----------
__author__ = "NaamaGlauber"
import math
import clr
import Rhino as R
clr.AddReference("Grasshopper")
from Grasshopper.Kernel.Data import GH_Path as ghPath
from Grasshopper import DataTree as ghTree
#import System.Collections.Generic as SCG

def find_len(a, b):
    return math.sqrt(math.pow((b[0] - a[0]), 2) + math.pow((b[1] - a[1]), 2))

def find_mid(a, b):
    c = R.Geometry.Point3d((a[0] + b[0])/2, (a[1] + b[1])/2, 0)
    return c

angs = ghTree[float]()
polylines = ghTree[R.Geometry.Polyline]()


for formIdx in range(crvs.BranchCount):
    #print "formIdx ", formIdx
    pts = crvs.Branch(formIdx)
    crvCorners = []
    #crvCorners.append(pts[0])
    x = len(pts)
    path = ghPath(formIdx)

    for i in range(1,x+1):
        crvCorners.append(pts[i%x])

    # polylineCrv = R.Geometry.Polyline(crvCorners)
    # polylines.Add(polylineCrv, path)

    while x > numOfPoints: # 3
        min_len = find_len(crvCorners[0], crvCorners[1])
        remove_location = 0

        for i in range(0,x):
            len_a = find_len(crvCorners[i], crvCorners[(i+1)%x])
            if len_a < min_len:
                min_len = len_a
                remove_location = i

        to_remove_1 = crvCorners[(remove_location)%x]
        to_remove_2 = crvCorners[(remove_location + 1)%x]

        mid = find_mid(to_remove_1, to_remove_2)

        crvCorners.remove(to_remove_1)
        crvCorners.remove(to_remove_2)

        crvCorners.insert(remove_location, mid)
        x = len(crvCorners)

    polylineCrv = R.Geometry.Polyline(crvCorners)
    polylines.Add(polylineCrv, path)
# ---------- end py_remove_pts ----------
cp_2 = ControlPoints(Curve=py_remove_pts)  # -> Points, Weights, Knots
crv_cp = CurveClosestPoint(Point=simplify(cp_2.Points), Curve=graft(cull_5))  # -> Point, Parameter, Distance
pline_3 = PolyLine(Vertices=crv_cp.Point, Closed=Toggle(True))  # -> flatten(Polyline)
area_4 = Area(Geometry=pline_3)  # -> Area, Centroid
area_5 = Area(Geometry=cull_5)  # -> Area, Centroid
division_4 = Division(A=area_4.Area, B=area_5.Area)
smaller_2 = SmallerThan(FirstNumber=division_4, SecondNumber="0.47")  # -> SmallerThan, OrEqualTo
larger_2 = LargerThan(FirstNumber=division_4, SecondNumber="0.47")  # -> LargerThan, OrEqualTo
cull_7 = CullPattern(List=division_4, CullPattern=larger_2.LargerThan)
lng_3 = ListLength(List=cull_7)
pow_4 = Power(A=cull_7, B=Slider(2, range=0..10))
multiplication_6 = Multiplication(A="255", B=pow_4)
sort = SortList(Keys=multiplication_6)  # -> reverse(Keys), reverse(ValuesA)
item = ListItem(List=sort.Keys, Index=0, Wrap=True)
max = Maximum(A="200", B=item)
dup_3 = DuplicateData(Data=max, Number=lng_3, Order=True)
subtraction_5 = Subtraction(A=dup_3, B=multiplication_6)
cull_8 = CullPattern(List=cull_5, CullPattern=larger_2.LargerThan)
filter_by_size_2 = FilterBySize(A=min_size, B=max_size, G=cull_5)
multiplication_7 = Multiplication(A=multiplication_6, B=filter_by_size_2)
multiplication_8 = Multiplication(A=subtraction_5, B=filter_by_size_2)
boundary_2 = BoundarySurfaces(Edges=cull_8)
rgb_2 = ColourRGB(Alpha=255, Red=multiplication_8, Green=multiplication_7, Blue=0)
dom_color_2 = DomColor(mixvsdom=mix_vs_dom, C=rgb_2, B=square_active, B_2=triangle_active)
preview_2 = CustomPreview(Geometry=boundary_2, Shader=dom_color_2)

# ---- group: find extream points
cpoly = ControlPolygon(Curve=graft(crv_2))  # -> Polygon, Points
redpline = Reduce(Polyline=cpoly.Polygon, Tolerance=1)  # -> Polyline, Reduction
cp_3 = ControlPoints(Curve=redpline.Polyline)  # -> Points, Weights, Knots
cpoly_2 = ControlPolygon(Curve=redpline.Polyline)  # -> Polygon, Points
lng_4 = ListLength(List=cp_3.Points)
hull = ConvexHull(Points=cpoly_2.Points, Plane=PlaneXY(0, 0, 0))  # -> Hull, HullZ, Indices
cp_4 = ControlPoints(Curve=hull.Hull)  # -> simplify(Points), Weights, Knots
subtraction_6 = Subtraction(A=lng_4, B=1)
series_2 = Series(Start=0, Step=1, Count=subtraction_6)
item_2 = ListItem(List=cp_3.Points, Index=series_2, Wrap=True)  # -> simplify(Item)
py_clear_polyline_pts_2 = PythonScript(crvs=simplify(item_2), a=degrees_2, d=distance_2)  # -> flatten(out), flatten(polylines), angs; inputs crvs: tree of Point3d; same code as py_clear_polyline_pts
cp_5 = ControlPoints(Curve=py_clear_polyline_pts_2.polylines)  # -> simplify(Points), Weights, Knots

# ----
bool = Boolean(graft(smaller_2.OrEqualTo))
cull_9 = CullPattern(List=cull_5, CullPattern=flatten(bool))
cull_10 = CullPattern(List=clearnull_3, CullPattern=bool)
cull_11 = CullPattern(List=clearintnull, CullPattern=bool)
clearintnull_2 = PythonScript(x=cull_11)  # -> a; inputs x: tree of Int32; same code as clearintnull
clearnull_4 = PythonScript(x=cull_10)  # -> a; inputs x: tree of Point3d; same code as clearnull
crv_3 = Curve(cull_9)
range = Range(Domain="PI/2", Steps="100")
xy = XYPlane(Origin=Point(0, 0, 0))
prot = RotatePlane(Plane=xy, Angle=range)  # -> graft(Plane)
bbox = BoundingBox(Content=crv_3, Plane=simplify(prot))  # -> Box, Box_2
area_6 = Area(Geometry=crv_3)  # -> Area, Centroid
flip = FlipMatrix(Data=bbox.Box)  # -> simplify(Data)
dist = Distance(PointA=clearnull_4, PointB=graft(area_6.Centroid))  # disabled
area_7 = Area(Geometry=flip)  # -> Area, Centroid
mmax = Mmax(K=dist)  # -> flatten(i); disabled
circle = CircleCNR(Center=area_6.Centroid, Normal=Vector(0, 0, 1), Radius=mmax)  # disabled
sort_2 = SortList(Keys=area_7.Area, ValuesA=flip)  # -> Keys, ValuesA
expression = Expression(x=mmax, Expression="π*(x^2)")  # disabled
item_3 = ListItem(List=sort_2.ValuesA, Index=0, Wrap=True)
number_slider_8 = Slider(3.2, range=0..10)  # disabled
area_8 = Area(Geometry=flatten(item_3))  # -> Area, Centroid
division_5 = Division(A=area_6.Area, B=expression)  # disabled
division_6 = Division(A=area_6.Area, B=area_8.Area)
pow_5 = Power(A=division_5, B=number_slider_8)  # disabled
norm_0_1_4 = Norm01(num=flatten(division_6))
subtraction_7 = Subtraction(A="1", B=norm_0_1_4)
lng_5 = ListLength(List=norm_0_1_4)
pow_6 = Power(A=subtraction_7, B=Slider(0.1, range=0..10))
numofpts = Number(flatten(clearintnull_2))
multiplication_9 = Multiplication(A=pow_6, B="255")
division_7 = Division(A=multiplication_9, B=numofpts)
filter_by_size_3 = FilterBySize(A=min_size, B=max_size, G=crv_3)
sort_3 = SortList(Keys=division_7)  # -> reverse(Keys), ValuesA
item_4 = ListItem(List=sort_3.Keys, Index=0, Wrap=True)
boundary_3 = BoundarySurfaces(Edges=crv_3)
max_2 = Maximum(A="140", B=item_4)
dup_4 = DuplicateData(Data=max_2, Number=lng_5, Order=True)
subtraction_8 = Subtraction(A=dup_4, B=division_7)
multiplication_10 = Multiplication(A=subtraction_8, B=filter_by_size_3)
multiplication_11 = Multiplication(A=multiplication_10, B=square_active)
rgb_3 = ColourRGB(Alpha=255, Red=multiplication_11, Green=0, Blue=0)
dominantsqr = DominantSqr(mixvsdom=mix_vs_dom, A=rgb_3, C=rgb_3)
preview_3 = CustomPreview(Geometry=boundary_3, Shader=dominantsqr)

# ---- group: 4 points
# bigger value =
# more square
panel_5 = Panel("4")
equals = Equality(FirstNumber=extreme_pts, SecondNumber=panel_5)  # -> Equality, Inequality
cull_12 = CullPattern(List=cp.Points, CullPattern=equals.Equality)
clearnull_5 = PythonScript(x=cull_12)  # -> a; inputs x: tree of Point3d; disabled; same code as clearnull
cull_13 = CullPattern(List=crv_2, CullPattern=flatten(equals.Equality))
py_remove_pts_2 = PythonScript(crvs=simplify(clearnull_5), numOfPoints="3")  # -> flatten(polylines); inputs crvs: tree of Point3d, numOfPoints: Int32; disabled; same code as py_remove_pts
range_2 = Range(Domain="PI/2", Steps="100")
xy_2 = XYPlane(Origin=Point(0, 0, 0))
prot_2 = RotatePlane(Plane=xy_2, Angle=range_2)  # -> graft(Plane)
cp_6 = ControlPoints(Curve=py_remove_pts_2)  # -> Points, Weights, Knots; disabled
toggle = BooleanToggle(True)  # disabled
bbox_2 = BoundingBox(Content=cull_13, Plane=simplify(prot_2))  # -> Box, Box_2
pline_4 = PolyLine(Vertices=cp_6.Points, Closed=toggle)  # disabled
flip_2 = FlipMatrix(Data=bbox_2.Box)  # -> simplify(Data)
area_9 = Area(Geometry=pline_4)  # -> flatten(Area), Centroid; disabled
area_10 = Area(Geometry=flip_2)  # -> Area, Centroid
area_11 = Area(Geometry=cull_13)  # -> Area, Centroid; disabled
number_slider_9 = Slider(1, range=0..1)  # disabled
sort_4 = SortList(Keys=area_10.Area, ValuesA=flip_2)  # -> Keys, ValuesA
division_8 = Division(A=area_9.Area, B=area_11.Area)  # -> graft(Result); disabled
panel_6 = Panel("1")  # disabled
item_5 = ListItem(List=sort_4.ValuesA, Index=0, Wrap=True)
subtraction_9 = Subtraction(A=panel_6, B=division_8)  # disabled
area_12 = Area(Geometry=flatten(item_5))  # -> Area, Centroid
area_13 = Area(Geometry=cull_13)  # -> Area, Centroid
panel_7 = Panel("1")  # disabled
subtraction_10 = Subtraction(A=panel_7, B=number_slider_9)  # disabled
division_9 = Division(A=area_13.Area, B=area_12.Area)  # -> graft(Result)
multiplication_12 = Multiplication(A=subtraction_9, B=subtraction_10)  # disabled
multiplication_13 = Multiplication(A=division_9, B=number_slider_9)  # disabled
addition_3 = Addition(A=division_9, B=multiplication_12)  # -> flatten(Result)
norm_0_1_5 = Norm01(num=flatten(addition_3))
subtraction_11 = Subtraction(A="1", B=norm_0_1_5)
lng_6 = ListLength(List=subtraction_11)
dup_5 = DuplicateData(Data="255", Number=lng_6, Order=True)
pow_7 = Power(A=subtraction_11, B=Slider(1.7, range=0..10))
multiplication_14 = Multiplication(A=pow_7, B="255")
subtraction_12 = Subtraction(A=dup_5, B=multiplication_14)
filter_by_size_4 = FilterBySize(A=min_size, B=max_size, G=cull_13)
multiplication_15 = Multiplication(A=subtraction_12, B=filter_by_size_4)
multiplication_16 = Multiplication(A=multiplication_14, B=filter_by_size_4)
rgb_4 = ColourRGB(Alpha=255, Red=multiplication_15, Green=multiplication_16, Blue=0)
boundary_4 = BoundarySurfaces(Edges=cull_13)
dom_color_3 = DomColor(mixvsdom=mix_vs_dom, C=rgb_4, B=square_active, B_2=triangle_active)
preview_4 = CustomPreview(Geometry=boundary_4, Shader=dom_color_3)

# ---- group: find 20 closest curves
area_14 = Area(Geometry=crv_2)  # -> Area, Centroid
cps = ClosestPoints(Point=area_14.Centroid, Cloud=area_14.Centroid, Count=Slider(20, range=0..100))  # -> ClosestPoint, CPIndex, Distance
path_mapper = PathMapper(cps.ClosestPoint, source="{A;B}", target="{B}")
index = ItemIndex(List=area_14.Centroid, Item=path_mapper)
cull_i = CullIndex(List=index, Indices=0, Wrap=True)
path_mapper_2 = PathMapper(cull_i, source="{A;B}", target="{A}")

# ----
cull_14 = CullPattern(List=cp.Points, CullPattern=equals.Equality)

create_nodes_data_structure = PythonScript(
    nearestCurvesIdx=path_mapper_2,
    maxDist=number_slider_2,
    curvesCP=cp_5.Points,
    thresholdAz=number_slider,
    maxDegree=number_slider_3)  # -> nodeTree, lineTree, nodeLines, NeighLinesAz; inputs nearestCurvesIdx: tree of Int32, curvesCP: tree of Point3d
# ---------- create_nodes_data_structure: Python ----------
###############################################################################
#  FILE: createNodes.py
#  WRITER : adiyehezkeli, ID: 300203791
#           naamaglauber, ID: 312513583
#  DESCRIPTION :
#   conver Rhino structures to Python point3D structure (lists)
#   operation and calculation are directly on our structures and converted back to Rhino as
###############################################################################

import rhinoscriptsyntax as rs
import math
import clr
import Rhino as R
clr.AddReference("Grasshopper")
from Grasshopper.Kernel.Data import GH_Path as ghPath
from Grasshopper import DataTree as ghTree
#from operator import itemgetter

# input:  point1 <Point3d>
#         point2 <Point3d>
# output: float
def calcAzimuth(point1, point2):
    p2 = point1 - point2 #Point3d(Subtraction(point1, point2))
    az = 0
    if p2[1] < 0:
        sign = -1
    else:
        sign = 1
    if p2[0] == 0:
        az = 90
    else:
        if p2[0] > 0:
            az = math.degrees(math.atan(sign*p2[1]/p2[0]))
        if p2[0] < 0:
            az = math.degrees(math.atan(sign*p2[1]/(-p2[0])))
            az = 180 - az
    #if sign == -1:
    #    az = 360 - az
    #return az
    return az*sign

# input:  pointList <Point[]>
# output: Point3d
def find_center(pointList):
    x = 0.0
    y = 0.0

    for centerPoint in pointList:
        x += centerPoint.point3d[0]
        y += centerPoint.point3d[1]

    x = x/len(pointList)
    y = y/len(pointList)

    return R.Geometry.Point3d(x,y,0.0)

class Curve:

    # input:  points <Point>
    #         index  <int>, index in the global list of curves
    # output: void
    def __init__(self, points, usablePointsIdx, index):
        self.neighborsIdxs = {}     # Dictionary(int) ???
        self.points = points        # Point[]
        self.index = index          # int, in the global list of curves
        self.usablePointsIdx = usablePointsIdx  # int[], indexes of usable points (in self.points)

class Point:
    #input:  curveIdx   <int>
    #        point      <Point3d>
    #        curveIndex <int>, index of point in the curve
    def __init__(self, curveIdx, point, curveIndex):
        self.curveIdx = curveIdx
        #print ("init Point, type of curve: ", type(self.curveIdx))
        self.point3d = point
        self.curveIndex = curveIndex
        self.nodeIdx = -1                # each Point is related to only one Node object

    def set_node(self, nodeIdx):
        self.nodeIdx = nodeIdx

# input:  p1 <Point3d>
#         p2 <Point3d>
# output: float
#def ClacIncline(p1,p2):
#    return (p1[1] - p2[1])/(p1[0] - p2[0])

class Line:
    # input:  node1 <Node>
    #         node2 <Node>
    # output: void

    def __init__(self, node1, node2):
        self.lineNodes = []             # Node[]
        #print "node1: ", node1
        self.lineNodes.append(node1)
        #print "node2: ", node2
        self.lineNodes.append(node2)
        self.startNode = node1          # Node
        self.endNode = node2            # Node
        cen1 = node1.center             # Point3d
        cen2 = node2.center             # Point3d
        self.startAzimuth = calcAzimuth(cen1, cen2) # float
        self.endAzimuth = self.startAzimuth         # float


    # input:  nextNode <Node>
    # output: void
    def AddEndNode(self, nextNode):
        self.lineNodes.append(nextNode)
        self.endAzimuth = calcAzimuth(self.lineNodes[-1].center, nextNode.center)
        self.endNode = nextNode

    # input:  prevNode <Node>
    # output: void
    def AddStartNode(self, prevNode):
        rLine = []
        rLine.append(prevNode)
        listSize = len(self.lineNodes)
        #for i in range(listSize):
            #print "rLine: ", rLine
            #rLine.append(self.lineNodes[listSize-i])
        self.lineNodes = rLine
        self.startAzimuth = calcAzimuth(nextNode.center, self.lineNodes[0].center)
        self.startNode = prevNode

class Node:
    # input:  point <Point>
    # output: void
    def __init__(self, point, nodeIdx):
        self.nodePoints = []                                # Point[]
        self.nodePoints.append(point)
        self.lines = []                                     # Line[]
        self.center = R.Geometry.Point3d(point.point3d)     # Point3d
        self.nodeIdx = nodeIdx
        self.connections = []                               # Node[] of other nodes connected to this node with a line

    def size(self):
        return len(self.nodePoints)

    # input:  point <Point>
    # output: void
    def add_point(self, point):
        self.nodePoints.append(point)
        self.center = find_center(self.nodePoints) # Point3d

#######################################################################
#                       Create Python structures                      #
#######################################################################

curves = []     # Curve[]
nodes = []      # Node[]
allLines = []

# convert to python structures
# curvesCP          <Tree(Point3d)> - Rhino input
# nearestCurvesIdx  <Tree(int[])>   - Rhino input
for branchIdx in range(curvesCP.BranchCount):
    curvePoints = []                # Point[]
    usablePointsIdx = []                # int (point index)
    pts = curvesCP.Branch(branchIdx)   # Point3d[]
    for point in range(len(pts)):
        curvePoints.append(Point(branchIdx, pts[point], point))
        usablePointsIdx.append(point)

    newCurve = Curve(curvePoints, usablePointsIdx, branchIdx)
    newCurve.neighborsIdxs = nearestCurvesIdx.Branch(branchIdx)
    curves.append(newCurve)

#######################################################################
#                         Initializing all nodes                      #
#######################################################################
nodeIdx = 0
for curve in curves:
    neighborsIdxs = curve.neighborsIdxs
    while len(curve.usablePointsIdx) > 0: # Point[]
        pointToUse = curve.usablePointsIdx.pop()
        node = Node(curve.points[pointToUse], nodeIdx)
        curve.points[pointToUse].set_node(nodeIdx)

        for nIdx in neighborsIdxs:
            pts = curves[nIdx].usablePointsIdx
            pointsToDelete = []
            for point2Idx in pts:  # Point[]
                # maxDist <float> - Rhino input
                if curve.points[pointToUse].point3d.DistanceTo(curves[nIdx].points[point2Idx].point3d) < maxDist:
                    curves[nIdx].points[point2Idx].set_node(node.nodeIdx) # nodeIdx +=1 ???
                    node.add_point(curves[nIdx].points[point2Idx])
                    pointsToDelete.append(point2Idx)
            for toDelete in pointsToDelete:
                curves[nIdx].usablePointsIdx.remove(toDelete)
        if len(node.nodePoints) > 1:
            nodes.append(node)
            nodeIdx += 1
        else:
            for point in node.nodePoints:
                point.nodeIdx = -1
        # if len(node.nodePoints) > 1:
        #     nodes.append(node)

# Component Nodes output:
nodeTree = ghTree[R.Geometry.Point3d]()
for node in nodes:
    nodeTree.Add(node.center)

#######################################################################
#               Search for all lines for each node                    #
#######################################################################
nodeIdx = 0
for node in nodes:                                  # Node[]
    #print "nodeIdx: ", nodeIdx,
    for pt in node.nodePoints:                      # Point[]
        prevPtIdx = pt.curveIndex - 1               # int
        nextPtIdx = pt.curveIndex + 1               # int
        crvPoints = curves[pt.curveIdx].points
        n = len(crvPoints)
        prevPt = crvPoints[prevPtIdx % n]     # Point TODO???
        nextPt = crvPoints[nextPtIdx % n]     # Point TODO???
        prevNode = nodes[prevPt.nodeIdx]      # Node
        nextNode = nodes[nextPt.nodeIdx]      # Node
        # All lines in a node start from this node ???
        if prevPt.nodeIdx > -1:
            if not prevNode in node.connections:
                node.connections.append(prevNode)
                prevNode.connections.append(node)
                linePrev = Line(prevNode, node)
                allLines.append(linePrev)
                node.lines.append(linePrev)
                prevNode.lines.append(linePrev)
        if nextPt.nodeIdx > -1:
            if not nextNode in node.connections:
                node.connections.append(nextNode)
                nextNode.connections.append(node)
                lineNext = Line(node, nextNode)
                allLines.append(lineNext)
                node.lines.append(lineNext)
                nextNode.lines.append(lineNext)

def reverseLine(line):
    # reverse azimuths
    tempAzimuth = line.startAzimuth
    line.startAzimuth = line.endAzimuth
    line.endAzimuth = tempAzimuth

    # reverse start/end nodes
    tempNode = line.startNode
    line.startNode = line.endNode
    line.endNode = tempNode

    line.lineNodes.reverse()


# input:  line1 <Line>
# input:  line2 <Line>
# input:  node <Node> (where to join)
# output: void
def joinLines(line1, line2, node):
    # print("joining")
    if line1.startNode == line2.startNode:
        reverseLine(line1)
    elif line1.startNode == line2.endNode:
        reverseLine(line1)
        reverseLine(line2)
    elif line1.endNode == line2.endNode:
        reverseLine(line2)

    for lineNode in line2.lineNodes:
        line1.AddEndNode(lineNode)
    line1.endNode = line2.endNode
    # line2.endNode.lines.append(line1)
    line2.endNode.lines[line2.endNode.lines.index(line2)] = line1
    # line2.endNode.lines.remove(line2)

    allLines.remove(line2)

#######################################################################
#                   Combining lines into one long curve               #
#######################################################################
NeighLinesAz = []
for node in nodes:
    azimuths = []
    differences = []
    joined = []
    for otherNode in node.connections:
        az = calcAzimuth(node.center, otherNode.center)
        azimuths.append(az)
    for i in range(len(azimuths)):
        for j in range(len(azimuths)):
            if i < j:
                d = abs( 180 - abs(azimuths[i] - azimuths[j])) # 180--?
                #d = min(abs( 360 - abs(azimuths[i] - azimuths[j])), abs(azimuths[i] - azimuths[j])) # 180--?
                NeighLinesAz.append(d)
                if d < maxDegree:
                #if d < 45 or d > 134:
                    differences.append(((i,j), d))
    count = 0
    while len(differences) > 0:
        # print("starting to join lines")
        if count < 1000:
            minDiff = 0
            for i in range(len(differences)):
                if differences[minDiff][1] > differences[i][1]:
                    minDiff = i
            toDelete = []
            if differences[minDiff][1] >= maxDegree:
            #if differences[minDiff][1] >= 45 and differences[minDiff][1] <= 134:
                print("oh no!")
            joinLines(node.lines[[differences[minDiff]][0][0][0]], node.lines[[differences[minDiff]][0][0][1]], node)
            toDelete.append(differences[minDiff])
            for diff in differences:
                if not diff == differences[minDiff]:
                    if diff[0][0] == differences[minDiff][0][0] or diff[0][1] == differences[minDiff][0][0] or diff[0][0] == differences[minDiff][0][1] or diff[0][1] == differences[minDiff][0][1]:
                        toDelete.append(diff)
            for diff in toDelete:
                differences.remove(diff)
            count += 1
        else:
            print("endless loop!!!")
            break



    # for i in range(len(azimuths)):
    #     bestMatch = (0, 180)
    #     for j in range(len(azimuths)):
    #         diff = abs(abs(azimuths[i] - azimuths[j]) - 180)
    #         if diff < bestMatch[]
    #
    #         if j > i:
    #             if abs(abs(azimuths[i] - azimuths[j]) - 180) < maxDegree:
    #                 print("i: ", i, "J: ", j)
    #                 joinLines(node.lines[i], node.lines[j], node)
    
# for node in nodes:
#     print(node.nodeIdx)
#
# for line in allLines:
#     print("start node: ", line.startNode.center)
#     print("end node: ", line.endNode.center)

#nodeIdx = 0
#a = []
#b = []
#centers = []
lineTree = ghTree[R.Geometry.Polyline]()
# node = nodes[0]
# path = ghPath(nodeIdx)
# nodeIdx +=1
# for line in node.lines:
#     for neigborNode in line.lineNodes:  # Node
#         centerNeigbor = neigborNode.center
#         centers.append(centerNeigbor)
#         myCenter = node.center
#         myPoint = R.Geometry.Point3d(myCenter)
#         a.append(myPoint)
#         neighborPoint = R.Geometry.Point3d(centerNeigbor)
#         b.append(neighborPoint)
#         newLine = R.Geometry.Polyline() # Line
#         newLine.Add(myPoint)
#         newLine.Add(neighborPoint)
#         lineTree.Add(newLine)

for line in allLines:
    path = ghPath(nodeIdx)
    nodeIdx +=1
    currentLine = R.Geometry.Polyline()
    for lineNode in line.lineNodes:  # Node
        currentLine.Add(lineNode.center)
    lineTree.Add(currentLine)

# for node in nodes:
#     path = ghPath(nodeIdx)
#     nodeIdx +=1
#     for line in node.lines:
#         currentLine = R.Geometry.Polyline()
#         for lineNode in line.lineNodes:  # Node
#             currentLine.Add(lineNode.center)
#         lineTree.Add(currentLine)


        # for neigborNode in line.lineNodes:  # Node
        #     centerNeigbor = neigborNode.center
        #     myCenter = node.center
        #     myPoint = R.Geometry.Point3d(myCenter)
        #     a.append(myPoint)
        #     neighborPoint = R.Geometry.Point3d(centerNeigbor)
        #     b.append(neighborPoint)
        #     newLine = R.Geometry.Polyline() # Line
        #     newLine.Add(myPoint)
        #     newLine.Add(neighborPoint)
        #     lineTree.Add(newLine)
"""
# Unifying lines
# TO CHECK Avoid LOOPS!!!!
for node in nodes:
    for line in node.lines:
        # Take one before last node of the current line
        OneBeforeLastNodeInLine = line.lineNodes[-2]
        # Take last node of the current line it will be the FIRST NODE for the next line in the unifying process
        LastNodeInLine = line.lineNodes[-1]
        # Find azimuth of the last segment in the current line
        prevAz = calcAzimuth( OneBeforeLastNodeInLine.center, LastNodeInLine.center)
        minAz = 180
        optionalNextLines = []
        lineToUnifyWith = None  # Line
        for neighLine in LastNodeInLine.lines:
            # take next node of the neighbor line
            neighLine_SecondNode = neighLine.lineNodes[1]
            az = calcAzimuth(LastNodeInLine.center, neighLine_SecondNode.center)
            if az < thresholdAz:
                optionalNextLines.append((az, neighLine))
            if az < minAz:
                minAz = az
                lineToUnifyWith = neighLine
        if lineToUnifyWith != None:
            for lNode in lineToUnifyWith.lineNodes:
                line.AddEndNode(lNode)
            for lNode in line.lineNodes:
                print "lineToUnifyWith", lineToUnifyWith
                lineToUnifyWith.AddStartNode(lNode)
        #optionalNextLines.sort(key=itemgetter(1))
        #lineToUnifyWith = optionalNextLines[0][1]

# reorgenizing all the lines in one list
lineTree = ghTree[R.Geometry.Point3d]()
for node in nodes:                          # Node
    for line in node.lines:                 # Line
        for neigborNode in line.lineNodes:  # Node
            centerNeigborNode = neigborNode.center
            rhinoPoint = R.Geometry.Point3d(centerNeigborNode)
            lineTree.Add(rhinoPoint)
"""
# ---------- end create_nodes_data_structure ----------
len = Length(Curve=create_nodes_data_structure.lineTree)
sort_5 = SortList(Keys=len, ValuesA=create_nodes_data_structure.lineTree)  # -> Keys, ValuesA
item_6 = ListItem(List=sort_5.Keys, Index="0", Wrap=True)
item_7 = ListItem(List=reverse(sort_5.Keys), Index="0", Wrap=True)
item_8 = ListItem(List=reverse(sort_5.ValuesA), Index="1", Wrap=True)

gradient = Gradient(LowerLimit=item_6, UpperLimit=item_7, Parameter=len, stops=[0.0523: RGB(0, 0, 0), 0.218: RGB(255, 255, 255)])

multiplication_17 = Multiplication(A=gradient, B=lines_active)

lines = Lines(maxdist=number_slider_2, thresholdaz=number_slider, G=crv_2, maxdegree=number_slider_3)  # -> linetree, i, i_2, L
wide_lines = WideLines(C=create_nodes_data_structure.lineTree, num=len, col=gradient, A=len)  # -> C_2, col_3
preview_5 = CustomPreview(Geometry=wide_lines.C_2, Shader=simplify(wide_lines.col_3))
preview_6 = CustomPreview(Geometry=create_nodes_data_structure.lineTree, Shader=multiplication_17)

circle_2 = CircleCNR(Center=create_nodes_data_structure.nodeTree, Normal=Vector(0, 0, 1), Radius=radius)
sort_6 = SortList(Keys=create_nodes_data_structure.NeighLinesAz)  # -> Keys, ValuesA
panel_8 = Panel(sort_6.Keys)
crv_4 = Curve(cull_13)  # disabled
item_9 = ListItem(List=crv_4, Index=series, Wrap=True)  # disabled
lng_7 = ListLength(List=item_9)  # disabled
item_10 = ListItem(List=crv_4, Index=subtraction, Wrap=True)  # disabled
boundary_5 = BoundarySurfaces(Edges=item_9)  # disabled
area_15 = Area(Geometry=item_10)  # -> Area, Centroid; disabled
lng_8 = ListLength(List=boundary_5)  # disabled
subtraction_13 = Subtraction(A=lng_8, B=lng_7)  # disabled
boundary_6 = BoundarySurfaces(Edges=item_10)  # disabled
panel_9 = Panel(subtraction_13)  # disabled
filter_by_size_5 = FilterBySize(A=min_size, B=max_size, G=cull_13)  # disabled
multiplication_18 = Multiplication(A=subtraction_3, B=filter_by_size_5)  # disabled
multiplication_19 = Multiplication(A=multiplication, B=filter_by_size_5)  # disabled
rgb_5 = ColourRGB(Alpha=255, Red=multiplication_18, Green=multiplication_19, Blue=0)  # disabled
dom_color_4 = DomColor(mixvsdom=mix_vs_dom, C=rgb_5, B=square_active, B_2=triangle_active)  # disabled
boundary_7 = BoundarySurfaces(Edges=cull_13)  # disabled
preview_7 = CustomPreview(Geometry=boundary_7, Shader=dom_color_4)  # disabled

# ==== cluster CrvPts
C = ClusterInput()
cpoly = ControlPolygon(Curve=graft(C))  # -> Polygon, Points
redpline = Reduce(Polyline=cpoly.Polygon, Tolerance=1)  # -> Polyline, Reduction
cp = ControlPoints(Curve=redpline.Polyline)  # -> Points, Weights, Knots
P = ClusterOutput(cp.Points)
lng = ListLength(List=cp.Points)
subtraction = Subtraction(A=lng, B=1)
series = Series(Start=0, Step=1, Count=subtraction)
item = ListItem(List=cp.Points, Index=series, Wrap=True)  # -> simplify(Item)
i = ClusterOutput(item)

# ==== cluster Lines
G = ClusterInput()

# ---- group: find 20 closest curves
area = Area(Geometry=G)  # -> Area, Centroid
cps = ClosestPoints(Point=area.Centroid, Cloud=area.Centroid, Count=Slider(20, range=0..100))  # -> ClosestPoint, CPIndex, Distance
path_mapper = PathMapper(cps.ClosestPoint, source="{A;B}", target="{B}")
index = ItemIndex(List=area.Centroid, Item=path_mapper)
cull_i = CullIndex(List=index, Indices=0, Wrap=True)
path_mapper_2 = PathMapper(cull_i, source="{A;B}", target="{A}")

# ----
degrees = Slider(155, range=150..180)
distance = Slider(1.54, range=0..2.2)

# ---- group: find extream points
cpoly = ControlPolygon(Curve=graft(G))  # -> Polygon, Points
redpline = Reduce(Polyline=cpoly.Polygon, Tolerance=1)  # -> Polyline, Reduction
cp = ControlPoints(Curve=redpline.Polyline)  # -> Points, Weights, Knots
cpoly_2 = ControlPolygon(Curve=redpline.Polyline)  # -> Polygon, Points
lng = ListLength(List=cp.Points)
hull = ConvexHull(Points=cpoly_2.Points, Plane=PlaneXY(0, 0, 0))  # -> Hull, HullZ, Indices
cp_2 = ControlPoints(Curve=hull.Hull)  # -> simplify(Points), Weights, Knots
subtraction = Subtraction(A=lng, B=1)
series = Series(Start=0, Step=1, Count=subtraction)
item = ListItem(List=cp.Points, Index=series, Wrap=True)  # -> simplify(Item)
py_clear_polyline_pts = PythonScript(crvs=simplify(item), a=degrees, d=distance)  # -> flatten(out), flatten(polylines), angs; inputs crvs: tree of Point3d
# ---------- py_clear_polyline_pts: Python ----------
__author__ = "NaamaGlauber"
import math
import clr
import Rhino as R
clr.AddReference("Grasshopper")
from Grasshopper.Kernel.Data import GH_Path as ghPath
from Grasshopper import DataTree as ghTree

def find_len(a, b):
    return math.sqrt(math.pow((b[0] - a[0]), 2) + math.pow((b[1] - a[1]), 2))

angs = ghTree[float]()
polylines = ghTree[R.Geometry.Polyline]()
for formIdx in range(crvs.BranchCount):
    #print "formIdx ", formIdx
    pts = crvs.Branch(formIdx)
    crvCorners = []
    #crvCorners.append(pts[0])
    x = len(pts)
    path = ghPath(formIdx)
    for i in range(1,x+1):
        toAdd = 1
        len_a = find_len(pts[(i-1)%x], pts[i%x])
        len_b = find_len(pts[i%x], pts[(i+1)%x])
        len_c = find_len(pts[(i-1)%x], pts[(i+1)%x]) # The edge in front of the desired angle
         
        ratio = ((len_a * len_a) + (len_b * len_b) - (len_c * len_c)) / (2 * len_a * len_b)
        rad = math.acos(ratio) #math.radians(ratio)
        deg= math.degrees(rad)
        if deg > a and x>3 and (len(crvCorners)+(x-i+1))>3:
            toAdd = 0
            #print "point idx", i%x
            #print "too flat", deg
            
        dis = len_a #find_len(pts[(i-1)%x], pts[(i)%x])
        #print "dis= ", dis
        if dis <d and x>3 and (len(crvCorners)+(x-i+1))>3:
            toAdd = 0
            #print "x= " , x
            #print "potential points = " ,(len(crvCorners)+(x-i+1)) 
            #print "pts[i-1] = ", pts[(i-1)%x]
            #print "pts[i] = ", pts[(i)%x]
            #print "point idx", i%x
            #print "too close", dis
            #print "toAdd", toAdd
            
        if toAdd == 1:
            #print "toAdd ", toAdd
            angs.Add(deg, path)
            crvCorners.append(pts[i%x])
    polylineCrv = R.Geometry.Polyline(crvCorners)
    polylines.Add(polylineCrv, path)
# ---------- end py_clear_polyline_pts ----------
cp_3 = ControlPoints(Curve=py_clear_polyline_pts.polylines)  # -> simplify(Points), Weights, Knots

# ----
thresholdaz = ClusterInput()
maxdegree = ClusterInput()
maxdist = ClusterInput()

create_nodes_data_structure = PythonScript(nearestCurvesIdx=path_mapper_2, maxDist=maxdist, curvesCP=cp_3.Points, thresholdAz=thresholdaz, maxDegree=maxdegree)  # -> out, nodeTree, lineTree, nodeLines, a, b, centers; inputs nearestCurvesIdx: tree of Int32, curvesCP: tree of Point3d
# ---------- create_nodes_data_structure: Python ----------
###############################################################################
#  FILE: createNodes.py
#  WRITER : adiyehezkeli, ID: 300203791
#           naamaglauber, ID: 312513583
#  DESCRIPTION :
#   conver Rhino structures to Python point3D structure (lists)
#   operation and calculation are directly on our structures and converted back to Rhino as
###############################################################################

import rhinoscriptsyntax as rs
import math
import clr
import Rhino as R
clr.AddReference("Grasshopper")
from Grasshopper.Kernel.Data import GH_Path as ghPath
from Grasshopper import DataTree as ghTree
#from operator import itemgetter

# input:  point1 <Point3d>
#         point2 <Point3d>
# output: float
def calcAzimuth(point1, point2):
    p2 = point1 - point2 #Point3d(Subtraction(point1, point2))
    az = 0
    if p2[1] < 0:
        sign = -1
    else:
        sign = 1
    if p2[0] == 0:
        az = 90
    else:
        if p2[0] > 0:
            az = math.degrees(math.atan(sign*p2[1]/p2[0]))
        if p2[0] < 0:
            az = math.degrees(math.atan(sign*p2[1]/(-p2[0])))
            az = 180 - az
    # print(az*sign)
    return az*sign

# input:  pointList <Point[]>
# output: Point3d
def find_center(pointList):
    x = 0.0
    y = 0.0

    for centerPoint in pointList:
        x += centerPoint.point3d[0]
        y += centerPoint.point3d[1]

    x = x/len(pointList)
    y = y/len(pointList)

    return R.Geometry.Point3d(x,y,0.0)

class Curve:

    # input:  points <Point>
    #         index  <int>, index in the global list of curves
    # output: void
    def __init__(self, points, usablePointsIdx, index):
        self.neighborsIdxs = {}     # Dictionary(int) ???
        self.points = points        # Point[]
        self.index = index          # int, in the global list of curves
        self.usablePointsIdx = usablePointsIdx  # int[], indexes of usable points (in self.points)

class Point:
    #input:  curveIdx   <int>
    #        point      <Point3d>
    #        curveIndex <int>, index of point in the curve
    def __init__(self, curveIdx, point, curveIndex):
        self.curveIdx = curveIdx
        #print ("init Point, type of curve: ", type(self.curveIdx))
        self.point3d = point
        self.curveIndex = curveIndex
        self.nodeIdx = -1                # each Point is related to only one Node object

    def set_node(self, nodeIdx):
        self.nodeIdx = nodeIdx

# input:  p1 <Point3d>
#         p2 <Point3d>
# output: float
#def ClacIncline(p1,p2):
#    return (p1[1] - p2[1])/(p1[0] - p2[0])

class Line:
    # input:  node1 <Node>
    #         node2 <Node>
    # output: void

    def __init__(self, node1, node2):
        self.lineNodes = []             # Node[]
        #print "node1: ", node1
        self.lineNodes.append(node1)
        #print "node2: ", node2
        self.lineNodes.append(node2)
        self.startNode = node1          # Node
        self.endNode = node2            # Node
        cen1 = node1.center             # Point3d
        cen2 = node2.center             # Point3d
        self.startAzimuth = calcAzimuth(cen1, cen2) # float
        self.endAzimuth = self.startAzimuth         # float


    # input:  nextNode <Node>
    # output: void
    def AddEndNode(self, nextNode):
        self.lineNodes.append(nextNode)
        self.endAzimuth = calcAzimuth(self.lineNodes[-1].center, nextNode.center)
        self.endNode = nextNode

    # input:  prevNode <Node>
    # output: void
    def AddStartNode(self, prevNode):
        rLine = []
        rLine.append(prevNode)
        listSize = len(self.lineNodes)
        #for i in range(listSize):
            #print "rLine: ", rLine
            #rLine.append(self.lineNodes[listSize-i])
        self.lineNodes = rLine
        self.startAzimuth = calcAzimuth(nextNode.center, self.lineNodes[0].center)
        self.startNode = prevNode

class Node:
    # input:  point <Point>
    # output: void
    def __init__(self, point, nodeIdx):
        self.nodePoints = []                                # Point[]
        self.nodePoints.append(point)
        self.lines = []                                     # Line[]
        self.center = R.Geometry.Point3d(point.point3d)     # Point3d
        self.nodeIdx = nodeIdx
        self.connections = []                               # Node[] of other nodes connected to this node with a line

    def size(self):
        return len(self.nodePoints)

    # input:  point <Point>
    # output: void
    def add_point(self, point):
        self.nodePoints.append(point)
        self.center = find_center(self.nodePoints) # Point3d

#######################################################################
#                       Create Python structures                      #
#######################################################################

curves = []     # Curve[]
nodes = []      # Node[]
allLines = []

# convert to python structures
# curvesCP          <Tree(Point3d)> - Rhino input
# nearestCurvesIdx  <Tree(int[])>   - Rhino input
for branchIdx in range(curvesCP.BranchCount):
    curvePoints = []                # Point[]
    usablePointsIdx = []                # int (point index)
    pts = curvesCP.Branch(branchIdx)   # Point3d[]
    for point in range(len(pts)):
        curvePoints.append(Point(branchIdx, pts[point], point))
        usablePointsIdx.append(point)

    newCurve = Curve(curvePoints, usablePointsIdx, branchIdx)
    newCurve.neighborsIdxs = nearestCurvesIdx.Branch(branchIdx)
    curves.append(newCurve)

######
# Initializing all nodes
nodeIdx = 0
for curve in curves:
    neighborsIdxs = curve.neighborsIdxs
    while len(curve.usablePointsIdx) > 0: # Point[]
        pointToUse = curve.usablePointsIdx.pop()
        node = Node(curve.points[pointToUse], nodeIdx)
        curve.points[pointToUse].set_node(nodeIdx)

        for nIdx in neighborsIdxs:
            pts = curves[nIdx].usablePointsIdx
            pointsToDelete = []
            for point2Idx in pts:  # Point[]
                # maxDist <float> - Rhino input
                if curve.points[pointToUse].point3d.DistanceTo(curves[nIdx].points[point2Idx].point3d) < maxDist:
                    curves[nIdx].points[point2Idx].set_node(node.nodeIdx) # nodeIdx +=1 ???
                    node.add_point(curves[nIdx].points[point2Idx])
                    pointsToDelete.append(point2Idx)
            for toDelete in pointsToDelete:
                curves[nIdx].usablePointsIdx.remove(toDelete)
        if len(node.nodePoints) > 1:
            nodes.append(node)
            nodeIdx += 1
        else:
            for point in node.nodePoints:
                point.nodeIdx = -1
        # if len(node.nodePoints) > 1:
        #     nodes.append(node)

# Component Nodes output:
nodeTree = ghTree[R.Geometry.Point3d]()
for node in nodes:
    nodeTree.Add(node.center)

# Search for all lines for each node
nodeIdx = 0
for node in nodes:                                  # Node[]
    #print "nodeIdx: ", nodeIdx,
    for pt in node.nodePoints:                      # Point[]
        prevPtIdx = pt.curveIndex - 1               # int
        nextPtIdx = pt.curveIndex + 1               # int
        crvPoints = curves[pt.curveIdx].points
        n = len(crvPoints)
        prevPt = crvPoints[prevPtIdx % n]     # Point TODO???
        nextPt = crvPoints[nextPtIdx % n]     # Point TODO???
        prevNode = nodes[prevPt.nodeIdx]      # Node
        nextNode = nodes[nextPt.nodeIdx]      # Node
        # All lines in a node start from this node ???
        if prevPt.nodeIdx > -1:
            if not prevNode in node.connections:
                node.connections.append(prevNode)
                prevNode.connections.append(node)
                linePrev = Line(prevNode, node)
                allLines.append(linePrev)
                node.lines.append(linePrev)
                prevNode.lines.append(linePrev)
        if nextPt.nodeIdx > -1:
            if not nextNode in node.connections:
                node.connections.append(nextNode)
                nextNode.connections.append(node)
                lineNext = Line(node, nextNode)
                allLines.append(lineNext)
                node.lines.append(lineNext)
                nextNode.lines.append(lineNext)

def reverseLine(line):
    # reverse azimuths
    tempAzimuth = line.startAzimuth
    line.startAzimuth = line.endAzimuth
    line.endAzimuth = tempAzimuth

    # reverse start/end nodes
    tempNode = line.startNode
    line.startNode = line.endNode
    line.endNode = tempNode

    line.lineNodes.reverse()


# input:  line1 <Line>
# input:  line2 <Line>
# input:  node <Node> (where to join)
# output: void
def joinLines(line1, line2, node):
    # print("joining")
    if line1.startNode == line2.startNode:
        reverseLine(line1)
    elif line1.startNode == line2.endNode:
        reverseLine(line1)
        reverseLine(line2)
    elif line1.endNode == line2.endNode:
        reverseLine(line2)

    for lineNode in line2.lineNodes:
        line1.AddEndNode(lineNode)
    line1.endNode = line2.endNode
    # line2.endNode.lines.append(line1)
    line2.endNode.lines[line2.endNode.lines.index(line2)] = line1
    # line2.endNode.lines.remove(line2)

    allLines.remove(line2)


# Combining lines into one long curve
for node in nodes:
    azimuths = []
    differences = []
    joined = []
    for otherNode in node.connections:
        azimuths.append(calcAzimuth(node.center, otherNode.center))
    for i in range(len(azimuths)):
        for j in range(len(azimuths)):
            if i < j:
                diff = abs(abs(azimuths[i] - azimuths[j]) - 180) # 180--?
                if diff < maxDegree:
                    differences.append(((i,j), diff))
    count = 0
    while len(differences) > 0:
        # print("starting to join lines")
        if count < 1000:
            minDiff = 0
            for i in range(len(differences)):
                if differences[minDiff][1] > differences[i][1]:
                    minDiff = i
            toDelete = []
            if differences[minDiff][1] >= maxDegree:
                print("oh no!")

            joinLines(node.lines[[differences[minDiff]][0][0][0]], node.lines[[differences[minDiff]][0][0][1]], node)
            toDelete.append(differences[minDiff])
            for diff in differences:
                if not diff == differences[minDiff]:
                    if diff[0][0] == differences[minDiff][0][0] or diff[0][1] == differences[minDiff][0][0] or diff[0][0] == differences[minDiff][0][1] or diff[0][1] == differences[minDiff][0][1]:
                        toDelete.append(diff)
            for diff in toDelete:
                differences.remove(diff)
            count += 1
        else:
            print("endless loop!!!")
            break

    #
    # for i in range(len(azimuths)):
    #     bestMatch = (0, 180)
    #     for j in range(len(azimuths)):
    #         diff = abs(abs(azimuths[i] - azimuths[j]) - 180)
    #         if diff < bestMatch[]
    #
    #         if j > i:
    #             if abs(abs(azimuths[i] - azimuths[j]) - 180) < maxDegree:
    #                 print("i: ", i, "J: ", j)
    #                 joinLines(node.lines[i], node.lines[j], node)




#
# for node in nodes:
#     print(node.nodeIdx)
#
# for line in allLines:
#     print("start node: ", line.startNode.center)
#     print("end node: ", line.endNode.center)

nodeIdx = 0
a = []
b = []
centers = []
lineTree = ghTree[R.Geometry.Polyline]()

# node = nodes[0]
# path = ghPath(nodeIdx)
# nodeIdx +=1
# for line in node.lines:
#     for neigborNode in line.lineNodes:  # Node
#         centerNeigbor = neigborNode.center
#         centers.append(centerNeigbor)
#         myCenter = node.center
#         myPoint = R.Geometry.Point3d(myCenter)
#         a.append(myPoint)
#         neighborPoint = R.Geometry.Point3d(centerNeigbor)
#         b.append(neighborPoint)
#         newLine = R.Geometry.Polyline() # Line
#         newLine.Add(myPoint)
#         newLine.Add(neighborPoint)
#         lineTree.Add(newLine)

for line in allLines:
    path = ghPath(nodeIdx)
    nodeIdx +=1
    currentLine = R.Geometry.Polyline()
    for lineNode in line.lineNodes:  # Node
        currentLine.Add(lineNode.center)
    lineTree.Add(currentLine)

# for node in nodes:
#     path = ghPath(nodeIdx)
#     nodeIdx +=1
#     for line in node.lines:
#         currentLine = R.Geometry.Polyline()
#         for lineNode in line.lineNodes:  # Node
#             currentLine.Add(lineNode.center)
#         lineTree.Add(currentLine)


        # for neigborNode in line.lineNodes:  # Node
        #     centerNeigbor = neigborNode.center
        #     myCenter = node.center
        #     myPoint = R.Geometry.Point3d(myCenter)
        #     a.append(myPoint)
        #     neighborPoint = R.Geometry.Point3d(centerNeigbor)
        #     b.append(neighborPoint)
        #     newLine = R.Geometry.Polyline() # Line
        #     newLine.Add(myPoint)
        #     newLine.Add(neighborPoint)
        #     lineTree.Add(newLine)
"""
# Unifying lines
# TO CHECK Avoid LOOPS!!!!
for node in nodes:
    for line in node.lines:
        # Take one before last node of the current line
        OneBeforeLastNodeInLine = line.lineNodes[-2]
        # Take last node of the current line it will be the FIRST NODE for the next line in the unifying process
        LastNodeInLine = line.lineNodes[-1]
        # Find azimuth of the last segment in the current line
        prevAz = calcAzimuth( OneBeforeLastNodeInLine.center, LastNodeInLine.center)
        minAz = 180
        optionalNextLines = []
        lineToUnifyWith = None  # Line
        for neighLine in LastNodeInLine.lines:
            # take next node of the neighbor line
            neighLine_SecondNode = neighLine.lineNodes[1]
            az = calcAzimuth(LastNodeInLine.center, neighLine_SecondNode.center)
            if az < thresholdAz:
                optionalNextLines.append((az, neighLine))
            if az < minAz:
                minAz = az
                lineToUnifyWith = neighLine
        if lineToUnifyWith != None:
            for lNode in lineToUnifyWith.lineNodes:
                line.AddEndNode(lNode)
            for lNode in line.lineNodes:
                print "lineToUnifyWith", lineToUnifyWith
                lineToUnifyWith.AddStartNode(lNode)
        #optionalNextLines.sort(key=itemgetter(1))
        #lineToUnifyWith = optionalNextLines[0][1]

# reorgenizing all the lines in one list
lineTree = ghTree[R.Geometry.Point3d]()
for node in nodes:                          # Node
    for line in node.lines:                 # Line
        for neigborNode in line.lineNodes:  # Node
            centerNeigborNode = neigborNode.center
            rhinoPoint = R.Geometry.Point3d(centerNeigborNode)
            lineTree.Add(rhinoPoint)
"""
# ---------- end create_nodes_data_structure ----------
pt = Point(create_nodes_data_structure.nodeTree)
len = Length(Curve=create_nodes_data_structure.lineTree)
sort = SortList(Keys=len, ValuesA=create_nodes_data_structure.lineTree)  # -> Keys, ValuesA
item_2 = ListItem(List=sort.Keys, Index="0", Wrap=True)
item_3 = ListItem(List=reverse(sort.Keys), Index="0", Wrap=True)
item_4 = ListItem(List=reverse(sort.ValuesA), Index="1", Wrap=True)

linetree = ClusterOutput(create_nodes_data_structure.lineTree)
i = ClusterOutput(item_2)
i_2 = ClusterOutput(item_3)
L = ClusterOutput(len)

# ==== cluster WideLines
num = ClusterInput()
A = ClusterInput()
C = ClusterInput()
col = ClusterInput()

norm_0_1 = Norm01(num=flatten(num))
multiplication = Multiplication(A=Slider(4, range=0..10), B=norm_0_1)
multiplication_2 = Multiplication(A=A, B=Slider(3, range=0..100))
divide = DivideCurve(Curve=C, Count=multiplication_2, Kinks=False)  # -> Points, Tangents, Parameters
circle = CircleCNR(Center=simplify(divide.Points), Normal=Vector(0, 0, 1), Radius=simplify(graft(multiplication)))
col_2 = Colour(graft(col))

col_3 = ClusterOutput(col_2)
C_2 = ClusterOutput(circle)

# ==== cluster DomColor
C = ClusterInput()
B = ClusterInput()
B_2 = ClusterInput()
mixvsdom = ClusterInput()
argb = SplitARGB(Colour=C)  # -> Alpha, Red, Green, Blue
mixvsdom_2 = Number(mixvsdom)
py_dominant_color = PythonScript(x=argb.Red, y=argb.Green)  # -> r, g; inputs x: list, y: list
# ---------- py_dominant_color: Python ----------
__author__ = "NaamaGlauber"
import math
import clr
import Rhino as R
clr.AddReference("Grasshopper")

r = []
g = []
for i in range(len(x)):
    if x[i] == y[i] and x[i] == 0:
        r.append(0)
        g.append(0)
    else:
        if x[i] >= y[i]: # RED
            r.append(1)
            g.append(0)
        else:
            r.append(0)
            g.append(1)
# ---------- end py_dominant_color ----------
multiplication = Multiplication(A=py_dominant_color.r, B=B)
multiplication_2 = Multiplication(A=py_dominant_color.g, B=B_2)
rgb = ColourRGB(Alpha=255, Red=multiplication, Green=multiplication_2, Blue=0)
subtraction = Subtraction(A="1", B=mixvsdom_2)
multiplication_3 = Multiplication(A=rgb, B="255")
multiplication_4 = Multiplication(A=C, B=subtraction)
multiplication_5 = Multiplication(A=multiplication_3, B=mixvsdom_2)
addition = Addition(A=multiplication_4, B=multiplication_5)
argb_2 = SplitARGB(Colour=addition)  # -> Alpha, Red, Green, Blue
multiplication_6 = Multiplication(A=argb_2.Red, B=B)
multiplication_7 = Multiplication(A=argb_2.Green, B=B_2)
multiplication_8 = Multiplication(A=multiplication_7, B=255)
multiplication_9 = Multiplication(A=multiplication_6, B=255)
rgb_2 = ColourRGB(Alpha=255, Red=multiplication_9, Green=multiplication_8, Blue=0)
C_2 = ClusterOutput(rgb_2)

# ==== cluster FilterBySize
G = ClusterInput()
area = Area(Geometry=G)  # -> Area, Centroid
sort = SortList(Keys=area.Area, ValuesA=G)  # -> Keys, ValuesA
item = ListItem(List=sort.Keys, Index=0, Wrap=True)
subtraction = Subtraction(A=area.Area, B=item)
subtraction_2 = Subtraction(A=sort.Keys, B=item)
B = ClusterInput()
A = ClusterInput()
rev = ReverseList(List=subtraction_2)
min = Minimum(A=A, B=B)
max = Maximum(A=A, B=B)
item_2 = ListItem(List=rev, Index=0, Wrap=True)
division = Division(A=subtraction, B=item_2)
smaller = SmallerThan(FirstNumber=division, SecondNumber=max)  # -> SmallerThan, OrEqualTo
larger = LargerThan(FirstNumber=division, SecondNumber=min)  # -> LargerThan, OrEqualTo
and = GateAnd(A=larger.OrEqualTo, B=smaller.OrEqualTo)
R = ClusterOutput(and)

# ==== cluster Mmax
K = ClusterInput()
sort = SortList(Keys=K)  # -> Keys, ValuesA
rev = ReverseList(List=sort.Keys)
item = ListItem(List=rev, Index=0, Wrap=True)
i = ClusterOutput(item)

# ==== cluster DominantSqr
C = ClusterInput()
argb = SplitARGB(Colour=C)  # -> Alpha, Red, Green, Blue
mixvsdom = ClusterInput()
subtraction = Subtraction(A=argb.Red, B=0.5)
mixvsdom_2 = Number(mixvsdom)
max = Maximum(A=subtraction, B="0")
rgb = ColourRGB(Alpha=255, Red=max, Green=0, Blue=0)
multiplication = Multiplication(A=rgb, B="255")
subtraction_2 = Subtraction(A="1", B=mixvsdom_2)
A = ClusterInput()
multiplication_2 = Multiplication(A=A, B=subtraction_2)
multiplication_3 = Multiplication(A=multiplication, B=mixvsdom_2)
addition = Addition(A=multiplication_2, B=multiplication_3)
R = ClusterOutput(addition)

# ==== cluster Norm01
num = ClusterInput()
num_2 = Number(num)
sort = SortList(Keys=num_2)  # -> Keys, ValuesA
item = ListItem(List=sort.Keys, Index=0, Wrap=True)
subtraction = Subtraction(A=num_2, B=item)
sort_2 = SortList(Keys=subtraction)  # -> Keys, ValuesA
rev = ReverseList(List=sort_2.Keys)
item_2 = ListItem(List=rev, Index=0, Wrap=True)
division = Division(A=subtraction, B=item_2)
R = ClusterOutput(division)
