# Grasshopper definition VisualizationAndSimilarities_01_07.gh (Grasshopper 1.0.4)
# plug-ins: Python Interpreter

crv = Curve([<curve referenced from the Rhino model> x79])  # disabled
lng = ListLength(List=crv)  # disabled
py_idxslist = PythonScript(len=lng)  # -> out, idxsCouplesList; disabled
# ---------- py_idxslist: Python ----------
import Rhino as R
import clr
clr.AddReference("Grasshopper")
from Grasshopper.Kernel.Data import GH_Path as ghPath
from Grasshopper import DataTree as ghTree

idxsCouplesList = ghTree[int]()
k=0
for i in range(len):
    for j in range(len):
        path = ghPath(k)
        if i != j:
            idxsCouplesList.Add(i,path)
            idxsCouplesList.Add(j,path)
            k=k+1
# ---------- end py_idxslist ----------
panel = Panel("0")  # disabled
panel_2 = Panel("1")  # disabled
item = ListItem(List=py_idxslist.idxsCouplesList, Index=panel, Wrap=True)  # disabled
item_2 = ListItem(List=py_idxslist.idxsCouplesList, Index=panel_2, Wrap=True)  # disabled
item_3 = ListItem(List=crv, Index=item, Wrap=True)  # disabled
item_4 = ListItem(List=crv, Index=item_2, Wrap=True)  # disabled
num_of_lines = Slider(23, range=0..100)  # disabled
divide = DivideCurve(Curve=item_4, Count=num_of_lines, Kinks=False)  # -> Points, Tangents, Parameters; disabled
divide_2 = DivideCurve(Curve=item_3, Count=num_of_lines, Kinks=False)  # -> Points, Tangents, Parameters; disabled
path_mapper = PathMapper(divide.Points, source="{A;B}", target="{A}")  # disabled
path_mapper_2 = PathMapper(divide_2.Points, source="{A;B}", target="{A}")  # disabled
number_slider = Slider(1000, range=0..1000)  # disabled
number_slider_2 = Slider(1000, range=0..1000)  # disabled
hull = ConvexHull(Points=path_mapper, Plane=PlaneXY(0, 0, 0))  # -> Hull, HullZ, Indices; disabled
hull_2 = ConvexHull(Points=path_mapper_2, Plane=PlaneXY(0, 0, 0))  # -> Hull, HullZ, Indices; disabled
area = Area(Geometry=hull.Hull)  # -> Area, Centroid; disabled
area_2 = Area(Geometry=hull_2.Hull)  # -> Area, Centroid; disabled
expression = Expression(x=number_slider, y=area.Area, Expression="(x/y)^(1/2)")  # disabled
expression_2 = Expression(x=number_slider_2, y=area_2.Area, Expression="(x/y)^(1/2)")  # disabled
scale = Scale(Geometry=hull.Hull, Center=area.Centroid, Factor=expression)  # -> Geometry, Transform; disabled
scale_2 = Scale(Geometry=hull_2.Hull, Center=area_2.Centroid, Factor=expression_2)  # -> Geometry, Transform; disabled
clstr_create_lines = ClstrCreateLines(C=scale.Geometry, N=num_of_lines, A=area.Centroid)  # -> simplify(L); disabled
clstr_create_lines_2 = ClstrCreateLines(C=scale_2.Geometry, N=num_of_lines, A=area_2.Centroid)  # -> simplify(L); disabled
series = Series(Start=0, Step=1, Count=num_of_lines)  # disabled
shift = ShiftList(List=clstr_create_lines, Shift=series, Wrap=True)  # disabled
len = Length(Curve=shift)  # disabled
len_2 = Length(Curve=clstr_create_lines_2)  # disabled
rev = ReverseList(List=shift)  # disabled
len_3 = Length(Curve=rev)  # disabled
expression_3 = Expression(x=len_2, y=len, Expression="abs(x-y)")  # -> simplify(R); disabled
expression_4 = Expression(x=len_2, y=len_3, Expression="abs(x-y)")  # -> simplify(R); disabled
avr = Average(Input=expression_3)  # disabled
avr_2 = Average(Input=expression_4)  # disabled
path_mapper_3 = PathMapper(avr, source="{A;B}", target="{A}")  # disabled
path_mapper_4 = PathMapper(avr_2, source="{A;B}", target="{A}")  # disabled
sort = SortList(Keys=path_mapper_3)  # -> Keys, ValuesA; disabled
sort_2 = SortList(Keys=path_mapper_4)  # -> Keys, ValuesA; disabled
item_5 = ListItem(List=sort_2.Keys, Index=0, Wrap=True)  # disabled
item_6 = ListItem(List=sort.Keys, Index=0, Wrap=True)  # disabled
min = Minimum(A=item_6, B=item_5)  # disabled
sort_3 = SortList(Keys=flatten(min))  # -> Keys, ValuesA; disabled
larger = LargerThan(FirstNumber=sort_3.Keys, SecondNumber=0)  # -> LargerThan, OrEqualTo; disabled
cull = CullPattern(List=sort_3.Keys, CullPattern=larger.LargerThan)  # disabled

crossref = CrossReference(CrossMode=1)  # -> ListA, ListB; disabled
radgrid = Radial(Plane=PlaneXY(0, 0, 0), Size=1, ExtentR=5, ExtentP=20)  # -> Cells, Points; disabled
matrix = ConstructMatrix(Rows=3, Columns=3)  # disabled
wav = WeightedAverage()  # disabled

# ---- group: find neighbors by offset of curves
number_slider_3 = Slider(3, range=0..10)  # disabled
crv_2 = Curve([<curve referenced from the Rhino model> x261])  # disabled
lng_2 = ListLength(List=crv_2)  # disabled
offset_l = OffsetLoose(Curve=crv_2, Distance=number_slider_3)  # disabled
ccx = CurveCurve(CurveA=simplify(graft(crv_2)), CurveB=offset_l)  # -> Points, ParamsA, ParamsB; disabled
py_idxslist_2 = PythonScript(len=lng_2)  # -> out, graft(idxsList); disabled
# ---------- py_idxslist_2: Python ----------
import Rhino as R
import clr
clr.AddReference("Grasshopper")
from Grasshopper.Kernel.Data import GH_Path as ghPath
from Grasshopper import DataTree as ghTree

idxsList = ghTree[int]()

for i in range(len):
    for j in range(len):
        path = ghPath(i) 
        idxsList.Add(j, path)
# ---------- end py_idxslist_2 ----------
lng_3 = ListLength(List=ccx.Points)  # disabled
dup = DuplicateData(Data=graft(crv_2), Number=lng_2, Order=True)  # -> simplify(graft(Data)); disabled
larger_2 = LargerThan(FirstNumber=lng_3, SecondNumber=0)  # -> LargerThan, OrEqualTo; disabled
cull_2 = CullPattern(List=py_idxslist_2.idxsList, CullPattern=larger_2.LargerThan)  # disabled
cull_3 = CullPattern(List=dup, CullPattern=larger_2.LargerThan)  # disabled
path_mapper_5 = PathMapper(cull_2, source="{A;B}", target="{A}")  # disabled
path_mapper_6 = PathMapper(cull_3, source="{A;B}", target="{A}")  # disabled
crv_3 = Curve(path_mapper_6)  # disabled

# ----
num = Number(path_mapper_5)  # disabled

# ---- group: find extreme points
crv_4 = Curve(crv_2)  # disabled
cpoly = ControlPolygon(Curve=graft(crv_4))  # -> Polygon, Points; disabled
redpline = Reduce(Polyline=cpoly.Polygon, Tolerance=1)  # -> Polyline, Reduction; disabled
cp = ControlPoints(Curve=redpline.Polyline)  # -> Points, Weights, Knots; disabled
cpoly_2 = ControlPolygon(Curve=redpline.Polyline)  # -> Polygon, Points; disabled
lng_4 = ListLength(List=cp.Points)  # disabled
hull_3 = ConvexHull(Points=cpoly_2.Points, Plane=PlaneXY(0, 0, 0))  # -> Hull, HullZ, Indices; disabled
cp_2 = ControlPoints(Curve=hull_3.Hull)  # -> simplify(Points), Weights, Knots; disabled
subtraction = Subtraction(A=lng_4, B=1)  # disabled
distance = Slider(1.54, range=0..2.2)  # disabled
series_2 = Series(Start=0, Step=1, Count=subtraction)  # disabled
degrees = Slider(155, range=150..180)  # disabled
item_7 = ListItem(List=cp.Points, Index=series_2, Wrap=True)  # -> simplify(Item); disabled
py_clear_polyline_pts = PythonScript(crvs=simplify(item_7), a=degrees, d=distance)  # -> flatten(out), flatten(polylines), angs; inputs crvs: tree of Point3d
# ---------- py_clear_polyline_pts: Python ----------
__author__ = "NaamaGlauber"
import math
import clr
import Rhino as R
clr.AddReference("Grasshopper")
from Grasshopper.Kernel.Data import GH_Path as ghPath
from Grasshopper import DataTree as ghTree
#import System.Collections.Generic as SCG

def find_len(a, b):
    return math.sqrt(math.pow((b[0] - a[0]), 2) + math.pow((b[1] - a[1]), 2))

angs = ghTree[float]()
polylines = ghTree[R.Geometry.Polyline]()
for formIdx in range(crvs.BranchCount):
    #print "formIdx ", formIdx
    pts = crvs.Branch(formIdx)
    crvCorners = []
    #crvCorners.append(pts[0])
    x = len(pts)
    path = ghPath(formIdx)
    for i in range(1,x+1):
        toAdd = 1
        len_a = find_len(pts[(i-1)%x], pts[i%x])
        len_b = find_len(pts[i%x], pts[(i+1)%x])
        len_c = find_len(pts[(i-1)%x], pts[(i+1)%x]) # The edge in front of the desired angle
         
        ratio = ((len_a * len_a) + (len_b * len_b) - (len_c * len_c)) / (2 * len_a * len_b)
        rad = math.acos(ratio) #math.radians(ratio)
        deg= math.degrees(rad)
        if deg > a:
            toAdd = 0
            #print "point idx", i%x
            #print "too flat", deg
        dis = find_len(pts[(i-1)%x], pts[(i)%x])
        #print "dis= ", dis
        if dis <d:
            toAdd = 0
            #print "pts[i-1] = ", pts[(i-1)%x]
            #print "pts[i] = ", pts[(i)%x]
            #print "point idx", i%x
            #print "too close", dis
            #print "toAdd", toAdd
        if toAdd == 1:
            #print "toAdd ", toAdd
            angs.Add(deg, path)
            crvCorners.append(pts[i%x])
    polylineCrv = R.Geometry.Polyline(crvCorners)
    polylines.Add(polylineCrv, path)
# ---------- end py_clear_polyline_pts ----------
cp_3 = ControlPoints(Curve=py_clear_polyline_pts.polylines)  # -> simplify(Points), Weights, Knots; disabled
# Output:
# (curvIdx; ExtremePointIdx; NeighborIdx)
# >> List of all neighbors' extreme point
py_extreme_s_neighbors = PythonScript(neighborIdxs=num, extremePoints=cp_3.Points, d=distance)  # -> out, treeExtPtsNeighbors; inputs neighborIdxs: tree of Int32, extremePoints: tree of Point3d; disabled
# ---------- py_extreme_s_neighbors: Python ----------
__author__ = "NaamaGlauber"
import math
import clr
import Rhino as R
clr.AddReference("Grasshopper")
from Grasshopper.Kernel.Data import GH_Path as ghPath
from Grasshopper import DataTree as ghTree
#import System.Collections.Generic as SCG

def find_len(a, b):
    return math.sqrt(math.pow((b[0] - a[0]), 2) + math.pow((b[1] - a[1]), 2))

treeExtPtsNeighbors = ghTree[R.Geometry.Point3d]()
for crvIdx in range(neighborIdxs.BranchCount):
    pts = extremePoints.Branch(crvIdx)
    pointCount = 0
    for exPointOrig in pts:
        neighborCount = 0
        for neighborIdx in neighborIdxs.Branch(crvIdx):
            neighborPts = extremePoints.Branch(neighborIdx)
            path = ghPath(crvIdx,pointCount,neighborCount)
            # treeExtPtsNeighbors.Add()
            for exPointNeighbor in neighborPts:
                if find_len(exPointOrig, exPointNeighbor) < d:
                    treeExtPtsNeighbors.Add(exPointNeighbor,path)
            neighborCount = neighborCount +1
        pointCount = pointCount +1
# ---------- end py_extreme_s_neighbors ----------

# ----
number_slider_4 = Slider(15, range=0..200)  # disabled
number_slider_5 = Slider(0.4463, range=0..1)  # disabled
divide_3 = DivideCurve(Curve=crv_4, Count=number_slider_4, Kinks=False)  # -> Points, Tangents, Parameters; disabled
extreme_pts = PythonScript(x=simplify(divide_3.Points), y=number_slider_5)  # -> simplify(a); inputs x: list of Point3d; disabled
# ---------- extreme_pts: Python ----------
__author__ = "AdiYehezkeli"

import rhinoscriptsyntax as rs


import math
	
def find_len(a, b):
	return math.sqrt(math.pow((b[0] - a[0]), 2) + math.pow((b[1] - a[1]), 2))

a = []

for i in range(0, len(x)):

	len_a = find_len(x[i-2], x[i-1])
	len_b = find_len(x[i-1], x[i])
	len_c = find_len(x[i-2], x[i]) # The edge in front of the desired angle

	if len_a * len_c == 0:
	    angle = math.radians(180.0)
	else:
	    angle = ((len_a * len_a) + (len_c * len_c) - (len_b * len_b)) / (2 * len_a * len_c)
	    angle = math.acos(math.radians(angle))

	if angle > 1: 
		angle = 2 - angle

	if angle < y:
		a.append(x[i - 1])
# ---------- end extreme_pts ----------

number_slider_6 = Slider(10, range=0..10)  # disabled
curve_to_compare_to = Curve()  # disabled
accuracy = Integer()  # disabled
curve_batch = Curve([<curve referenced from the Rhino model> x79])  # disabled
number_slider_7 = Slider(30, range=0..100)  # disabled
curve_to_compare_to_2 = Curve([<curve referenced from the Rhino model> x79])  # disabled
curve_batch_2 = Curve()  # disabled
accuracy_2 = Integer(number_slider_6)  # disabled
divide_4 = DivideCurve(Curve=curve_batch, Count=number_slider_7, Kinks=False)  # -> Points, Tangents, Parameters; disabled
divide_5 = DivideCurve(Curve=curve_to_compare_to_2, Count=number_slider_7, Kinks=False)  # -> Points, Tangents, Parameters; disabled
hull_4 = ConvexHull(Points=divide_5.Points, Plane=PlaneXY(0, 0, 0))  # -> Hull, HullZ, Indices; disabled
hull_5 = ConvexHull(Points=divide_4.Points, Plane=PlaneXY(0, 0, 0))  # -> Hull, HullZ, Indices; disabled
area_3 = Area(Geometry=hull_5.Hull)  # -> Area, Centroid; disabled
area_4 = Area(Geometry=hull_4.Hull)  # -> Area, Centroid; disabled
divide_6 = DivideCurve(Curve=hull_4.Hull, Count=accuracy_2, Kinks=False)  # -> Points, Tangents, Parameters; disabled
divide_7 = DivideCurve(Curve=hull_5.Hull, Count=accuracy_2, Kinks=False)  # -> Points, Tangents, Parameters; disabled
ln = Line(StartPoint=area_3.Centroid, EndPoint=divide_7.Points)  # disabled
ln_2 = Line(StartPoint=area_4.Centroid, EndPoint=divide_6.Points)  # disabled
path_mapper_7 = PathMapper(ln, source="{A;B;C}", target="{B}")  # disabled
path_mapper_8 = PathMapper(ln_2, source="{A;B;C}", target="{B}")  # disabled
lng_5 = ListLength(List=curve_to_compare_to_2)  # disabled
len_4 = Length(Curve=path_mapper_8)  # disabled
len_5 = Length(Curve=path_mapper_7)  # disabled
flip = FlipMatrix(Data=len_4)  # disabled
python = PythonScript(x=len_5, y=flip, divideNum=accuracy_2)  # -> out, a; inputs x: tree, y: tree; disabled
# ---------- python: Python ----------
__author__ = "NaamaGlauber"
import math
import clr
clr.AddReference("Grasshopper")
from Grasshopper.Kernel.Data import GH_Path as ghPath
from Grasshopper import DataTree as ghTree

a = ghTree[float]()
for i in range(x.BranchCount):
    Xvals = x.Branch(i)
    for j in range(y.BranchCount):
        Yvals = y.Branch(j)
        for k in range(divideNum):
            path = ghPath(i,j)
            diff = abs(Xvals[k] - Yvals[k])
            a.Add(diff, path)
# ---------- end python ----------
avr_3 = Average(Input=python.a)  # disabled
panel_3 = Panel(avr_3)  # disabled

toggle = BooleanToggle(True)  # disabled
pline = PolyLine(Vertices=cp_3.Points, Closed=toggle)  # disabled
lng_6 = ListLength(List=py_extreme_s_neighbors.treeExtPtsNeighbors)  # disabled
path_mapper_9 = PathMapper(lng_6, source="{A;B;C}", target="{A;B}")  # disabled
# Extreme points in the same area..
# TODO: How to be sure I'll have a full tree,
# even in the case the neighbors are not close..
lng_7 = ListLength(List=path_mapper_9)  # -> flatten(Length); disabled
crv_5 = Curve([<curve referenced from the Rhino model> x261])
divide_8 = DivideCurve(Curve=crv_5, Count=10, Kinks=False)  # -> Points, Tangents, Parameters; disabled
cpoly_3 = ControlPolygon(Curve=graft(crv_5))  # -> Polygon, Points

# ---- group: Imagination to external form
crv_6 = Curve([<curve referenced from the Rhino model> x261])
how_many_to_select = Slider(10, range=0..10)
colour = ColourPicker(PickedColour=RGB(2, 52, 153))
crv_7 = Curve(<curve referenced from the Rhino model>)
boundary = BoundarySurfaces(Edges=crv_7)
colour_2 = ColourPicker(PickedColour=RGB(51, 102, 204))
accuracy_3 = Panel("20")
cluster = Cluster(curve_batch=crv_6, accuracy=accuracy_3, curve_to_compare_to=boundary, how_many_to_select=how_many_to_select)  # -> best_fits, remeinder
boundary_2 = BoundarySurfaces(Edges=cluster.best_fits)
preview = CustomPreview(Geometry=boundary_2, Shader=colour)
cluster_2 = Cluster(curve_batch=cluster.remeinder, accuracy=accuracy_3, curve_to_compare_to=boundary, how_many_to_select=how_many_to_select)  # -> best_fits, remeinder
boundary_3 = BoundarySurfaces(Edges=cluster_2.best_fits)
preview_2 = CustomPreview(Geometry=boundary_3, Shader=colour_2)
cluster_3 = Cluster(
    curve_batch=cluster_2.remeinder,
    accuracy=accuracy_3,
    curve_to_compare_to=boundary,
    how_many_to_select=how_many_to_select)  # -> best_fits, remeinder
boundary_4 = BoundarySurfaces(Edges=cluster_3.best_fits)
colour_3 = ColourPicker(PickedColour=RGB(122, 165, 250))
preview_3 = CustomPreview(Geometry=boundary_4, Shader=colour_3)
cluster_4 = Cluster(
    curve_batch=cluster_3.remeinder,
    accuracy=accuracy_3,
    curve_to_compare_to=boundary,
    how_many_to_select=how_many_to_select)  # -> best_fits, remeinder
boundary_5 = BoundarySurfaces(Edges=cluster_4.best_fits)
colour_4 = ColourPicker(PickedColour=RGB(178, 204, 255))
preview_4 = CustomPreview(Geometry=boundary_5, Shader=colour_4)
cluster_5 = Cluster(
    curve_batch=cluster_4.remeinder,
    accuracy=accuracy_3,
    curve_to_compare_to=boundary,
    how_many_to_select=how_many_to_select)  # -> best_fits, remeinder
boundary_6 = BoundarySurfaces(Edges=cluster_5.best_fits)
colour_5 = ColourPicker(PickedColour=RGB(230, 238, 255))
preview_5 = CustomPreview(Geometry=boundary_6, Shader=colour_5)

# ---- group: Grid
number_slider_8 = Slider(12, range=5..50)  # disabled
line = Line(Line((-202.9261612, -160.1611111, 0), (-202.9261612, 456.6830836, 0)))  # disabled
line_2 = Line(Line((-202.9261612, -160.1611111, 0), (413.8083332, -160.1611111, 0)))  # disabled
len_6 = Length(Curve=line)  # disabled
pt = Point(<point referenced from the Rhino model>)  # disabled
division = Division(A=len_6, B=number_slider_8)  # disabled
xy = XYPlane(Origin=pt)  # disabled
sqgrid = Square(Plane=xy, Size=division, ExtentX=number_slider_8, ExtentY=number_slider_8)  # -> simplify(Cells), simplify(Points); disabled
crv_8 = Curve(sqgrid.Cells)  # disabled

# ---- group: find neighbors by offset of curves
number_slider_9 = Slider(3, range=0..10)  # disabled
crv_9 = Curve([<curve referenced from the Rhino model> x261])  # disabled
lng_8 = ListLength(List=crv_9)  # disabled
offset_l_2 = OffsetLoose(Curve=crv_9, Distance=number_slider_9)  # disabled
ccx_2 = CurveCurve(CurveA=simplify(graft(crv_9)), CurveB=offset_l_2)  # -> Points, ParamsA, ParamsB; disabled
py_idxslist_3 = PythonScript(len=lng_8)  # -> out, graft(idxsList); disabled; same code as py_idxslist_2
lng_9 = ListLength(List=ccx_2.Points)  # disabled
dup_2 = DuplicateData(Data=graft(crv_9), Number=lng_8, Order=True)  # -> simplify(graft(Data)); disabled
larger_3 = LargerThan(FirstNumber=lng_9, SecondNumber=0)  # -> LargerThan, OrEqualTo; disabled
cull_4 = CullPattern(List=py_idxslist_3.idxsList, CullPattern=larger_3.LargerThan)  # disabled
cull_5 = CullPattern(List=dup_2, CullPattern=larger_3.LargerThan)  # disabled
path_mapper_10 = PathMapper(cull_4, source="{A;B}", target="{A}")  # disabled
path_mapper_11 = PathMapper(cull_5, source="{A;B}", target="{A}")  # disabled
crv_10 = Curve(path_mapper_11)  # disabled

# ---- group: Imagination to other form's size
crv_11 = Curve([<curve referenced from the Rhino model> x261])
lng_10 = ListLength(List=crv_11)
division_2 = Division(A=lng_10, B=Slider(5, range=0..10))
how_many_to_select_2 = Slider(10, range=0..10)
colour_6 = ColourPicker(PickedColour=RGB(2, 52, 153))
crv_12 = Curve(<curve referenced from the Rhino model>)
item_8 = ListItem(List=crv_11, Index=Slider(59, range=0..642), Wrap=True)
boundary_7 = BoundarySurfaces(Edges=crv_12)
compare_areas = CompareAreas(curve_batch=crv_11, how_many_to_select=how_many_to_select_2, curve_to_compare_to=boundary_7)  # -> best_fits, remeinder
boundary_8 = BoundarySurfaces(Edges=compare_areas.best_fits)
preview_6 = CustomPreview(Geometry=boundary_8, Shader=colour_6)
compare_areas_2 = CompareAreas(curve_batch=compare_areas.remeinder, how_many_to_select=how_many_to_select_2, curve_to_compare_to=boundary_7)  # -> best_fits, remeinder
boundary_9 = BoundarySurfaces(Edges=compare_areas_2.best_fits)
colour_7 = ColourPicker(PickedColour=RGB(51, 102, 204))
preview_7 = CustomPreview(Geometry=boundary_9, Shader=colour_7)
compare_areas_3 = CompareAreas(curve_batch=compare_areas_2.remeinder, how_many_to_select=how_many_to_select_2, curve_to_compare_to=boundary_7)  # -> best_fits, remeinder
boundary_10 = BoundarySurfaces(Edges=compare_areas_3.best_fits)
colour_8 = ColourPicker(PickedColour=RGB(122, 165, 250))
preview_8 = CustomPreview(Geometry=boundary_10, Shader=colour_8)
compare_areas_4 = CompareAreas(curve_batch=compare_areas_3.remeinder, how_many_to_select=how_many_to_select_2, curve_to_compare_to=boundary_7)  # -> best_fits, remeinder
boundary_11 = BoundarySurfaces(Edges=compare_areas_4.best_fits)
colour_9 = ColourPicker(PickedColour=RGB(178, 204, 255))
preview_9 = CustomPreview(Geometry=boundary_11, Shader=colour_9)
compare_areas_5 = CompareAreas(curve_batch=compare_areas_4.remeinder, how_many_to_select=how_many_to_select_2, curve_to_compare_to=boundary_7)  # -> best_fits, remeinder
boundary_12 = BoundarySurfaces(Edges=compare_areas_5.best_fits)
colour_10 = ColourPicker(PickedColour=RGB(230, 238, 255))
preview_10 = CustomPreview(Geometry=boundary_12, Shader=colour_10)

# ----
number_slider_10 = Slider(100, range=99..100)  # disabled
hull_6 = ConvexHull(Points=divide_8.Points, Plane=PlaneXY(0, 0, 0))  # -> Hull, HullZ, Indices; disabled
redpline_2 = Reduce(Polyline=cpoly_3.Polygon, Tolerance=1)  # -> Polyline, Reduction

mintresh = Slider(55, range=0..100)  # disabled
mintresh_2 = Slider(138, range=100..300)  # disabled
crv_13 = Curve([<curve referenced from the Rhino model> x3286])  # disabled
number_slider_11 = Slider(59, range=0..642)  # disabled
number_slider_12 = Slider(5, range=0..10)  # disabled
number_slider_13 = Slider(5, range=0..10)  # disabled
number_slider_14 = Slider(59, range=0..642)  # disabled
number_slider_15 = Slider(5, range=0..10)  # disabled
number_slider_16 = Slider(59, range=0..642)  # disabled
area_5 = Area(Geometry=crv_13)  # -> Area, Centroid; disabled
crv_14 = Curve([<curve referenced from the Rhino model> x3286])
smaller = SmallerThan(FirstNumber=area_5.Area, SecondNumber=mintresh_2)  # -> SmallerThan, OrEqualTo; disabled
larger_4 = LargerThan(FirstNumber=area_5.Area, SecondNumber=mintresh)  # -> LargerThan, OrEqualTo; disabled
larger_5 = LargerThan(FirstNumber=area_5.Area, SecondNumber=mintresh_2)  # -> LargerThan, OrEqualTo; disabled
lng_11 = ListLength(List=crv_14)
and = GateAnd(A=larger_4.OrEqualTo, B=smaller.SmallerThan)  # disabled
smaller_2 = SmallerThan(FirstNumber=area_5.Area, SecondNumber=mintresh)  # -> SmallerThan, OrEqualTo; disabled
area_6 = Area(Geometry=crv_14)  # -> Area, Centroid
subtraction_2 = Subtraction(A=lng_11, B=1)
cull_6 = CullPattern(List=crv_13, CullPattern=smaller_2.SmallerThan)  # disabled
crv_15 = Curve(cull_6)  # disabled
crv_16 = Curve(crv_15)  # disabled
lng_12 = ListLength(List=crv_16)  # disabled
division_3 = Division(A=lng_12, B=number_slider_15)  # disabled
cull_7 = CullPattern(List=crv_13, CullPattern=and)  # disabled
crv_17 = Curve(cull_7)  # disabled
crv_18 = Curve(crv_17)  # disabled
lng_13 = ListLength(List=crv_18)  # disabled
division_4 = Division(A=lng_13, B=number_slider_13)  # disabled
cull_8 = CullPattern(List=crv_13, CullPattern=larger_5.OrEqualTo)  # disabled
crv_19 = Curve(cull_8)  # disabled
crv_20 = Curve(crv_19)  # disabled
lng_14 = ListLength(List=crv_20)  # disabled
division_5 = Division(A=lng_14, B=number_slider_12)  # disabled
sort_4 = SortList(Keys=area_6.Area, ValuesA=crv_14)  # -> Keys, ValuesA
item_9 = ListItem(List=sort_4.Keys, Index=0, Wrap=True)
item_10 = ListItem(List=sort_4.Keys, Index=subtraction_2, Wrap=True)
gradient = Gradient(LowerLimit=item_9, UpperLimit=item_10, Parameter=sort_4.Keys, stops=[0: RGB(255, 255, 255), 0.553: RGB(0, 0, 0)])
boundary_13 = BoundarySurfaces(Edges=sort_4.ValuesA)
colour_11 = ColourPicker(PickedColour=RGB(0, 89, 128))  # disabled
colour_12 = ColourPicker(PickedColour=RGB(51, 128, 0))  # disabled
colour_13 = ColourPicker(PickedColour=RGBA(70, 0, 128, 180))  # disabled
crv_21 = Curve(<curve referenced from the Rhino model>)  # disabled
item_11 = ListItem(List=crv_20, Index=number_slider_11, Wrap=True)  # disabled
preview_11 = CustomPreview(Geometry=boundary_13, Shader=gradient)
boundary_14 = BoundarySurfaces(Edges=crv_21)  # disabled
colour_14 = ColourPicker(PickedColour=RGB(178, 255, 0))  # disabled
preview_12 = CustomPreview(Geometry=cull_7, Shader=colour_14)  # disabled
colour_15 = ColourPicker(PickedColour=RGB(0, 42, 255))  # disabled
preview_13 = CustomPreview(Geometry=cull_8, Shader=colour_15)  # disabled
colour_16 = ColourPicker(PickedColour=RGB(255, 0, 170))  # disabled
preview_14 = CustomPreview(Geometry=cull_6, Shader=colour_16)  # disabled
colour_17 = ColourPicker(PickedColour=RGB(0, 125, 178))  # disabled
colour_18 = ColourPicker(PickedColour=RGB(71, 178, 0))  # disabled
colour_19 = ColourPicker(PickedColour=RGBA(98, 0, 178, 180))  # disabled
accuracy_4 = Panel("20")  # disabled
cluster_6 = Cluster(curve_batch=crv_20, accuracy=accuracy_4, curve_to_compare_to=boundary_14, how_many_to_select=division_5)  # -> best_fits, remeinder; disabled
cluster_7 = Cluster(curve_batch=crv_18, accuracy=accuracy_4, curve_to_compare_to=boundary_14, how_many_to_select=division_4)  # -> best_fits, remeinder; disabled
cluster_8 = Cluster(curve_batch=crv_16, accuracy=accuracy_4, curve_to_compare_to=boundary_14, how_many_to_select=division_3)  # -> best_fits, remeinder; disabled
boundary_15 = BoundarySurfaces(Edges=cluster_7.best_fits)  # disabled
boundary_16 = BoundarySurfaces(Edges=cluster_6.best_fits)  # disabled
boundary_17 = BoundarySurfaces(Edges=cluster_8.best_fits)  # disabled
preview_15 = CustomPreview(Geometry=boundary_15, Shader=colour_11)  # disabled
preview_16 = CustomPreview(Geometry=boundary_16, Shader=colour_12)  # disabled
preview_17 = CustomPreview(Geometry=boundary_17, Shader=colour_13)  # disabled
cluster_9 = Cluster(curve_batch=cluster_6.remeinder, accuracy=accuracy_4, curve_to_compare_to=boundary_14, how_many_to_select=division_5)  # -> best_fits, remeinder; disabled
cluster_10 = Cluster(curve_batch=cluster_7.remeinder, accuracy=accuracy_4, curve_to_compare_to=boundary_14, how_many_to_select=division_4)  # -> best_fits, remeinder; disabled
cluster_11 = Cluster(curve_batch=cluster_8.remeinder, accuracy=accuracy_4, curve_to_compare_to=boundary_14, how_many_to_select=division_3)  # -> best_fits, remeinder; disabled
boundary_18 = BoundarySurfaces(Edges=cluster_10.best_fits)  # disabled
boundary_19 = BoundarySurfaces(Edges=cluster_9.best_fits)  # disabled
boundary_20 = BoundarySurfaces(Edges=cluster_11.best_fits)  # disabled
preview_18 = CustomPreview(Geometry=boundary_18, Shader=colour_17)  # disabled
preview_19 = CustomPreview(Geometry=boundary_19, Shader=colour_18)  # disabled
preview_20 = CustomPreview(Geometry=boundary_20, Shader=colour_19)  # disabled
cluster_12 = Cluster(curve_batch=cluster_9.remeinder, accuracy=accuracy_4, curve_to_compare_to=boundary_14, how_many_to_select=division_5)  # -> best_fits, remeinder; disabled
cluster_13 = Cluster(curve_batch=cluster_10.remeinder, accuracy=accuracy_4, curve_to_compare_to=boundary_14, how_many_to_select=division_4)  # -> best_fits, remeinder; disabled
cluster_14 = Cluster(curve_batch=cluster_11.remeinder, accuracy=accuracy_4, curve_to_compare_to=boundary_14, how_many_to_select=division_3)  # -> best_fits, remeinder; disabled
boundary_21 = BoundarySurfaces(Edges=cluster_12.best_fits)  # disabled
boundary_22 = BoundarySurfaces(Edges=cluster_13.best_fits)  # disabled
boundary_23 = BoundarySurfaces(Edges=cluster_14.best_fits)  # disabled
colour_20 = ColourPicker(PickedColour=RGB(41, 155, 204))  # disabled
preview_21 = CustomPreview(Geometry=boundary_22, Shader=colour_20)  # disabled
colour_21 = ColourPicker(PickedColour=RGB(106, 204, 41))  # disabled
preview_22 = CustomPreview(Geometry=boundary_21, Shader=colour_21)  # disabled
colour_22 = ColourPicker(PickedColour=RGB(131, 41, 204))  # disabled
preview_23 = CustomPreview(Geometry=boundary_23, Shader=colour_22)  # disabled
cluster_15 = Cluster(curve_batch=cluster_12.remeinder, accuracy=accuracy_4, curve_to_compare_to=boundary_14, how_many_to_select=division_5)  # -> best_fits, remeinder; disabled
cluster_16 = Cluster(curve_batch=cluster_13.remeinder, accuracy=accuracy_4, curve_to_compare_to=boundary_14, how_many_to_select=division_4)  # -> best_fits, remeinder; disabled
cluster_17 = Cluster(curve_batch=cluster_14.remeinder, accuracy=accuracy_4, curve_to_compare_to=boundary_14, how_many_to_select=division_3)  # -> best_fits, remeinder; disabled
boundary_24 = BoundarySurfaces(Edges=cluster_15.best_fits)  # disabled
boundary_25 = BoundarySurfaces(Edges=cluster_16.best_fits)  # disabled
boundary_26 = BoundarySurfaces(Edges=cluster_17.best_fits)  # disabled
colour_23 = ColourPicker(PickedColour=RGB(69, 181, 230))  # disabled
preview_24 = CustomPreview(Geometry=boundary_25, Shader=colour_23)  # disabled
colour_24 = ColourPicker(PickedColour=RGB(133, 230, 69))  # disabled
preview_25 = CustomPreview(Geometry=boundary_24, Shader=colour_24)  # disabled
colour_25 = ColourPicker(PickedColour=RGB(157, 69, 230))  # disabled
preview_26 = CustomPreview(Geometry=boundary_26, Shader=colour_25)  # disabled
cluster_18 = Cluster(curve_batch=cluster_15.remeinder, accuracy=accuracy_4, curve_to_compare_to=boundary_14, how_many_to_select=division_5)  # -> best_fits, remeinder; disabled
cluster_19 = Cluster(curve_batch=cluster_16.remeinder, accuracy=accuracy_4, curve_to_compare_to=boundary_14, how_many_to_select=division_4)  # -> best_fits, remeinder; disabled
cluster_20 = Cluster(curve_batch=cluster_17.remeinder, accuracy=accuracy_4, curve_to_compare_to=boundary_14, how_many_to_select=division_3)  # -> best_fits, remeinder; disabled
boundary_27 = BoundarySurfaces(Edges=cluster_18.best_fits)  # disabled
boundary_28 = BoundarySurfaces(Edges=cluster_19.best_fits)  # disabled
boundary_29 = BoundarySurfaces(Edges=cluster_20.best_fits)  # disabled
colour_26 = ColourPicker(PickedColour=RGB(128, 217, 255))  # disabled
preview_27 = CustomPreview(Geometry=boundary_28, Shader=colour_26)  # disabled
colour_27 = ColourPicker(PickedColour=RGB(178, 255, 128))  # disabled
preview_28 = CustomPreview(Geometry=boundary_27, Shader=colour_27)  # disabled
colour_28 = ColourPicker(PickedColour=RGB(198, 128, 255))  # disabled
preview_29 = CustomPreview(Geometry=boundary_29, Shader=colour_28)  # disabled

# ---- group: Finds the 50 most squared faces
unitize = BooleanToggle(False)
accuracy_5 = Panel("100")
range = Range(Domain="PI/2", Steps=accuracy_5)
xy_2 = XYPlane(Origin=Point(0, 0, 0))
geo = Geometry([<curve referenced from the Rhino model> x261])
prot = RotatePlane(Plane=xy_2, Angle=range)
bbox = BoundingBox(Content=geo, Plane=graft(prot))  # -> Box, Box_2
flip_2 = FlipMatrix(Data=bbox.Box)
area_7 = Area(Geometry=flip_2)  # -> Area, Centroid
sort_5 = SortList(Keys=area_7.Area, ValuesA=flip_2)  # -> Keys, ValuesA
item_12 = ListItem(List=sort_5.ValuesA, Index=0, Wrap=True)
minimum_2d_bounding_box = Surface(item_12)
area_8 = Area(Geometry=minimum_2d_bounding_box)  # -> flatten(Area), Centroid
area_9 = Area(Geometry=geo)  # -> flatten(Area), Centroid
division_6 = Division(A=area_9.Area, B=area_8.Area)

# ----
accuracy_6 = Integer()
curve_batch_3 = Curve([<curve referenced from the Rhino model> x29])
curve_to_compare_to_3 = Curve(<curve referenced from the Rhino model>)
divide_9 = DivideCurve(Curve=curve_batch_3, Count=accuracy_6, Kinks=False)  # -> Points, Tangents, Parameters
divide_10 = DivideCurve(Curve=curve_to_compare_to_3, Count=accuracy_6, Kinks=False)  # -> Points, Tangents, Parameters
hull_7 = ConvexHull(Points=flatten(divide_10.Points), Plane=PlaneXY(0, 0, 0))  # -> Hull, HullZ, Indices
hull_8 = ConvexHull(Points=divide_9.Points, Plane=PlaneXY(0, 0, 0))  # -> Hull, HullZ, Indices
number_slider_17 = Slider(100, range=99..100)
area_10 = Area(Geometry=hull_8.Hull)  # -> Area, Centroid
area_11 = Area(Geometry=hull_7.Hull)  # -> Area, Centroid
expression_5 = Expression(x=number_slider_17, y=area_10.Area, Expression="(x/y)^(1/2)")
expression_6 = Expression(x=number_slider_17, y=area_11.Area, Expression="(x/y)^(1/2)")
number_slider_18 = Slider(50, range=0..100)
scale_3 = Scale(Geometry=hull_7.Hull, Center=area_11.Centroid, Factor=expression_6)  # -> Geometry, Transform
scale_4 = Scale(Geometry=hull_8.Hull, Center=area_10.Centroid, Factor=expression_5)  # -> Geometry, Transform
divide_11 = DivideCurve(Curve=scale_4.Geometry, Count=number_slider_18, Kinks=False)  # -> Points, Tangents, Parameters
divide_12 = DivideCurve(Curve=scale_3.Geometry, Count=number_slider_18, Kinks=False)  # -> Points, Tangents, Parameters
ln_3 = Line(StartPoint=area_10.Centroid, EndPoint=divide_11.Points)
ln_4 = Line(StartPoint=area_11.Centroid, EndPoint=divide_12.Points)
len_7 = Length(Curve=ln_3)
len_8 = Length(Curve=ln_4)
cluster_21 = Cluster(
    curve_batch=[<geometry referenced from the Rhino model> x29],
    curve_to_compare_to=<geometry referenced from the Rhino model>)  # -> best_fits, remeinder
sort_6 = SortList(Keys=len_7, ValuesA=ln_3)  # -> Keys, ValuesA
sort_7 = SortList(Keys=len_8, ValuesA=ln_4)  # -> Keys, ValuesA
rev_2 = ReverseList(List=sort_6.ValuesA)
rev_3 = ReverseList(List=sort_7.ValuesA)
item_13 = ListItem(List=rev_2, Index=0, Wrap=True)
item_14 = ListItem(List=rev_3, Index=0, Wrap=True)
line_3 = Line(item_13)
line_4 = Line(item_14)
index = ItemIndex(List=ln_3, Item=line_3)
index_2 = ItemIndex(List=ln_4, Item=line_4)
shift_2 = ShiftList(List=ln_3, Shift=index, Wrap=True)
shift_3 = ShiftList(List=ln_4, Shift=index_2, Wrap=True)
rev_4 = ReverseList(List=shift_3)
len_9 = Length(Curve=shift_2)
len_10 = Length(Curve=shift_3)
len_11 = Length(Curve=rev_4)
expression_7 = Expression(x=len_9, y=len_10, Expression="abs(x-y)")
expression_8 = Expression(x=len_9, y=len_11, Expression="abs(x-y)")
ma = MassAddition(Input=expression_7)  # -> Result, PartialResults
ma_2 = MassAddition(Input=expression_8)  # -> Result, PartialResults
min_2 = Minimum(A=ma.Result, B=ma_2.Result)  # -> flatten(Result)
crv_22 = Curve(curve_batch_3)
sort_8 = SortList(Keys=min_2, ValuesA=crv_22)  # -> Keys, ValuesA
panel_4 = Panel(sort_8.Keys)
split = SplitList(List=sort_8.ValuesA)  # -> BestFits, Remeinder

area_12 = Area(Geometry=hull_6.Hull)  # -> Area, Centroid; disabled
cp_4 = ControlPoints(Curve=redpline_2.Polyline)  # -> Points, Weights, Knots
lng_15 = ListLength(List=cp_4.Points)
expression_9 = Expression(x=number_slider_10, y=area_12.Area, Expression="(x/y)^(1/2)")  # disabled
number_slider_19 = Slider(50, range=0..100)  # disabled
subtraction_3 = Subtraction(A=lng_15, B=1)
scale_5 = Scale(Geometry=hull_6.Hull, Center=area_12.Centroid, Factor=expression_9)  # -> Geometry, Transform; disabled
series_3 = Series(Start=0, Step=1, Count=subtraction_3)
distance_2 = Slider(1.54, range=0..2.2)
degrees_2 = Slider(155, range=150..180)
divide_13 = DivideCurve(Curve=scale_5.Geometry, Count=number_slider_19, Kinks=False)  # -> Points, Tangents, Parameters; disabled
item_15 = ListItem(List=cp_4.Points, Index=series_3, Wrap=True)  # -> simplify(Item)
ln_5 = Line(StartPoint=area_12.Centroid, EndPoint=divide_13.Points)  # -> simplify(Line); disabled
clx = CurveLine(Curve=graft(crv_5), Line=ln_5)  # -> simplify(Points), Params, Count; disabled
py_clear_polyline_pts_2 = PythonScript(crvs=simplify(item_15), a=degrees_2, d=distance_2)  # -> flatten(out), flatten(polylines), angs; inputs crvs: tree of Point3d; same code as py_clear_polyline_pts
item_16 = ListItem(List=clx.Points, Index=0, Wrap=True)  # disabled
item_17 = ListItem(List=clx.Points, Index=1, Wrap=True)  # disabled
py_clear_polyline_pts_3 = PythonScript(crvs=simplify(item_15), a=degrees_2, d=distance_2)  # -> flatten(out), flatten(polylines), angs; inputs crvs: tree of Point3d
# ---------- py_clear_polyline_pts_3: Python ----------
__author__ = "NaamaGlauber"
import math
import clr
import Rhino as R
clr.AddReference("Grasshopper")
from Grasshopper.Kernel.Data import GH_Path as ghPath
from Grasshopper import DataTree as ghTree
#import System.Collections.Generic as SCG

def find_len(a, b):
    return math.sqrt(math.pow((b[0] - a[0]), 2) + math.pow((b[1] - a[1]), 2))

angs = ghTree[float]()
polylines = ghTree[R.Geometry.Polyline]()


for formIdx in range(crvs.BranchCount):
    #print "formIdx ", formIdx
    pts = crvs.Branch(formIdx)
    crvCorners = []
    #crvCorners.append(pts[0])
    x = len(pts)
    path = ghPath(formIdx)
    for i in range(1,x+1):
        crvCorners.append(pts[i%x])
    polylineCrv = R.Geometry.Polyline(crvCorners)
    polylines.Add(polylineCrv, path)

    while x > 3:
        min_len = find_len(pts[0%x], pts[1%x])
        remove_location = 0
        # to_remove_1 = pts[0%x]
        # to_remove_2 = pts[1%x]
        for i in range(0,x-1):
            len_a = find_len(pts[i%x], pts[(i+1)%x])
            if len_a < min_len:
                min_len = len_a
                remove_location = i
        x=x-1

        to_remove_1 = crvCorners[(remove_location)%x]
        to_remove_2 = crvCorners[(remove_location + 1)%x]

        mid = {(to_remove_1[0] + to_remove_2[0]) / 2, (to_remove_1[1] + to_remove_2[1]) / 2}

        crvCorners.remove(to_remove_1)
        crvCorners.remove(to_remove_2)
        # crvCorners.insert(remove_location, mid)
        # x = len(crvCorners)
# ---------- end py_clear_polyline_pts_3 ----------
num_2 = Number(path_mapper_10)  # disabled
cp_5 = ControlPoints(Curve=py_clear_polyline_pts_2.polylines)  # -> simplify(Points), Weights, Knots
dist = Distance(PointA=item_16, PointB=item_17)  # disabled
path_mapper_12 = PathMapper(minimum_2d_bounding_box, source="{A;B;C;D}", target="{C}")

# ---- group: find extreme points
# To change this ^ Python implementation:
# 1. Check about around 180 deg angle (V)
# 2. Parameter for "close" extreme points in the same curve (V)
#      a. check that curve has are at least three points (TODO)
#      b. find the middle point (TODO)
crv_23 = Curve(crv_9)  # disabled
cpoly_4 = ControlPolygon(Curve=graft(crv_23))  # -> Polygon, Points; disabled
redpline_3 = Reduce(Polyline=cpoly_4.Polygon, Tolerance=1)  # -> Polyline, Reduction; disabled
cp_6 = ControlPoints(Curve=redpline_3.Polyline)  # -> Points, Weights, Knots; disabled
cpoly_5 = ControlPolygon(Curve=redpline_3.Polyline)  # -> Polygon, Points; disabled
lng_16 = ListLength(List=cp_6.Points)  # disabled
hull_9 = ConvexHull(Points=cpoly_5.Points, Plane=PlaneXY(0, 0, 0))  # -> Hull, HullZ, Indices; disabled
cp_7 = ControlPoints(Curve=hull_9.Hull)  # -> simplify(Points), Weights, Knots; disabled
subtraction_4 = Subtraction(A=lng_16, B=1)  # disabled
distance_3 = Slider(1.54, range=0..2.2)  # disabled
series_4 = Series(Start=0, Step=1, Count=subtraction_4)  # disabled
degrees_3 = Slider(155, range=150..180)  # disabled
item_18 = ListItem(List=cp_6.Points, Index=series_4, Wrap=True)  # -> simplify(Item); disabled
py_clear_polyline_pts_4 = PythonScript(crvs=simplify(item_18), a=degrees_3, d=distance_3)  # -> flatten(out), flatten(polylines), angs; inputs crvs: tree of Point3d; disabled; same code as py_clear_polyline_pts
cp_8 = ControlPoints(Curve=py_clear_polyline_pts_4.polylines)  # -> simplify(Points), Weights, Knots; disabled
# Output:
# (curvIdx; ExtremePointIdx; NeighborIdx)
# >> List of all neighbors' extreme point
py_extreme_s_neighbors_2 = PythonScript(neighborIdxs=num_2, extremePoints=cp_8.Points, d=distance_3)  # -> out, treeExtPtsNeighbors; inputs neighborIdxs: tree of Int32, extremePoints: tree of Point3d; disabled; same code as py_extreme_s_neighbors

# ---- group: Test
line_5 = Line(Line((517.364253, 190.7050838, 0), (516.3611857, 189.1574858, 0)))  # disabled
line_6 = Line(Line((516.3611857, 189.1574858, 0), (519.4592362, 173.5682142, 0)))  # disabled
angle = Angle(VectorA=line_5, VectorB=line_6)  # -> Angle, Reflex; disabled
multiplication = Multiplication(A=angle.Angle, B=180)  # disabled
pi = Pi(Factor=1)  # disabled
division_7 = Division(A=multiplication, B=pi)  # disabled
subtraction_5 = Subtraction(A=180, B=division_7)  # disabled
number_slider_20 = Slider(0, range=0..180)  # disabled
flip_3 = FlipMatrix(Data=item_18)  # disabled
item_19 = ListItem(List=flip_3, Index=number_slider_20, Wrap=True)  # -> flatten(Item); disabled
pline_2 = PolyLine(Vertices=item_19, Closed=False)  # disabled
number_slider_21 = Slider(0, range=0..6)  # disabled
cp_9 = ControlPoints(Curve=pline_2)  # -> Points, Weights, Knots; disabled
item_20 = ListItem(List=cp_9.Points, Index=number_slider_21, Wrap=True)  # disabled

# ---- group: Sharpest edge
avr_4 = Average(Input=py_clear_polyline_pts_4.angs)  # disabled
crv_24 = Curve(crv_23)  # disabled
sort_9 = SortList(Keys=py_clear_polyline_pts_4.angs)  # -> Keys, ValuesA; disabled
item_21 = ListItem(List=sort_9.Keys, Index=0, Wrap=True)  # -> flatten(Item); disabled
sort_10 = SortList(Keys=item_21, ValuesA=crv_24)  # -> Keys, ValuesA; disabled
lng_17 = ListLength(List=sort_10.Keys)  # disabled
subtraction_6 = Subtraction(A=lng_17, B=1)  # disabled
boundary_30 = BoundarySurfaces(Edges=sort_10.ValuesA)  # disabled
item_22 = ListItem(List=sort_10.Keys, Index=0, Wrap=True)  # disabled
item_23 = ListItem(List=sort_10.Keys, Index=subtraction_6, Wrap=True)  # disabled
gradient_2 = Gradient(
    LowerLimit=item_22,
    UpperLimit=item_23,
    Parameter=sort_10.Keys,
    stops=[0: RGB(0, 98, 0), 0.34: RGB(159, 198, 146), 0.525: RGB(81, 175, 17), 0.811: RGB(170, 235, 41), 1: RGB(221, 255, 53)])  # disabled
preview_30 = CustomPreview(Geometry=boundary_30, Shader=gradient_2)  # disabled

# ---- group: proportions
number_slider_22 = Slider(30, range=0..100)  # disabled
curve_to_compare_to_4 = Curve([<curve referenced from the Rhino model> x261])  # disabled
divide_14 = DivideCurve(Curve=curve_to_compare_to_4, Count=number_slider_22, Kinks=False)  # -> Points, Tangents, Parameters; disabled
hull_10 = ConvexHull(Points=divide_14.Points, Plane=PlaneXY(0, 0, 0))  # -> Hull, HullZ, Indices; disabled
area_13 = Area(Geometry=hull_10.Hull)  # -> Area, Centroid; disabled
divide_15 = DivideCurve(Curve=hull_10.Hull, Count=number_slider_22, Kinks=False)  # -> Points, Tangents, Parameters; disabled
ln_6 = Line(StartPoint=area_13.Centroid, EndPoint=divide_15.Points)  # disabled
number_slider_23 = Slider(29, range=0..100)  # disabled
number_slider_24 = Slider(0, range=0..100)  # disabled
len_12 = Length(Curve=ln_6)  # disabled
sort_11 = SortList(Keys=len_12)  # -> Keys, ValuesA; disabled
item_24 = ListItem(List=sort_11.Keys, Index=number_slider_23, Wrap=True)  # disabled
item_25 = ListItem(List=sort_11.Keys, Index=number_slider_24, Wrap=True)  # disabled
number_slider_25 = Slider(1, range=0..1)  # disabled
division_8 = Division(A=item_24, B=item_25)  # -> flatten(Result); disabled
sort_12 = SortList(Keys=division_8, ValuesA=curve_to_compare_to_4)  # -> Keys, ValuesA; disabled
lng_18 = ListLength(List=sort_12.Keys)  # disabled
boundary_31 = BoundarySurfaces(Edges=sort_12.ValuesA)  # disabled
number_slider_26 = Slider(0, range=0..100)  # disabled
subtraction_7 = Subtraction(A=lng_18, B=number_slider_25)  # disabled
item_26 = ListItem(List=sort_12.Keys, Index=subtraction_7, Wrap=True)  # disabled
item_27 = ListItem(List=sort_12.Keys, Index=number_slider_26, Wrap=True)  # disabled
gradient_3 = Gradient(
    LowerLimit=item_27,
    UpperLimit=item_26,
    Parameter=sort_12.Keys,
    stops=[0: RGB(0, 98, 0), 0.25: RGB(81, 175, 17), 0.5: RGB(159, 198, 146), 0.75: RGB(170, 235, 41), 1: RGB(221, 255, 53)])  # disabled
preview_31 = CustomPreview(Geometry=boundary_31, Shader=gradient_3)  # disabled

# ----
path_mapper_13 = PathMapper(dist, source="{A;B}", target="{A}")  # disabled
number_slider_27 = Slider(15, range=0..200)  # disabled
shift_4 = ShiftList(List=cp_5.Points, Shift=1, Wrap=True)  # disabled
number_slider_28 = Slider(0.4463, range=0..1)  # disabled
lenseg = SegmentLengths(Curve=flatten(path_mapper_12))  # -> ShortestLength, ShortestDomain, LongestLength, LongestDomain
subtraction_8 = Subtraction(A=number_slider_19, B=1)  # disabled
sort_13 = SortList(Keys=path_mapper_13)  # -> Keys, ValuesA; disabled
divide_16 = DivideCurve(Curve=crv_23, Count=number_slider_27, Kinks=False)  # -> Points, Tangents, Parameters; disabled
dist_2 = Distance(PointA=cp_5.Points, PointB=shift_4)  # disabled
item_28 = ListItem(List=sort_13.Keys, Index=subtraction_8, Wrap=True)  # disabled
item_29 = ListItem(List=sort_13.Keys, Index=0, Wrap=True)  # disabled
path_mapper_14 = PathMapper(division_6, source="{A;B;C;D}", target="{C}")
extreme_pts_2 = PythonScript(x=simplify(divide_16.Points), y=number_slider_28)  # -> simplify(a); inputs x: list of Point3d; disabled; same code as extreme_pts
division_9 = Division(A=lenseg.ShortestLength, B=lenseg.LongestLength)  # -> flatten(Result)
multiplication_2 = Multiplication(A=division_6, B=division_9)

# ----
# make sure (extreme situation):
# In case of 5 points for square-
# to do not count the flatt angle..
distances = Number(simplify(dist_2))  # disabled
angles_deg = Number(py_clear_polyline_pts_2.angs)  # disabled
min_diameter = Number(item_29)  # disabled
max_diameter = Number(item_28)  # disabled
pt_extreme_points = Point(cp_5.Points)  # disabled
panel_5 = Panel("90")  # disabled
panel_6 = Panel("180")  # disabled
subtraction_9 = Subtraction(A=angles_deg, B=panel_5)  # disabled
subtraction_10 = Subtraction(A=angles_deg, B=panel_6)  # disabled
python_2 = PythonScript(Distances=distances)  # -> accAllPairsRatios; inputs Distances: tree; disabled
# ---------- python_2: Python ----------
import Rhino as R
import clr
clr.AddReference("Grasshopper")
from Grasshopper.Kernel.Data import GH_Path as ghPath
from Grasshopper import DataTree as ghTree

def find_len(a, b):
    return math.sqrt(math.pow((b[0] - a[0]), 2) + math.pow((b[1] - a[1]), 2))

accAllPairsRatios = ghTree[float]()

for formIdx in range(Distances.BranchCount):
    formDis = Distances.Branch(formIdx)
    path = ghPath(formIdx)
    accD = 0
    for i in range(len(formDis)):
        for j in range(len(formDis)):
            if i<j:
                d = abs(formDis[i] - formDis[j])
                accD += d
    accAllPairsRatios.Add(accD, path)
# ---------- end python_2 ----------
abs = Absolute(Value=subtraction_9)  # disabled
abs_2 = Absolute(Value=subtraction_10)  # disabled
division_10 = Division(A=min_diameter, B=max_diameter)  # disabled
lng_19 = ListLength(List=pt_extreme_points)  # disabled
min_3 = Minimum(A=abs, B=abs_2)  # disabled
ma_3 = MassAddition(Input=distances)  # -> Result, PartialResults; disabled
ma_4 = MassAddition(Input=abs)  # -> Result, PartialResults; disabled
division_11 = Division(A=python_2, B=ma_3.Result)  # disabled
division_12 = Division(A=ma_4.Result, B=lng_19)  # disabled
number_slider_29 = Slider(1, range=0..1)  # disabled
number_slider_30 = Slider(0.6, range=0..1)  # disabled
number_slider_31 = Slider(0.4, range=0..1)  # disabled
number_slider_32 = Slider(0.4, range=0..1)  # disabled
max_min_form_proportion = Number(division_10)  # disabled
num_of_extreme_points = Number(lng_19)  # disabled
accdifffrom90deg = Number(ma_4.Result)  # disabled
acc_pairs_ratio = Number(division_11)  # disabled

sort_14 = SortList(Keys=flatten(multiplication_2), ValuesA=geo)  # -> Keys, ValuesA
lng_20 = ListLength(List=sort_14.Keys)
subtraction_11 = Subtraction(A=lng_20, B=1)
boundary_32 = BoundarySurfaces(Edges=sort_14.ValuesA)
item_30 = ListItem(List=sort_14.Keys, Index=0, Wrap=True)
item_31 = ListItem(List=sort_14.Keys, Index=subtraction_11, Wrap=True)
gradient_4 = Gradient(
    LowerLimit=item_30,
    UpperLimit=item_31,
    Parameter=sort_14.Keys,
    stops=[0.142: RGB(255, 255, 255), 0.413: RGB(255, 120, 120), 0.716: RGB(255, 0, 0), 0.994: RGB(138, 0, 0)])
preview_32 = CustomPreview(Geometry=boundary_32, Shader=gradient_4)

toggle_2 = BooleanToggle(True)  # disabled
pline_3 = PolyLine(Vertices=cp_8.Points, Closed=toggle_2)  # disabled
panel_7 = Panel(acc_pairs_ratio)  # disabled
panel_8 = Panel("4")  # disabled
panel_9 = Panel("255")  # disabled
panel_10 = Panel("255")  # disabled
smaller_3 = SmallerThan(FirstNumber=num_of_extreme_points, SecondNumber=panel_8)  # -> SmallerThan, OrEqualTo; disabled
subtraction_12 = Subtraction(A=panel_9, B=accdifffrom90deg)  # disabled
multiplication_3 = Multiplication(A=panel_10, B=max_min_form_proportion)  # disabled
number_slider_33 = Slider(0.3, range=0..1)  # disabled
number_slider_34 = Slider(0.7, range=0..1)  # disabled
abs_3 = Absolute(Value=subtraction_12)  # disabled
lng_21 = ListLength(List=py_extreme_s_neighbors_2.treeExtPtsNeighbors)  # disabled
multiplication_4 = Multiplication(A=abs_3, B=number_slider_34)  # disabled
path_mapper_15 = PathMapper(lng_21, source="{A;B;C}", target="{A;B}")  # disabled
number_slider_35 = Slider(0.2, range=0..1)  # disabled
neg = Negative(Value=multiplication_4)  # disabled
multiplication_5 = Multiplication(A=smaller_3.SmallerThan, B=neg)  # disabled
multiplication_6 = Multiplication(A=multiplication_3, B=number_slider_33)  # disabled
multiplication_7 = Multiplication(A=number_slider_35, B=multiplication_5)  # disabled
ma_5 = MassAddition(Input=[multiplication_4, multiplication_7, multiplication_6])  # -> Result, PartialResults; disabled
# Extreme points in the same area..
# TODO: How to be sure I'll have a full tree,
# even in the case the neighbors are not close..
lng_22 = ListLength(List=path_mapper_15)  # -> flatten(Length); disabled
rectanglness = Number(ma_5.Result)  # disabled
rgb = ColourRGB(Alpha=255, Red=rectanglness, Green=0, Blue=0)  # -> flatten(Colour); disabled

sort_15 = SortList(Keys=flatten(acc_pairs_ratio), ValuesA=crv_5)  # -> Keys, ValuesA
lng_23 = ListLength(List=sort_15.Keys)
subtraction_13 = Subtraction(A=lng_23, B=1)
boundary_33 = BoundarySurfaces(Edges=sort_15.ValuesA)
item_32 = ListItem(List=sort_15.Keys, Index=0, Wrap=True)
item_33 = ListItem(List=sort_15.Keys, Index=subtraction_13, Wrap=True)
gradient_5 = Gradient(
    LowerLimit=item_32,
    UpperLimit=item_33,
    Parameter=sort_15.Keys,
    stops=[0: RGB(0, 98, 0), 0.34: RGB(159, 198, 146), 0.525: RGB(81, 175, 17), 0.811: RGB(170, 235, 41), 1: RGB(221, 255, 53)])
preview_33 = CustomPreview(Geometry=boundary_33, Shader=gradient_5)

sort_16 = SortList(Keys=flatten(accdifffrom90deg), ValuesA=crv_5)  # -> Keys, ValuesA
lng_24 = ListLength(List=sort_16.Keys)
subtraction_14 = Subtraction(A=lng_24, B=1)
boundary_34 = BoundarySurfaces(Edges=sort_16.ValuesA)
item_34 = ListItem(List=sort_16.Keys, Index=0, Wrap=True)
item_35 = ListItem(List=sort_16.Keys, Index=subtraction_14, Wrap=True)
gradient_6 = Gradient(
    LowerLimit=item_34,
    UpperLimit=item_35,
    Parameter=sort_16.Keys,
    stops=[0: RGB(0, 98, 0), 0.34: RGB(159, 198, 146), 0.525: RGB(81, 175, 17), 0.811: RGB(170, 235, 41), 1: RGB(221, 255, 53)])
preview_34 = CustomPreview(Geometry=boundary_34, Shader=gradient_6)

sort_17 = SortList(Keys=flatten(max_min_form_proportion), ValuesA=crv_5)  # -> Keys, ValuesA
lng_25 = ListLength(List=sort_17.Keys)
subtraction_15 = Subtraction(A=lng_25, B=1)
boundary_35 = BoundarySurfaces(Edges=sort_17.ValuesA)
item_36 = ListItem(List=sort_17.Keys, Index=0, Wrap=True)
item_37 = ListItem(List=sort_17.Keys, Index=subtraction_15, Wrap=True)
gradient_7 = Gradient(
    LowerLimit=item_36,
    UpperLimit=item_37,
    Parameter=sort_17.Keys,
    stops=[0.449: RGB(0, 98, 0), 0.577: RGB(159, 198, 146), 0.719: RGB(81, 175, 17), 0.864: RGB(170, 235, 41), 1: RGB(221, 255, 53)])
preview_35 = CustomPreview(Geometry=boundary_35, Shader=gradient_7)

sort_18 = SortList(Keys=flatten(rectanglness), ValuesA=crv_5)  # -> Keys, ValuesA
lng_26 = ListLength(List=sort_18.Keys)
subtraction_16 = Subtraction(A=lng_26, B=1)
boundary_36 = BoundarySurfaces(Edges=sort_18.ValuesA)
item_38 = ListItem(List=sort_18.Keys, Index=0, Wrap=True)
item_39 = ListItem(List=sort_18.Keys, Index=subtraction_16, Wrap=True)
gradient_8 = Gradient(
    LowerLimit=item_38,
    UpperLimit=item_39,
    Parameter=sort_18.Keys,
    stops=[0.344: RGB(255, 255, 255), 0.802: RGB(255, 0, 0), 0.994: RGB(138, 0, 0)])
preview_36 = CustomPreview(Geometry=boundary_36, Shader=gradient_8)

# ==== cluster ClstrCreateLines
C = ClusterInput()
N = ClusterInput()
A = ClusterInput()
divide = DivideCurve(Curve=C, Count=N, Kinks=False)  # -> Points, Tangents, Parameters
ln = Line(StartPoint=A, EndPoint=divide.Points)
L = ClusterOutput(ln)

# ==== cluster Cluster
curve_to_compare_to = ClusterInput()
curve_batch = ClusterInput()
accuracy = ClusterInput()
accuracy_2 = Integer(accuracy)
curve_to_compare_to_2 = Curve(curve_to_compare_to)
curve_batch_2 = Curve(curve_batch)
divide = DivideCurve(Curve=curve_batch_2, Count=accuracy_2, Kinks=False)  # -> Points, Tangents, Parameters
divide_2 = DivideCurve(Curve=curve_to_compare_to_2, Count=accuracy_2, Kinks=False)  # -> Points, Tangents, Parameters
hull = ConvexHull(Points=flatten(divide_2.Points), Plane=PlaneXY(0, 0, 0))  # -> Hull, HullZ, Indices
hull_2 = ConvexHull(Points=divide.Points, Plane=PlaneXY(0, 0, 0))  # -> Hull, HullZ, Indices
number_slider = Slider(100, range=99..100)
area = Area(Geometry=hull_2.Hull)  # -> Area, Centroid
area_2 = Area(Geometry=hull.Hull)  # -> Area, Centroid
expression = Expression(x=number_slider, y=area.Area, Expression="(x/y)^(1/2)")
expression_2 = Expression(x=number_slider, y=area_2.Area, Expression="(x/y)^(1/2)")
number_slider_2 = Slider(50, range=0..100)
scale = Scale(Geometry=hull.Hull, Center=area_2.Centroid, Factor=expression_2)  # -> Geometry, Transform
scale_2 = Scale(Geometry=hull_2.Hull, Center=area.Centroid, Factor=expression)  # -> Geometry, Transform
divide_3 = DivideCurve(Curve=scale_2.Geometry, Count=number_slider_2, Kinks=False)  # -> Points, Tangents, Parameters
divide_4 = DivideCurve(Curve=scale.Geometry, Count=number_slider_2, Kinks=False)  # -> Points, Tangents, Parameters
ln = Line(StartPoint=area.Centroid, EndPoint=divide_3.Points)
ln_2 = Line(StartPoint=area_2.Centroid, EndPoint=divide_4.Points)
len = Length(Curve=ln)
len_2 = Length(Curve=ln_2)
sort = SortList(Keys=len, ValuesA=ln)  # -> Keys, ValuesA
sort_2 = SortList(Keys=len_2, ValuesA=ln_2)  # -> Keys, ValuesA
rev = ReverseList(List=sort.ValuesA)
rev_2 = ReverseList(List=sort_2.ValuesA)
item = ListItem(List=rev, Index=0, Wrap=True)
item_2 = ListItem(List=rev_2, Index=0, Wrap=True)
line = Line(item)
line_2 = Line(item_2)
index = ItemIndex(List=ln, Item=line)
index_2 = ItemIndex(List=ln_2, Item=line_2)
shift = ShiftList(List=ln, Shift=index, Wrap=True)
shift_2 = ShiftList(List=ln_2, Shift=index_2, Wrap=True)
rev_3 = ReverseList(List=shift_2)
len_3 = Length(Curve=shift)
len_4 = Length(Curve=shift_2)
len_5 = Length(Curve=rev_3)
expression_3 = Expression(x=len_3, y=len_4, Expression="abs(x-y)")
expression_4 = Expression(x=len_3, y=len_5, Expression="abs(x-y)")
ma = MassAddition(Input=expression_3)  # -> Result, PartialResults
ma_2 = MassAddition(Input=expression_4)  # -> Result, PartialResults
min = Minimum(A=ma.Result, B=ma_2.Result)  # -> flatten(Result)
crv = Curve(curve_batch_2)
sort_3 = SortList(Keys=min, ValuesA=crv)  # -> Keys, ValuesA
panel = Panel(sort_3.Keys)
how_many_to_select = ClusterInput()
split = SplitList(List=sort_3.ValuesA, HowManyToSelect=how_many_to_select)  # -> BestFits, Remeinder
best_fits = ClusterOutput(split.BestFits)
remeinder = ClusterOutput(split.Remeinder)

# ==== cluster CompareAreas
curve_to_compare_to = ClusterInput()
curve_batch = ClusterInput()
curve_to_compare_to_2 = Curve(curve_to_compare_to)
curve_batch_2 = Curve(curve_batch)
area = Area(Geometry=curve_batch_2)  # -> Area, Centroid
area_2 = Area(Geometry=curve_to_compare_to_2)  # -> Area, Centroid
subtraction = Subtraction(A=area.Area, B=area_2.Area)
abs = Absolute(Value=subtraction)
how_many_to_select = ClusterInput()
sort = SortList(Keys=abs, ValuesA=curve_batch_2)  # -> Keys, ValuesA
split = SplitList(List=sort.ValuesA, HowManyToSelect=how_many_to_select)  # -> BestFits, Remeinder
best_fits = ClusterOutput(split.BestFits)
remeinder = ClusterOutput(split.Remeinder)
