# Grasshopper definition ControlPoints.gh (Grasshopper 0.9.76)

crv = Curve(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)
# Do what you want with these points..
cp = ControlPoints(Curve=crv)  # -> Points, Weights, Knots
pt = Point(cp.Points)
nurbs = NurbsCurve(Vertices=pt, Degree=3, Periodic=False)  # -> Curve, Length, Domain
crv_2 = Curve(nurbs.Curve)
