# Grasshopper definition GhPythonExample.gh (Grasshopper 0.9.76)
# plug-ins: Python Interpreter

plane = PlaneSrf(Plane=PlaneXY(0, 0, 0), XSize=Domain(-10, 10), YSize=Domain(-10, 10))
range = Range(Domain=Domain(0, 1), Steps=10)
srf = Surface(plane)
pt = PointXYZ(XComponent=range, YComponent=range, ZComponent=0)
iso = IsoCurve(Surface=reparameterize(srf), UVPoint=pt)  # -> UIsocurve, VIsocurve

# ---- group: Here you can input Lines
line = Line(iso.VIsocurve)

# ---- group: Here you can input Curves
crv = Curve(iso.UIsocurve)

# ----
python = PythonScript(Curves=crv, Lines=line, GhMemory=0)  # -> out, a; inputs Curves: list of Curve, Lines: list of Line
# ---------- python: Python ----------
# note that "Curves" is not equal to "curves"
# variables in python are case sensitive
print len(Curves)
print len(Lines)

# create an empty list
linesToKeep = []
# loop through the lines
for line in Lines:
    # if the length of this line is long enough
    if line.Length > 0.5:
        # add the line to our list of lines to keep
        linesToKeep.append( line )
# after the loop, output our list from a
a = linesToKeep
# ---------- end python ----------
panel = Panel(python.a)
