# Grasshopper definition GhPythonVoronoi.gh (Grasshopper 0.8.66)

# ---- group: Using Grasshopper Voronoi Function
pt = Point([Point(28.20225948, 19.55977507, 0), Point(23.30118001, 16.78746372, 0), Point(19.16334366, 21.33196522, 0), Point(11.48901529, 21.58540358, 0), Point(3.231785316, 16.03203513, 0), Point(19.1139974, 8.659670191, 0), Point(11.3587758, 6.139749172, 0)])
pt_2 = Point([Point(28.77603143, 1.542546775, 0), Point(6.053050258, -0.5835801183, 0), Point(-5.241998863, 24.26552795, 0), Point(35.42017797, 32.77003552, 0)])
python = PythonScript(voronoiPts=pt, outlinePts=pt_2)  # -> out, polylines; inputs voronoiPts: list of Point3d, outlinePts: list of Point3d
# ---------- python: Python ----------
"""
Inputs:
- voronoiPts = Point3D list
- outlinePts = Point3D list
Outputs:
- polylines = Polyline Curve list
"""

# Import Grasshopper using the .NET Common Language Runtime AddReference function
import clr
clr.AddReference("Grasshopper") 
import Grasshopper as gh

# Create a list of nodes from the input points
nodes = gh.Kernel.Geometry.Node2List()
for p in voronoiPts:
    n = gh.Kernel.Geometry.Node2(p.X,p.Y)
    nodes.Append(n)

# Create a list of outline nodes
outline = gh.Kernel.Geometry.Node2List()
for p in outlinePts:
    n = gh.Kernel.Geometry.Node2(p.X,p.Y)
    outline.Append(n)

# Create the voronoi diagram
voronoi = gh.Kernel.Geometry.Voronoi.Solver.Solve_BruteForce(nodes,outline)

# Get polylines from the voronoi cells and return them to GH
polylines = []
for c in voronoi:
    pl = c.ToPolyline()
    polylines.append(pl)
# ---------- end python ----------
crv = Curve(python.polylines)
