# Grasshopper definition IterateGhTreeUsingPython.gh (Grasshopper 0.8.66)

series = Series(Start=0, Step=1, Count=5)
series_2 = Series(Start=10, Step=1, Count=5)
series_3 = Series(Start=100, Step=1, Count=5)
entwine = Entwine(Branch00=series, Branch01=series_2, Branch02=series_3)  # -> simplify(Result)
python = PythonScript(tree=entwine)  # -> out, firstItems; inputs tree: tree
# ---------- python: Python ----------
firstItems = []
for i in range(tree.BranchCount):
    branchList = tree.Branch(i)
    firstItems.append(branchList[0])
# ---------- end python ----------
panel = Panel(python.firstItems)
