# Grasshopper definition pullCurvetoZ=0.gh (Grasshopper 0.9.76)

curve_mountains = Curve()
curve = Curve([<curve referenced from the Rhino model> x19])
# Surfaces- NOT WORKING!
surface = Surface(<surface referenced from the Rhino model>)
# Polylines
control_points = ControlPoints(Curve=curve)  # -> Points, Weights, Knots
surface_points = SurfacePoints(Surface=surface)  # -> Points, Weights, Greville, UCount, VCount
# NURB CURVES
control_points_2 = ControlPoints(Curve=curve_mountains)  # -> Points, Weights, Knots
deconstruct = Deconstruct(Point=control_points.Points)  # -> XComponent, YComponent, ZComponent
deconstruct_2 = Deconstruct(Point=surface_points.Points)  # -> XComponent, YComponent, ZComponent
deconstruct_3 = Deconstruct(Point=control_points_2.Points)  # -> XComponent, YComponent, ZComponent
point = Point(surface_points.Points)
construct_point = ConstructPoint(XCoordinate=deconstruct_2.XComponent, YCoordinate=deconstruct_2.YComponent, ZCoordinate=0)
panel = Panel(deconstruct_3.ZComponent)
construct_point_2 = ConstructPoint(XCoordinate=deconstruct_3.XComponent, YCoordinate=deconstruct_3.YComponent, ZCoordinate=0)
construct_point_3 = ConstructPoint(XCoordinate=deconstruct.XComponent, YCoordinate=deconstruct.YComponent, ZCoordinate=0)
surface_from_points = SurfaceFromPoints(Points=construct_point, Interpolate=False)
nurbs_curve = NurbsCurve(Vertices=construct_point_2, Degree=3, Periodic=False)  # -> Curve, Length, Domain
polyline = PolyLine(Vertices=construct_point_3, Closed=False)
curve_2 = Curve(nurbs_curve.Curve)
